% Simulink data dictionary APPTypes.sldd

DT_CAN1_SG_ABM1 = Simulink.Bus(HeaderFile="Rte_Type.h")
  CAN1_ABM_Passenger_ODS_Sta: uint8
  CAN1_ABM_RearPassengerCTR_ODS_Sta: uint8
  CAN1_ABM_RearPassengerLH_ODS_Sta: uint8
  CAN1_ABM_RearPassengerRH_ODS_Sta: uint8
  CAN1_AirBagFailCmd: uint8
  CAN1_Checksum_ABM1: uint8
  CAN1_CrashOutputSts: uint8
  CAN1_DriverSeatBeltCmd: uint8
  CAN1_LifeCount_ABM1: uint8
  CAN1_PABSwitchCmd: uint8
  CAN1_PsngrSeatBeltCmd: uint8
  CAN1_RCenterSeatBeltCmd: uint8
  CAN1_RDriverSeatBeltCmd: uint8
  CAN1_RPsngrSeatBeltCmd: uint8
  CAN1_TLHPsngrSeatBeltCmd: uint8
  CAN1_TRHPsngrSeatBeltCmd: uint8

DT_CAN1_SG_ESC1 = Simulink.Bus(HeaderFile="Rte_Type.h")
  CAN1_ABS_Active: uint8
  CAN1_ABS_Failed: uint8
  CAN1_ABS_WnlmpSta: uint8
  CAN1_AVH_Active: uint8
  CAN1_AVH_Failed: uint8
  CAN1_Amber_WnlmpSta: uint8
  CAN1_BTCS_Active: uint8
  CAN1_EBD_Active: uint8
  CAN1_EBD_Failed: uint8
  CAN1_ESC1_CS: uint8
  CAN1_ESC1_RC: uint8
  CAN1_ESC_Active: uint8
  CAN1_ESC_BeepReq: uint8
  CAN1_ESC_EstVehSpd: uint16
  CAN1_ESC_EstVehSpd_V: uint8
  CAN1_ESC_Failed: uint8
  CAN1_ESC_OFF_Status: uint8
  CAN1_ESC_Off_lmpSta: uint8
  CAN1_ESC_TSA_Active: uint8
  CAN1_ESC_WnlmpSta: uint8
  CAN1_ESS_Active: uint8
  CAN1_Fr_PTCS_Active: uint8
  CAN1_FrntAxlTrqReq_Drv: uint16
  CAN1_GRADE: uint8
  CAN1_HBB_Active: uint8
  CAN1_HBB_Failed: uint8
  CAN1_HDD_Active: uint8
  CAN1_HDD_Failed: uint8
  CAN1_HSA_Active: uint8
  CAN1_HSA_Failed: uint8
  CAN1_LF_PulseCount: uint8
  CAN1_LF_PulseCount_V: uint8
  CAN1_LF_RawWhlSpeed: uint16
  CAN1_LF_RawWhlSpeed_V: uint8
  CAN1_LF_WhlRotDir: uint8
  CAN1_LR_PulseCount: uint8
  CAN1_LR_PulseCount_V: uint8
  CAN1_LR_RawWhlSpeed: uint16
  CAN1_LR_RawWhlSpeed_V: uint8
  CAN1_LR_WhlRotDir: uint8
  CAN1_PBA_Active: uint8
  CAN1_PBA_Failed: uint8
  CAN1_RF_PulseCount: uint8
  CAN1_RF_PulseCount_V: uint8
  CAN1_RF_RawWhlSpeed: uint16
  CAN1_RF_RawWhlSpeed_V: uint8
  CAN1_RF_WhlRotDir: uint8
  CAN1_RR_PulseCount: uint8
  CAN1_RR_PulseCount_V: uint8
  CAN1_RR_RawWhlSpeed: uint16
  CAN1_RR_RawWhlSpeed_V: uint8
  CAN1_RR_WhlRotDir: uint8
  CAN1_RearAxlTrqReq_Drv: uint16
  CAN1_Red_WnlmpSta: uint8
  CAN1_Rr_PTCS_Active: uint8
  CAN1_SystemVoltage: uint8
  CAN1_TCS_Active: uint8
  CAN1_TCS_Failed: uint8
  CAN1_VehSpeed: uint16

DT_CAN1_SG_ESC5 = Simulink.Bus(HeaderFile="Rte_Type.h")
  CAN1_ACCAvail: uint8
  CAN1_AEBAvail: uint8
  CAN1_ActBrkLamp_Sta: uint8
  CAN1_BrkDiscTempSta: uint8
  CAN1_BrkPedalPos: uint8
  CAN1_BrkPedalPos_Sta: uint8
  CAN1_BrkSw_Sta: uint8
  CAN1_BrkSw_V: uint8
  CAN1_DecErrSta: uint8
  CAN1_ESC5_CS: uint8
  CAN1_ESC5_RC: uint8
  CAN1_ESC_ADAS_Sta: uint8
  CAN1_ESC_APS_Sta: uint8
  CAN1_ESC_DriverBrkOverride: uint8
  CAN1_ESC_Standstill: uint8
  CAN1_Fr_RBC_Active: uint8
  CAN1_FrntAxlTrqReq_Brk: uint16
  CAN1_LatAccel: uint8
  CAN1_LatAccel_V: uint8
  CAN1_LongAccel: uint8
  CAN1_LongAccel_V: uint8
  CAN1_MCPressure: uint16
  CAN1_MCPressure_V: uint8
  CAN1_Meter_Ind_VehSpeed: uint16
  CAN1_RDC_Active: uint8
  CAN1_RearAxlTrqReq_Brk: uint16
  CAN1_Rr_RBC_Active: uint8
  CAN1_YawRate: uint16
  CAN1_YawRate_V: uint8

DT_CAN1_SG_eBST1 = Simulink.Bus(HeaderFile="Rte_Type.h")
  CAN1_LowBrakeFluid_Sta: uint8
  CAN1_eBST_AmberWnlmpSta: uint8
  CAN1_eBST_BeepReq: uint8
  CAN1_eBST_RedWnlmpSta: uint8

DT_CAN2_SG_IVI3 = Simulink.Bus(HeaderFile="Rte_Type.h")
  CAN2_IVI_CLBlower_Y_Sta: uint8
  CAN2_IVI_CLBlower_Z_Sta: uint8
  CAN2_IVI_CRBlower_Y_Sta: uint8
  CAN2_IVI_CRBlower_Z_Sta: uint8
  CAN2_IVI_DrBlower_Mode_Sta: uint8
  CAN2_IVI_DrBlower_Y_Sta: uint8
  CAN2_IVI_DrBlower_Z_Sta: uint8
  CAN2_IVI_HMI_CustmiFun_Sta: uint8
  CAN2_IVI_HMI_CustmiKEY_Sta: uint8
  CAN2_IVI_LSEATvent_Cmd: uint8
  CAN2_IVI_MLFMost_Cmd: uint8
  CAN2_IVI_MLFootLift_Cmd: uint8
  CAN2_IVI_MLNapMode_Cmd: uint8
  CAN2_IVI_MLRecliner_Cmd: uint8
  CAN2_IVI_MLRestore_Cmd: uint8
  CAN2_IVI_MLSEATvent_Cmd: uint8
  CAN2_IVI_MLSeatLift_Cmd: uint8
  CAN2_IVI_MLSldRestore_Cmd: uint8
  CAN2_IVI_MLSlider_Cmd: uint8
  CAN2_IVI_MLZeroGravity_Cmd: uint8
  CAN2_IVI_MRFMost_Cmd: uint8
  CAN2_IVI_MRFootLift_Cmd: uint8
  CAN2_IVI_MRNapMode_Cmd: uint8
  CAN2_IVI_MRRecliner_Cmd: uint8
  CAN2_IVI_MRRestore_Cmd: uint8
  CAN2_IVI_MRSEATvent_Cmd: uint8
  CAN2_IVI_MRSeatLift_Cmd: uint8
  CAN2_IVI_MRSldRestore_Cmd: uint8
  CAN2_IVI_MRSlider_Cmd: uint8
  CAN2_IVI_MRZeroGravity_Cmd: uint8
  CAN2_IVI_PsBlower_Mode_Sta: uint8
  CAN2_IVI_PsBlower_Y_Sta: uint8
  CAN2_IVI_PsBlower_Z_Sta: uint8
  CAN2_IVI_RSEATvent_Cmd: uint8
  CAN2_IVI_RollMod_atCarWash_Sta: uint8
  CAN2_IVI_SOS_Call_Sta: uint8
  CAN2_IVI_SnowMode_Cmd: uint8
  CAN2_IVI_UserTakeOver_APS_Sta: uint8
  CAN2_IVI_XWDMode_Cmd: uint8
  CAN2_IVI_Zon1WindDirSWReq_Sta: uint8

DT_CAN2_SG_METER1 = Simulink.Bus(HeaderFile="Rte_Type.h")
  CAN2_APCforDTE: uint16
  CAN2_AVGPwrConsumption: uint16
  CAN2_AvailableTrip: uint16
  CAN2_Averaged_vehspeed: uint16
  CAN2_Charge: uint8
  CAN2_LEDlitWarnReq: uint8
  CAN2_METER_KPH_Calcu: uint8
  CAN2_METER_KPH_Real: uint16
  CAN2_METER_MPH_Calcu: uint8
  CAN2_METER_MPH_Real: uint16
  CAN2_ODOMETER: uint32
  CAN2_ParkBrake: uint8
  CAN2_Spd_Crl_Mode: uint8
  CAN2_Spd_Crl_Sta: uint8
  CAN2_Trip_A: uint32
  CAN2_Trip_B: uint32

DT_CAN3_SG_BMS1 = Simulink.Bus(HeaderFile="Rte_Type.h")
  CAN3_BMSChckSum_1: uint8
  CAN3_BMSRolCnct_1: uint8
  CAN3_HVBPwrAvailChrg: uint16
  CAN3_HVBPwrAvailChrg30: uint16
  CAN3_HVBPwrAvailChrg60: uint16
  CAN3_HVBPwrAvailDchrg: uint16
  CAN3_HVBPwrAvailDchrg30: uint16
  CAN3_HVBPwrAvailDchrg60: uint16
  CAN3_HVBattCurr: uint16
  CAN3_HVBattVolt: uint16

DT_CAN3_SG_BMS3 = Simulink.Bus(HeaderFile="Rte_Type.h")
  CAN3_ACChrgCurrDis: uint16
  CAN3_BMS_HVBattCellBalance_Sta: uint8
  CAN3_BMS_HVBattSOCDiff_Sta: uint8
  CAN3_BMS_SOC_UseLimit_Sta: uint8
  CAN3_Battsystfail_Num: uint8
  CAN3_CellType: uint8
  CAN3_ChrgCurType: uint8
  CAN3_ChrgLampSta: uint8
  CAN3_FireDetErr: uint8
  CAN3_HVBChrgPwr: uint16
  CAN3_HVBChrgPwrTotal: uint32
  CAN3_HVBDrvPwr: uint16
  CAN3_HVBDrvPwrTotal: uint32
  CAN3_HVBFullChrgPwr: uint16
  CAN3_HVBIsoImpedenceN: uint16
  CAN3_HVBIsoImpedenceP: uint16
  CAN3_HVBSOH: uint8
  CAN3_HVBattErr: uint8
  CAN3_HVBattPackVolt: uint16
  CAN3_HVBattSOC: uint8
  CAN3_HVBattSOCDis: uint8
  CAN3_RechrgCyc: uint32
  CAN3_RemainChrgTime: uint16

DT_CAN3_SG_BMS5 = Simulink.Bus(HeaderFile="Rte_Type.h")
  CAN3_DCPortNeg_Temp: uint8
  CAN3_DCPortPos_Temp: uint8
  CAN3_HVInVolt: uint16
  CAN3_LVBattDet12V: uint8
  CAN3_OBCACCSLimit: uint8
  CAN3_OBCDCCurLm: uint16
  CAN3_OBCDCVoltLm: uint16
  CAN3_OBCEna: uint8
  CAN3_ReChargerStaFromEvcc: uint8

DT_CAN3_SG_BMS6 = Simulink.Bus(HeaderFile="Rte_Type.h")
  CAN3_BMSChckSum: uint8
  CAN3_BMSRolCnct: uint8
  CAN3_BMS_READY: uint8
  CAN3_BMS_Warn_1: uint8
  CAN3_BMS_Warn_2: uint8
  CAN3_BMS_Warn_3: uint8
  CAN3_BMS_Warn_4: uint8
  CAN3_BMS_Warn_5: uint8
  CAN3_BMS_Warn_6: uint8
  CAN3_BMS_Warn_7: uint8
  CAN3_BMS_Warn_8: uint8
  CAN3_CellUnconsistErr: uint8
  CAN3_ChrgInLockReq: uint8
  CAN3_ChrgPlugSta: uint8
  CAN3_DCChrgSysShockErr: uint8
  CAN3_DisChrgPlugErr: uint8
  CAN3_ExtChrgSta: uint8
  CAN3_HVBCellOvrVoltErr: uint8
  CAN3_HVBCellOvrVoltWarn: uint8
  CAN3_HVBCellUdrVoltWarn: uint8
  CAN3_HVBCellUnbalanErr: uint8
  CAN3_HVBCellUndrVoltErr: uint8
  CAN3_HVBChrgErr: uint8
  CAN3_HVBContactorSta: uint8
  CAN3_HVBHVILErr: uint8
  CAN3_HVBOvrChrgCurrErr: uint8
  CAN3_HVBOvrDchrgCurErr: uint8
  CAN3_HVBOvrSOCErr: uint8
  CAN3_HVBOvrTempErr: uint8
  CAN3_HVBOvrTempWarn: uint8
  CAN3_HVBOvrVoltErr: uint8
  CAN3_HVBPrechrgSta: uint8
  CAN3_HVBPreheatPrecoolSta: uint8
  CAN3_HVBSOCJumpError: uint8
  CAN3_HVBShrtChrgCurrErr: uint8
  CAN3_HVBShrtDischrgCurrErr: uint8
  CAN3_HVBTempDiffErr: uint8
  CAN3_HVBUndrSOCErr: uint8
  CAN3_HVBUndrTempErr: uint8
  CAN3_HVBUndrTempWarn: uint8
  CAN3_HVBUndrVoltErr: uint8
  CAN3_HVBattReady4Pre: uint8
  CAN3_HVILSta: uint8
  CAN3_IsoDetSta: uint8
  CAN3_SystemUncomErr: uint8
  CAN3_V2LSta: uint8

DT_CAN3_SG_CCU1 = Simulink.Bus(HeaderFile="Rte_Type.h")
  CAN3_CS_CCU1: uint8
  CAN3_DCDCAuxCur: uint16
  CAN3_DCDCAuxVolt: uint8
  CAN3_DCDCHVCur: uint16
  CAN3_DCDCInVoltInf: uint16
  CAN3_DCDCPreCompleted: uint8
  CAN3_OBCDCCurrInf: uint16
  CAN3_OBCDCVoltInf: uint16
  CAN3_OBCPreCompleted: uint8
  CAN3_OBCV2LINVOTP: uint8
  CAN3_OBCV2LInsuFault: uint8
  CAN3_OBCV2LVinOVP: uint8
  CAN3_OBCV2LVinUVP: uint8
  CAN3_OBCV2LVoutOCP: uint8
  CAN3_OBCV2LVoutOVP: uint8
  CAN3_OBCV2LVoutUVP: uint8
  CAN3_OBCWakeup4Plugin: uint8
  CAN3_RC_CCU1: uint8

DT_CAN3_SG_CCU2 = Simulink.Bus(HeaderFile="Rte_Type.h")
  CAN3_CS_CCU2: uint8
  CAN3_DCDCEnaSta: uint8
  CAN3_DCDCFaultSta: uint8
  CAN3_DCDCReady4Pre: uint8
  CAN3_DCDCTemp: uint8
  CAN3_OBCACCurrInf: uint16
  CAN3_OBCACVoltInf: uint16
  CAN3_OBCDCP: uint16
  CAN3_OBCEnaSta: uint8
  CAN3_OBCFaultSta: uint8
  CAN3_OBCPluginSta: uint8
  CAN3_OBCReady4Pre: uint8
  CAN3_OBCRlySta: uint8
  CAN3_OBCTemp: uint16
  CAN3_OBCV2LSta: uint8
  CAN3_OBC_AC_Cur_Lim: uint8
  CAN3_RC_CCU2: uint8

DT_CAN3_SG_EBM1 = Simulink.Bus(HeaderFile="Rte_Type.h")
  CAN3_EBM1_CS: uint8
  CAN3_EBM1_RC: uint8
  CAN3_EBMErrSta: uint8
  CAN3_EBMRLampSta: uint8
  CAN3_EBMSta: uint8

DT_CAN3_SG_MCU_B_F1 = Simulink.Bus(HeaderFile="Rte_Type.h")
  CAN3_Fr_ActvDmpDisabSta: uint8
  CAN3_Fr_EDUDrtSta: uint8
  CAN3_Fr_EDUOpratingSta: uint8
  CAN3_Fr_EDURealTMTq: uint16
  CAN3_Fr_EDURotateDirction: uint8
  CAN3_Fr_EDUTqReqFbk: uint16
  CAN3_Fr_MCU1Chksum: uint8
  CAN3_Fr_MCU1RolCnt: uint8
  CAN3_Fr_MCUBAT: uint8
  CAN3_Fr_MCUDCBusCurr: uint16
  CAN3_Fr_MCUDCBusVolt: uint16
  CAN3_Fr_MCUDischrgSta: uint8
  CAN3_Fr_MCUEnaSta: uint8
  CAN3_Fr_MCUErr: uint8
  CAN3_Fr_MCUIGN_sta: uint8
  CAN3_Fr_MCUReady: uint8
  CAN3_Fr_MCUReady4Pre: uint8
  CAN3_Fr_MCUSysSta: uint8
  CAN3_Fr_MCUTemp: uint16
  CAN3_Fr_MotorAvailTq: uint16
  CAN3_Fr_RegenAvailTq: uint16
  CAN3_Fr_Reserved_bits: uint8
  CAN3_Fr_TMSpd: uint16
  CAN3_Fr_TMTemp: uint16
  CAN3_Fr_TMid: uint16
  CAN3_Fr_TMiq: uint16
  CAN3_MCUWarn_F: uint8
  CAN3_MCU_B_F_IGBTDdeTemp_Sta: uint16
  CAN3_MCU_B_F_RealPwrKw_Sta: uint16

DT_CAN3_SG_MCU_B_F2 = Simulink.Bus(HeaderFile="Rte_Type.h")
  CAN3_Fr_CoolanttempReq: uint16
  CAN3_Fr_Failcode1: uint8
  CAN3_Fr_Failcode2: uint8
  CAN3_Fr_Failcodehistory1: uint8
  CAN3_Fr_Failcodehistory2: uint8
  CAN3_Fr_LLCTemp: uint16
  CAN3_Fr_LLCflowReq: uint8
  CAN3_Fr_MCU2Chksum: uint8
  CAN3_Fr_MCU2RolCnt: uint8
  CAN3_Fr_MCUTempWarn: uint8
  CAN3_Fr_MCU_HW_Ver: uint16
  CAN3_Fr_MCU_SW_Ver: uint16
  CAN3_Fr_TMTempWarn: uint8
  CAN3_MCU_B_F_FailLv_Sta: uint8
  CAN3_MCU_B_F_KL302TqCnt_Sta: uint8
  CAN3_MCU_B_F_LLCTempWarn_Sta: uint8

DT_CAN3_SG_MCU_B_R1 = Simulink.Bus(HeaderFile="Rte_Type.h")
  CAN3_MCUWarn_R: uint8
  CAN3_MCU_B_R_IGBTDdeTemp_Sta: uint16
  CAN3_MCU_B_R_RealPwrKw_Sta: uint16
  CAN3_Rr_ActvDmpDisabSta: uint8
  CAN3_Rr_EDUDrtSta: uint8
  CAN3_Rr_EDUOpratingSta: uint8
  CAN3_Rr_EDURealTMTq: uint16
  CAN3_Rr_EDURotateDirction: uint8
  CAN3_Rr_EDUTqReqFbk: uint16
  CAN3_Rr_MCU1Chksum: uint8
  CAN3_Rr_MCU1RolCnt: uint8
  CAN3_Rr_MCUBAT: uint8
  CAN3_Rr_MCUDCBusCurr: uint16
  CAN3_Rr_MCUDCBusVolt: uint16
  CAN3_Rr_MCUDischrgSta: uint8
  CAN3_Rr_MCUEnaSta: uint8
  CAN3_Rr_MCUErr: uint8
  CAN3_Rr_MCUIGN_sta: uint8
  CAN3_Rr_MCUReady: uint8
  CAN3_Rr_MCUReady4Pre: uint8
  CAN3_Rr_MCUSysSta: uint8
  CAN3_Rr_MCUTemp: uint16
  CAN3_Rr_MotorAvailTq: uint16
  CAN3_Rr_RegenAvailTq: uint16
  CAN3_Rr_Reserved_bits: uint8
  CAN3_Rr_TMSpd: uint16
  CAN3_Rr_TMTemp: uint16
  CAN3_Rr_TMid: uint16
  CAN3_Rr_TMiq: uint16

DT_CAN3_SG_MCU_B_R2 = Simulink.Bus(HeaderFile="Rte_Type.h")
  CAN3_MCU_B_R_FailLv_Sta: uint8
  CAN3_MCU_B_R_KL302TqCnt_Sta: uint8
  CAN3_MCU_B_R_LLCTempWarn_Sta: uint8
  CAN3_Rr_CoolanttempReq: uint16
  CAN3_Rr_Failcode1: uint8
  CAN3_Rr_Failcode2: uint8
  CAN3_Rr_Failcodehistory1: uint8
  CAN3_Rr_Failcodehistory2: uint8
  CAN3_Rr_LLCTemp: uint16
  CAN3_Rr_LLCflowReq: uint8
  CAN3_Rr_MCU2Chksum: uint8
  CAN3_Rr_MCU2RolCnt: uint8
  CAN3_Rr_MCU3_HW_Ver: uint16
  CAN3_Rr_MCU3_SW_Ver: uint16
  CAN3_Rr_MCUTempWarn: uint8
  CAN3_Rr_TMTempWarn: uint8

DT_CAN3_SG_MCU_N_F1 = Simulink.Bus(HeaderFile="Rte_Type.h")
  CAN3_Fr_ActvDmpDisabSta_Nidec: uint8
  CAN3_Fr_EDUDrtSta_Nidec: uint8
  CAN3_Fr_EDUOpratingSta_Nidec: uint8
  CAN3_Fr_EDURealTMTq_Nidec: uint16
  CAN3_Fr_EDURotateDirction_Nidec: uint8
  CAN3_Fr_EDUTqReqFbk_Nidec: uint16
  CAN3_Fr_MCU1Chksum_Nidec: uint8
  CAN3_Fr_MCU1RolCnt_Nidec: uint8
  CAN3_Fr_MCUBAT_Nidec: uint8
  CAN3_Fr_MCUDCBusCurr_Nidec: uint16
  CAN3_Fr_MCUDCBusVolt_Nidec: uint16
  CAN3_Fr_MCUDischrgSta_Nidec: uint8
  CAN3_Fr_MCUEnaSta_Nidec: uint8
  CAN3_Fr_MCUErr_Nidec: uint8
  CAN3_Fr_MCUIGN_sta_Nidec: uint8
  CAN3_Fr_MCUReady4Pre_Nidec: uint8
  CAN3_Fr_MCUReady_Nidec: uint8
  CAN3_Fr_MCUSysSta_Nidec: uint8
  CAN3_Fr_MCUTemp_Nidec: uint16
  CAN3_Fr_MotorAvailTq_Nidec: uint16
  CAN3_Fr_RegenAvailTq_Nidec: uint16
  CAN3_Fr_Reserved_bits_Nidec: uint8
  CAN3_Fr_TMSpd_Nidec: uint16
  CAN3_Fr_TMTemp_Nidec: uint16
  CAN3_Fr_TMid_Nidec: uint16
  CAN3_Fr_TMiq_Nidec: uint16
  CAN3_MCUWarn_F_Nidec: uint8

DT_CAN3_SG_MCU_N_F2 = Simulink.Bus(HeaderFile="Rte_Type.h")
  CAN3_Fr_CoolanttempReq_Nidec: uint16
  CAN3_Fr_EOP_SpdSet_Nidec: uint16
  CAN3_Fr_Failcode1_Nidec: uint8
  CAN3_Fr_Failcode2_Nidec: uint8
  CAN3_Fr_Failcodehistory1_Nidec: uint8
  CAN3_Fr_Failcodehistory2_Nidec: uint8
  CAN3_Fr_LLCTemp_Nidec: uint16
  CAN3_Fr_LLCflowReq_Nidec: uint8
  CAN3_Fr_MCU2Chksum_Nidec: uint8
  CAN3_Fr_MCU2RolCnt_Nidec: uint8
  CAN3_Fr_MCUTempWarn_Nidec: uint8
  CAN3_Fr_TMTempWarn_Nidec: uint8
  CAN3_MCU_F_ResetCnt_Sta: uint8

DT_CAN3_SG_MCU_N_F3 = Simulink.Bus(HeaderFile="Rte_Type.h")
  CAN3_Fr_MCU_HW_Ver_Nidec: uint16
  CAN3_Fr_MCU_SW_Ver_Nidec: uint16

DT_CAN3_SG_MCU_N_R1 = Simulink.Bus(HeaderFile="Rte_Type.h")
  CAN3_MCUWarn_R_Nidec: uint8
  CAN3_Rr_ActvDmpDisabSta_Nidec: uint8
  CAN3_Rr_EDUDrtSta_Nidec: uint8
  CAN3_Rr_EDUOpratingSta_Nidec: uint8
  CAN3_Rr_EDURealTMTq_Nidec: uint16
  CAN3_Rr_EDURotateDirction_Nidec: uint8
  CAN3_Rr_EDUTqReqFbk_Nidec: uint16
  CAN3_Rr_MCU1Chksum_Nidec: uint8
  CAN3_Rr_MCU1RolCnt_Nidec: uint8
  CAN3_Rr_MCUBAT_Nidec: uint8
  CAN3_Rr_MCUDCBusCurr_Nidec: uint16
  CAN3_Rr_MCUDCBusVolt_Nidec: uint16
  CAN3_Rr_MCUDischrgSta_Nidec: uint8
  CAN3_Rr_MCUEnaSta_Nidec: uint8
  CAN3_Rr_MCUErr_Nidec: uint8
  CAN3_Rr_MCUIGN_sta_Nidec: uint8
  CAN3_Rr_MCUReady4Pre_Nidec: uint8
  CAN3_Rr_MCUReady_Nidec: uint8
  CAN3_Rr_MCUSysSta_Nidec: uint8
  CAN3_Rr_MCUTemp_Nidec: uint16
  CAN3_Rr_MotorAvailTq_Nidec: uint16
  CAN3_Rr_RegenAvailTq_Nidec: uint16
  CAN3_Rr_Reserved_bits_Nidec: uint8
  CAN3_Rr_TMSpd_Nidec: uint16
  CAN3_Rr_TMTemp_Nidec: uint16
  CAN3_Rr_TMid_Nidec: uint16
  CAN3_Rr_TMiq_Nidec: uint16

DT_CAN3_SG_MCU_N_R2 = Simulink.Bus(HeaderFile="Rte_Type.h")
  CAN3_MCU_R_ResetCnt_Sta: uint8
  CAN3_Rr_CoolanttempReq_Nidec: uint16
  CAN3_Rr_EOP_SpdSet_Nidec: uint16
  CAN3_Rr_Failcode1_Nidec: uint8
  CAN3_Rr_Failcode2_Nidec: uint8
  CAN3_Rr_Failcodehistory1_Nidec: uint8
  CAN3_Rr_Failcodehistory2_Nidec: uint8
  CAN3_Rr_LLCTemp_Nidec: uint16
  CAN3_Rr_LLCflowReq_Nidec: uint8
  CAN3_Rr_MCU2Chksum_Nidec: uint8
  CAN3_Rr_MCU2RolCnt_Nidec: uint8
  CAN3_Rr_MCUTempWarn_Nidec: uint8
  CAN3_Rr_TMTempWarn_Nidec: uint8

DT_CAN3_SG_MCU_N_R3 = Simulink.Bus(HeaderFile="Rte_Type.h")
  CAN3_Rr_MCU3_HW_Ver_Nidec: uint16
  CAN3_Rr_MCU3_SW_Ver_Nidec: uint16

DT_CAN3_SG_Shifter1 = Simulink.Bus(HeaderFile="Rte_Type.h")
  CAN3_Shifter_CRC8: uint8
  CAN3_Shifter_Fail_sta: uint8
  CAN3_Shifter_Handle_Cmd: uint8
  CAN3_Shifter_RC: uint8

DT_CAN4_SG_BodyZone_PS1 = Simulink.Bus(HeaderFile="Rte_Type.h")
  CAN4_BP_PSEAT_Error_Sta: uint8
  CAN4_BP_PSEAT_Mode_Sta: uint8
  CAN4_BP_PSEAT_Vent_Sta: uint8
  CAN4_BP_PSEAT_heater_Sta: uint8
  CAN4_BP_PTG_AbuseProtection_Sta: uint8
  CAN4_BP_PTG_Active_Sta: uint8
  CAN4_BP_PTG_CinchCur_Sta: uint16
  CAN4_BP_PTG_CinchDuty_Sta: uint8
  CAN4_BP_PTG_DebugMode_Sta: uint8
  CAN4_BP_PTG_ErrHall_Sta: uint8
  CAN4_BP_PTG_ErrLatch_Sta: uint8
  CAN4_BP_PTG_ErrLeftStrut_Sta: uint8
  CAN4_BP_PTG_ErrRightStrut_Sta: uint8
  CAN4_BP_PTG_ErrVoltage_Sta: uint8
  CAN4_BP_PTG_Exist_Sta: uint8
  CAN4_BP_PTG_FullSW_Sta: uint8
  CAN4_BP_PTG_HalfSW_Sta: uint8
  CAN4_BP_PTG_InsideSW1_Sta: uint8
  CAN4_BP_PTG_InsideSW2_Sta: uint8
  CAN4_BP_PTG_IsSetHeight_Sta: uint8
  CAN4_BP_PTG_LatchSeg_Sta: uint8
  CAN4_BP_PTG_LatchThermal_Sta: uint8
  CAN4_BP_PTG_LeftCur_Sta: uint16
  CAN4_BP_PTG_LeftDuty_Sta: uint8
  CAN4_BP_PTG_LeftHallPosn_Sta: uint16
  CAN4_BP_PTG_NtlSW_Sta: uint8
  CAN4_BP_PTG_OpenRatio_Sta: uint8
  CAN4_BP_PTG_PowerLatch_Sta: uint8
  CAN4_BP_PTG_RDIL_Cmd: uint8
  CAN4_BP_PTG_ReleaseCur_Sta: uint16
  CAN4_BP_PTG_RightCur_Sta: uint16
  CAN4_BP_PTG_RightDuty_Sta: uint8
  CAN4_BP_PTG_RightHallPosn_Sta: uint16
  CAN4_BP_PTG_StrutAntiPinch_Sta: uint8
  CAN4_BP_PTG_StrutStall_Sta: uint8
  CAN4_BP_PTG_StrutThermal_Sta: uint8
  CAN4_BP_PTG_Sys_Sta: uint8

DT_CAN4_SG_DKC1 = Simulink.Bus(HeaderFile="Rte_Type.h")
  CAN4_DKC_KeyNum_Sta: uint8
  CAN4_DKC_KeyType_Sta: uint8
  CAN4_DKC_PDkeyAreaRAPS_Sta: uint8
  CAN4_DKC_P_BLE_RSSI: uint8
  CAN4_DKC_P_UID_BatVolt: uint16
  CAN4_DKC_ParkingMode_Cmd: uint8
  CAN4_DKC_Re_VehData: uint8
  CAN4_P_CommandToBCM: uint8
  CAN4_P_CommandToPTG: uint8
  CAN4_P_DKey_Area_LockUnlock: uint8
  CAN4_P_DKey_Area_PS: uint8
  CAN4_P_DKey_Area_PTG: uint8
  CAN4_P_DKey_Welcome: uint8
  CAN4_P_Dkey_Show_IVI: uint8
  CAN4_P_KeyMiss: uint8
  CAN4_P_KeyMode: uint8
  CAN4_P_UID_LowPower: uint8

DT_CAN4_SG_PTG1 = Simulink.Bus(HeaderFile="Rte_Type.h")
  CAN4_PTG_Active_Sta: uint8
  CAN4_PTG_AutoStaus: uint8
  CAN4_PTG_Cinch_Current: uint8
  CAN4_PTG_Exist: uint8
  CAN4_PTG_Full_Lock: uint8
  CAN4_PTG_HW_Ver: uint8
  CAN4_PTG_Half_Lock: uint8
  CAN4_PTG_Inner_SW_1: uint8
  CAN4_PTG_Inner_SW_2: uint8
  CAN4_PTG_Is_Set_Height: uint8
  CAN4_PTG_Open_Ratio: uint8
  CAN4_PTG_RDIL_Sta: uint8
  CAN4_PTG_SW_Ver: uint8
  CAN4_PTG_Strut_Current: uint8
  CAN4_PTG_Sys_Sta: uint8
  CAN4_PTG_Warning_Sta: uint8

DT_CAN4_SG_ZONE_DR1 = Simulink.Bus(HeaderFile="Rte_Type.h")
  CAN4_ACT1_Actuator_address: uint8
  CAN4_ACT1_Actuator_set_position: uint16
  CAN4_ACT1_Actuator_start_position: uint16
  CAN4_ACT1_Applied_holding_current: uint8
  CAN4_ACT1_Clear_Event_Flags: uint8
  CAN4_ACT1_Emergency_run_position: uint8
  CAN4_ACT1_Emergency_run_release: uint8
  CAN4_ACT1_Rotation_direction: uint8
  CAN4_ACT1_Save_programming_data: uint8
  CAN4_ACT1_Select_position_specification: uint8
  CAN4_ACT1_Speed_specification: uint8
  CAN4_ACT1_Stall_detection_release: uint8
  CAN4_ACT1_Stop_mode: uint8
  CAN4_ACT2_Actuator_address: uint8
  CAN4_ACT2_Actuator_set_position: uint16
  CAN4_ACT2_Actuator_start_position: uint16
  CAN4_ACT2_Applied_holding_current: uint8
  CAN4_ACT2_Clear_Event_Flags: uint8
  CAN4_ACT2_Emergency_run_position: uint8
  CAN4_ACT2_Emergency_run_release: uint8
  CAN4_ACT2_Rotation_direction: uint8
  CAN4_ACT2_Save_programming_data: uint8
  CAN4_ACT2_Select_position_specification: uint8
  CAN4_ACT2_Speed_specification: uint8
  CAN4_ACT2_Stall_detection_release: uint8
  CAN4_ACT2_Stop_mode: uint8
  CAN4_ACT3_Actuator_address: uint8
  CAN4_ACT3_Actuator_set_position: uint16
  CAN4_ACT3_Actuator_start_position: uint16
  CAN4_ACT3_Applied_holding_current: uint8
  CAN4_ACT3_Clear_Event_Flags: uint8
  CAN4_ACT3_Emergency_run_position: uint8
  CAN4_ACT3_Emergency_run_release: uint8
  CAN4_ACT3_Rotation_direction: uint8
  CAN4_ACT3_Save_programming_data: uint8
  CAN4_ACT3_Select_position_specification: uint8
  CAN4_ACT3_Speed_specification: uint8
  CAN4_ACT3_Stall_detection_release: uint8
  CAN4_ACT3_Stop_mode: uint8
  CAN4_ACT4_Actuator_address: uint8
  CAN4_ACT4_Actuator_set_position: uint16
  CAN4_ACT4_Actuator_start_position: uint16
  CAN4_ACT4_Applied_holding_current: uint8
  CAN4_ACT4_Clear_Event_Flags: uint8
  CAN4_ACT4_Emergency_run_position: uint8
  CAN4_ACT4_Emergency_run_release: uint8
  CAN4_ACT4_Rotation_direction: uint8
  CAN4_ACT4_Save_programming_data: uint8
  CAN4_ACT4_Select_position_specification: uint8
  CAN4_ACT4_Speed_specification: uint8
  CAN4_ACT4_Stall_detection_release: uint8
  CAN4_ACT4_Stop_mode: uint8
  CAN4_ACT5_Actuator_address: uint8
  CAN4_ACT5_Actuator_set_position: uint16
  CAN4_ACT5_Actuator_start_position: uint16
  CAN4_ACT5_Applied_holding_current: uint8
  CAN4_ACT5_Clear_Event_Flags: uint8
  CAN4_ACT5_Emergency_run_position: uint8
  CAN4_ACT5_Emergency_run_release: uint8
  CAN4_ACT5_Rotation_direction: uint8
  CAN4_ACT5_Save_programming_data: uint8
  CAN4_ACT5_Select_position_specification: uint8
  CAN4_ACT5_Speed_specification: uint8
  CAN4_ACT5_Stall_detection_release: uint8
  CAN4_ACT5_Stop_mode: uint8
  CAN4_AllLockSta: uint8
  CAN4_AutoLightSW: uint8
  CAN4_BrakeLampFail: uint8
  CAN4_DrLockSta: uint8
  CAN4_HornSW: uint8
  CAN4_MIRROR_FOLD_SW: uint8
  CAN4_PsLockSta: uint8
  CAN4_RLLockSta: uint8
  CAN4_RLS_Exist: uint8
  CAN4_RLTurnLPErr: uint8
  CAN4_RLTurnLampC: uint8
  CAN4_RRLockSta: uint8
  CAN4_RRTurnLPErr: uint8
  CAN4_RRTurnLampC: uint8
  CAN4_RWiperAS: uint8
  CAN4_RWiperProtection: uint8
  CAN4_Wip_Speed: uint8
  CAN4_WiperSWPos: uint8
  CAN4_WiperZeroPosSW: uint8
  CAN4_ZDR_THCM_IntakeFail_Sta: uint8
  CAN4_ZDR_THCM_LINACT1_Sta: uint8
  CAN4_ZDR_THCM_LINACT2_Sta: uint8
  CAN4_ZDR_THCM_LINACT3_Sta: uint8
  CAN4_ZDR_THCM_LINACT4_Sta: uint8
  CAN4_ZDR_THCM_LINACT5_Sta: uint8
  CAN4_ZDR_THCM_ModeFail_Sta: uint8

DT_CAN4_SG_zGW_APTC1 = Simulink.Bus(HeaderFile="Rte_Type.h")
  CAN4_FrntPTCBusLineHiV: uint16
  CAN4_FrntPTCComFlt: uint8
  CAN4_FrntPTCFltSt: uint8
  CAN4_FrntPTCHVOverUFlt: uint8
  CAN4_FrntPTCHVUnderUFlt: uint8
  CAN4_FrntPTCHWVers: uint8
  CAN4_FrntPTCLVOverUFlt: uint8
  CAN4_FrntPTCLVUnderUFlt: uint8
  CAN4_FrntPTCLeActHeatPwr: uint8
  CAN4_FrntPTCLeBusLineC: uint8
  CAN4_FrntPTCLeCoreOverTFlt: uint8
  CAN4_FrntPTCLeCoreT: uint8
  CAN4_FrntPTCLeCoreTSnsrFlt: uint8
  CAN4_FrntPTCLeIGBTOverTFlt: uint8
  CAN4_FrntPTCLeIGBTShoCircFlt: uint8
  CAN4_FrntPTCLeIGBTT: uint8
  CAN4_FrntPTCLeIGBTTSnsrFlt: uint8
  CAN4_FrntPTCLeOpentCircFlt: uint8
  CAN4_FrntPTCLeOverAFlt: uint8
  CAN4_FrntPTCPCBOverTFlt: uint8
  CAN4_FrntPTCPCBT: uint8
  CAN4_FrntPTCPCBTSnsrFlt: uint8
  CAN4_FrntPTCRearLeActHeatPwr: uint8
  CAN4_FrntPTCRearLeBusLineC: uint8
  CAN4_FrntPTCRearLeCoreOverTFlt: uint8
  CAN4_FrntPTCRearLeCoreT: uint8
  CAN4_FrntPTCRearLeCoreTSnsrFlt: uint8
  CAN4_FrntPTCRearLeIGBTShoCFlt: uint8
  CAN4_FrntPTCRearLeOpentCircFlt: uint8
  CAN4_FrntPTCRearLeOverAFlt: uint8
  CAN4_FrntPTCRearRiActHeatPwr: uint8
  CAN4_FrntPTCRearRiBusLineC: uint8
  CAN4_FrntPTCRearRiCoreOverTFlt: uint8
  CAN4_FrntPTCRearRiCoreT: uint8
  CAN4_FrntPTCRearRiCoreTSnsrFlt: uint8
  CAN4_FrntPTCRearRiIGBTShoCFlt: uint8
  CAN4_FrntPTCRearRiOpentCircFlt: uint8
  CAN4_FrntPTCRearRiOverAFlt: uint8
  CAN4_FrntPTCRiActHeatPwr: uint8
  CAN4_FrntPTCRiBusLineC: uint8
  CAN4_FrntPTCRiCoreOverTFlt: uint8
  CAN4_FrntPTCRiCoreT: uint8
  CAN4_FrntPTCRiCoreTSnsrFlt: uint8
  CAN4_FrntPTCRiIGBTOverTFlt: uint8
  CAN4_FrntPTCRiIGBTShoCircFlt: uint8
  CAN4_FrntPTCRiIGBTT: uint8
  CAN4_FrntPTCRiIGBTTSnsrFlt: uint8
  CAN4_FrntPTCRiOpentCircFlt: uint8
  CAN4_FrntPTCRiOverAFlt: uint8
  CAN4_FrntPTCSWVers: uint8
  CAN4_FrntPTCSts: uint8
  CAN4_FrntPTCSupplierCod: uint8

DT_CAN4_SG_zGW_CANFr1 = Simulink.Bus(HeaderFile="Rte_Type.h")
  CAN4_COMP_ActualPwr: uint16
  CAN4_COMP_ComLost: uint8
  CAN4_COMP_ConCur: uint16
  CAN4_COMP_ConVolt: uint16
  CAN4_COMP_CtrlCircFlt: uint8
  CAN4_COMP_CurOverProtect: uint8
  CAN4_COMP_CurVaild: uint8
  CAN4_COMP_IPM_HWFLt: uint8
  CAN4_COMP_IPM_TempOverFlt: uint8
  CAN4_COMP_Init: uint8
  CAN4_COMP_SpdVaild: uint8
  CAN4_COMP_Sta: uint8
  CAN4_COMP_StatorSpd: uint16
  CAN4_COMP_VoltLessErr: uint8
  CAN4_COMP_VoltOverErr: uint8
  CAN4_COMP_VoltVaild: uint8
  CAN4_EAC_DrvVoltFalt: uint8
  CAN4_EAC_MotCrt: uint8
  CAN4_EAC_MotorLackFalt: uint8
  CAN4_EAC_OvLoadFalt: uint8
  CAN4_EAC_Temp: uint8
  CAN4_EAC_TempSnsrFalt: uint8
  CAN4_PTC1_ActuHiCrnt: uint8
  CAN4_PTC1_ClntInltOverTemProtn: uint8
  CAN4_PTC1_ClntInltTemSnsrFlt: uint8
  CAN4_PTC1_ClntOtltOverTemProtn: uint8
  CAN4_PTC1_ClntOtltTemSnsrFlt: uint8
  CAN4_PTC1_ClntTempInlt: uint8
  CAN4_PTC1_ClntTempOtlt: uint8
  CAN4_PTC1_CommError: uint8
  CAN4_PTC1_CoreOrIGBTOpenErr: uint8
  CAN4_PTC1_HVDisconnectProtn: uint8
  CAN4_PTC1_HVOverCrntProtn: uint8
  CAN4_PTC1_HiCrntSnsrFlt: uint8
  CAN4_PTC1_IGBTOverTemProtn: uint8
  CAN4_PTC1_IGBTShrtErr: uint8
  CAN4_PTC1_IGBTTem: uint8
  CAN4_PTC1_IGBTTemSnsrFlt: uint8
  CAN4_PTC1_MmryFlt: uint8
  CAN4_PTC1_PCBOverTempProtn: uint8
  CAN4_PTC1_PCBTempSnsrFlt: uint8
  CAN4_PTC1_PowerConsumption: uint8
  CAN4_PTC1_VbatVtgProtn: uint8
  CAN4_PTC1_VbatVtgSnsrFlt: uint8
  CAN4_PTC1_VbatVtgUnstable: uint8
  CAN4_PTC1_WrkngSts: uint8

DT_CAN4_SG_zGW_SEAT1 = Simulink.Bus(HeaderFile="Rte_Type.h")
  CAN4_DSEAT_AntiAct_Sta: uint8
  CAN4_DSEAT_Anti_Sta: uint8
  CAN4_DSEAT_EntryAct_Sta: uint8
  CAN4_DSEAT_EntryFun_Sta: uint8
  CAN4_DSEAT_Error_Sta: uint8
  CAN4_DSEAT_FL_Pos: uint8
  CAN4_DSEAT_HW_Ver: uint16
  CAN4_DSEAT_Mode: uint8
  CAN4_DSEAT_RL_Pos: uint8
  CAN4_DSEAT_Rec_Pos: uint8
  CAN4_DSEAT_SW_Ver: uint16
  CAN4_DSEAT_Slid_Pos: uint8
  CAN4_DSEAT_Vent_Sta: uint8
  CAN4_DSEAT_heater_sta: uint8
  CAN4_PSEAT_Error_Sta: uint8
  CAN4_PSEAT_HW_Ver: uint16
  CAN4_PSEAT_Mode: uint8
  CAN4_PSEAT_SW_Ver: uint16
  CAN4_PSEAT_Vent_Sta: uint8
  CAN4_PSEAT_heater_sta: uint8

DT_CAN5_SG_TBOX1 = Simulink.Bus(HeaderFile="Rte_Type.h")
  CAN5_Antitheft_Zero: uint8
  CAN5_CbnPreACEnaReq: uint8
  CAN5_CbnPreReq: uint8
  CAN5_CbnPreTarT: uint8
  CAN5_PowerOff_T_Set: uint8
  CAN5_ReOutsideMirror: uint8
  CAN5_Re_DoorLock: uint16
  CAN5_Re_PwrReqTbox: uint8
  CAN5_Re_Radio: uint8
  CAN5_Remote_ACTemp: uint8
  CAN5_Remote_AutoReq: uint8
  CAN5_Remote_MidAutoReq: uint8
  CAN5_TBOX_NET_SIG_STR: uint8
  CAN5_TBOX_Re_DTCData: uint8
  CAN5_TBOX_Re_VehData: uint8
  CAN5_TBOX_RemoteOn: uint8
  CAN5_TBOX_Remote_PW: uint8
  CAN5_TBOX_TEST_STATUS: uint8
  CAN5_Uncounting_Req: uint8

DT_CAN5_SG_TBOX2 = Simulink.Bus(HeaderFile="Rte_Type.h")
  CAN5_TimeSyncFromBS_Day: uint8
  CAN5_TimeSyncFromBS_Hour: uint8
  CAN5_TimeSyncFromBS_Minute: uint8
  CAN5_TimeSyncFromBS_Month: uint8
  CAN5_TimeSyncFromBS_Second: uint8
  CAN5_TimeSyncFromBS_Year: uint8

DT_CAN5_SG_TBOX3 = Simulink.Bus(HeaderFile="Rte_Type.h")
  CAN5_Charge_Percent_Set: uint8
  CAN5_ReserveChargeOFF_Day: uint8
  CAN5_ReserveChargeOFF_Hour: uint8
  CAN5_ReserveChargeOFF_Minute: uint8
  CAN5_ReserveChargeOFF_Month: uint8
  CAN5_ReserveChargeOFF_Year: uint8
  CAN5_ReserveChargeOn_Day: uint8
  CAN5_ReserveChargeOn_Hour: uint8
  CAN5_ReserveChargeOn_Minute: uint8
  CAN5_ReserveChargeOn_Month: uint8
  CAN5_ReserveChargeOn_Year: uint8
  CAN5_TBOX_HW_VER: uint32
  CAN5_TBOX_SW_VER: uint32

DT_CAN6_SG_FCM1 = Simulink.Bus(HeaderFile="Rte_Type.h")
  CAN6_ACC_ComfortBandLower: uint16
  CAN6_ACC_ComfortBandUpper: uint16
  CAN6_ACC_JerkLowerLimit: uint8
  CAN6_ACC_JerkUpperLimit: uint8
  CAN6_ACC_ObjDist: uint16
  CAN6_ACC_ObjDstLvl: uint8
  CAN6_ACC_ObjRelSpd: uint16
  CAN6_ACC_RequiredAccel: uint16
  CAN6_ACC_TakeoverReq: uint8
  CAN6_ACC_VehHoldReq: uint8
  CAN6_ADAS_ACC_Sta: uint8
  CAN6_ADAS_AEBReq: uint8
  CAN6_ADAS_AEB_Sta: uint8
  CAN6_ADAS_CAM_SpdLim: uint8
  CAN6_ADAS_DBSReq: uint8
  CAN6_ADAS_FCW_Mute: uint8
  CAN6_ADAS_FCW_Sensitivity: uint8
  CAN6_ADAS_FCW_Sta: uint8
  CAN6_ADAS_FaultSta: uint8
  CAN6_ADAS_FltWrnReq: uint8
  CAN6_ADAS_ForceIdle: uint8
  CAN6_ADAS_ISA_Sta: uint8
  CAN6_ADAS_LDW_Mute: uint8
  CAN6_ADAS_LDW_Sensitivity: uint8
  CAN6_ADAS_LDW_Sta: uint8
  CAN6_ADAS_LFC_Hands_Off_Warning: uint8
  CAN6_ADAS_LFC_Sta: uint8
  CAN6_ADAS_LFC_Warn_Sound: uint8
  CAN6_ADAS_LKA_Sta: uint8
  CAN6_ADAS_LaneModeL: uint8
  CAN6_ADAS_LaneModeR: uint8
  CAN6_ADAS_Lane_curveL: uint8
  CAN6_ADAS_Lane_curveR: uint8
  CAN6_ADAS_LanetypeL: uint8
  CAN6_ADAS_LanetypeR: uint8
  CAN6_ADAS_SLIF_SpdLim: uint8
  CAN6_ADAS_SLIF_Sta: uint8
  CAN6_ADAS_ShftPosnReq: uint8
  CAN6_ADAS_ShftPosnReq_A: uint8
  CAN6_ADAS_VehSpdLim: uint8
  CAN6_ADAS_WarningMsg: uint8
  CAN6_AEB_VehHoldReq: uint8
  CAN6_CameraBlockage: uint8
  CAN6_FCM1_Checksum: uint8
  CAN6_FCM1_LifeCount: uint8
  CAN6_FCM_ACCmode: uint8
  CAN6_FCM_LKA_StrToqReq: uint16
  CAN6_FCM_LKA_TOIAct: uint8
  CAN6_FCM_LKA_TOIFault: uint8
  CAN6_ForceLowBeam: uint8
  CAN6_HazardWarningReq: uint8
  CAN6_ISA_WarningMsg: uint8
  CAN6_LKA_HOD_Display_Warning: uint8
  CAN6_LKA_HOD_Sound_Warning: uint8
  CAN6_LVDA_ACCStatusInformation: uint8
  CAN6_LVDA_Disabled: uint8
  CAN6_LVDA_Failinfo: uint8
  CAN6_LVDA_Mute_Sta: uint8
  CAN6_LVDA_Warning: uint8
  CAN6_LeftTurnLightReq: uint8
  CAN6_RightTurnLightReq: uint8
  CAN6_Target_Type: uint8
  CAN6_TimeGapLevel: uint8

DT_CAN2_SG_GW2_C10_0 = Simulink.Bus(HeaderFile="Rte_Type.h")
  CAN2_ABM_Passenger_ODS_Sta: uint8
  CAN2_ABM_RearPassengerCTR_ODS_Sta: uint8
  CAN2_ABM_RearPassengerLH_ODS_Sta: uint8
  CAN2_ABM_RearPassengerRH_ODS_Sta: uint8
  CAN2_ABS_Active: uint8
  CAN2_ABS_Failed: uint8
  CAN2_ABS_WnlmpSta: uint8
  CAN2_AEBAvail: uint8
  CAN2_AVH_Active: uint8
  CAN2_AVH_Failed: uint8
  CAN2_AirBagFailCmd: uint8
  CAN2_Amber_WnlmpSta: uint8
  CAN2_BTCS_Active: uint8
  CAN2_BrkDiscTempSta: uint8
  CAN2_BrkSw_Sta: uint8
  CAN2_BrkSw_V: uint8
  CAN2_CrashOutputSts: uint8
  CAN2_DCDCAuxCur: uint16
  CAN2_DCDCAuxVolt: uint8
  CAN2_DrPMMLVOutPErrLmp: uint8
  CAN2_DrPMMSysErrLmp: uint8
  CAN2_DrSCPSysErrLmp: uint8
  CAN2_DriverSeatBeltCmd: uint8
  CAN2_EBD_Failed: uint8
  CAN2_EBMErrSta: uint8
  CAN2_EBMRLampSta: uint8
  CAN2_ESC_ADAS_Sta: uint8
  CAN2_ESC_BeepReq: uint8
  CAN2_ESC_Failed: uint8
  CAN2_ESC_OFF_Status: uint8
  CAN2_ESC_Off_lmpSta: uint8
  CAN2_ESC_WnlmpSta: uint8
  CAN2_ESS_Active: uint8
  CAN2_EpasFailed: uint8
  CAN2_FLTurnLPErr: uint8
  CAN2_FLTurn_Light_Warning: uint8
  CAN2_FRTurnLPErr: uint8
  CAN2_FRTurn_Light_Warning: uint8
  CAN2_FireDetErr: uint8
  CAN2_FrPMMLimpHomeActReq: uint8
  CAN2_HBB_Active: uint8
  CAN2_HBB_Failed: uint8
  CAN2_HDD_Active: uint8
  CAN2_HDD_Failed: uint8
  CAN2_HSA_Active: uint8
  CAN2_HSA_Failed: uint8
  CAN2_HVBattCurr: uint16
  CAN2_HVBattErr: uint8
  CAN2_HVBattVolt: uint16
  CAN2_LADBErr: uint8
  CAN2_LADB_Hibeam_Indication: uint8
  CAN2_LADB_Operation_Status: uint8
  CAN2_LADB_Warning: uint8
  CAN2_LAHB_Warning: uint8
  CAN2_LDRL_Warning: uint8
  CAN2_LF_PulseCount: uint8
  CAN2_LF_PulseCount_V: uint8
  CAN2_LF_WhlRotDir: uint8
  CAN2_LH_BeamErr: uint8
  CAN2_LLB_Warning: uint8
  CAN2_LL_BeamErr: uint8
  CAN2_LR_PulseCount: uint8
  CAN2_LR_PulseCount_V: uint8
  CAN2_LR_WhlRotDir: uint8
  CAN2_LowBrakeFluid_Sta: uint8
  CAN2_Lposition_Lamp_Warning: uint8
  CAN2_Meter_Ind_VehSpeed: uint16
  CAN2_PABSwitchCmd: uint8
  CAN2_PBA_Active: uint8
  CAN2_PBA_Failed: uint8
  CAN2_PsngrSeatBeltCmd: uint8
  CAN2_RADBErr: uint8
  CAN2_RADB_Hibeam_Indication: uint8
  CAN2_RADB_Operation_Status: uint8
  CAN2_RADB_Warning: uint8
  CAN2_RAHB_Warning: uint8
  CAN2_RCenterSeatBeltCmd: uint8
  CAN2_RDRL_Warning: uint8
  CAN2_RDriverSeatBeltCmd: uint8
  CAN2_RF_PulseCount: uint8
  CAN2_RF_PulseCount_V: uint8
  CAN2_RF_WhlRotDir: uint8
  CAN2_RH_BeamErr: uint8
  CAN2_RLB_Warning: uint8
  CAN2_RLTurnLPErr: uint8
  CAN2_RL_BeamErr: uint8
  CAN2_RPsngrSeatBeltCmd: uint8
  CAN2_RRTurnLPErr: uint8
  CAN2_RR_PulseCount: uint8
  CAN2_RR_PulseCount_V: uint8
  CAN2_RR_WhlRotDir: uint8
  CAN2_Red_WnlmpSta: uint8
  CAN2_Rposition_Lamp_Warning: uint8
  CAN2_SAS_Angle: uint16
  CAN2_SAS_V: uint8
  CAN2_TCS_Failed: uint8
  CAN2_TLHPsngrSeatBeltCmd: uint8
  CAN2_TRHPsngrSeatBeltCmd: uint8
  CAN2_VehSpeed: uint16
  CAN2_eBST_AmberWnlmpSta: uint8
  CAN2_eBST_BeepReq: uint8
  CAN2_eBST_RedWnlmpSta: uint8

DT_CAN2_SG_CGW_GW2_CE100_0 = Simulink.Bus(HeaderFile="Rte_Type.h")
  CAN2_COMP_ActualPwr: uint16
  CAN2_CbnPreACEnaReq: uint8
  CAN2_ChargeInletLockSta: uint8
  CAN2_ChrgPlugSta: uint8
  CAN2_DKC_KeyNum_Sta: uint8
  CAN2_DKC_KeyType_Sta: uint8
  CAN2_DisChrgPlugErr: uint8
  CAN2_ExtChrgSta: uint8
  CAN2_FrntPTCLeActHeatPwr: uint8
  CAN2_FrntPTCRearLeActHeatPwr: uint8
  CAN2_FrntPTCRearRiActHeatPwr: uint8
  CAN2_FrntPTCRiActHeatPwr: uint8
  CAN2_HVBChrgErr: uint8
  CAN2_HVBContactorSta: uint8
  CAN2_HVBMTempMax: uint8
  CAN2_HVBOvrTempErr: uint8
  CAN2_HVBOvrTempWarn: uint8
  CAN2_MainRlyNegSta: uint8
  CAN2_MainRlyPosSta: uint8
  CAN2_OBCACCSLimit: uint8
  CAN2_OBCACCurrInf: uint16
  CAN2_OBCACVoltInf: uint16
  CAN2_OBCFaultSta: uint8
  CAN2_OBC_AC_Cur_Lim: uint8
  CAN2_P_Dkey_Show_IVI: uint8
  CAN2_P_KeyMiss: uint8
  CAN2_P_UID_LowPower: uint8
  CAN2_RLS_Lamp_Sta: uint8
  CAN2_Re_Radio: uint8
  CAN2_SWC_ACC_Sta: uint8
  CAN2_SWC_Down_Sta: uint8
  CAN2_SWC_LKA_Sta: uint8
  CAN2_SWC_Left_Sta: uint8
  CAN2_SWC_RegenDown: uint8
  CAN2_SWC_RegenUp: uint8
  CAN2_SWC_Right_Sta: uint8
  CAN2_SWC_Trip_Sta: uint8
  CAN2_SWC_Undefined_Sta: uint8
  CAN2_SWC_Up_Sta: uint8
  CAN2_SWC_VR_Sta: uint8
  CAN2_SWC_mode_Sta: uint8
  CAN2_Shifter_Fail_sta: uint8
  CAN2_Shifter_Handle_Cmd: uint8
  CAN2_TBOX_NET_SIG_STR: uint8
  CAN2_TBOX_TEST_STATUS: uint8
  CAN2_TrailerCheck: uint8
  CAN2_TrailerModeSta: uint8
  CAN2_V2LSta: uint8
  CAN2_ZFR_BCM_ChargerDoorSW_Sta: uint8
  CAN2_ZFR_EChrg_Active_Sta: uint8
  CAN2_ZFR_EChrg_OperationDeny_Cmd: uint8
  CAN2_ZFR_EChrg_Sys_Sta: uint8
  CAN2_ZFR_EChrg_WashMode_Sta: uint8

DT_CAN2_SG_GW2_CE100_2 = Simulink.Bus(HeaderFile="Rte_Type.h")
  CAN2_DSEAT_Anti_Sta: uint8
  CAN2_DSEAT_EntryFun_Sta: uint8
  CAN2_DSEAT_Error_Sta: uint8
  CAN2_DSEAT_Mode: uint8
  CAN2_DSEAT_Vent_Sta: uint8
  CAN2_DSEAT_heater_sta: uint8
  CAN2_FAPWL_01_LIN_Response_Error: uint8
  CAN2_Fr_EDUDrtSta_Nidec: uint8
  CAN2_Fr_EDURealTMTq_Nidec: uint16
  CAN2_Fr_MCUTempWarn_Nidec: uint8
  CAN2_Fr_MCUTemp_Nidec: uint16
  CAN2_Fr_MotorAvailTq_Nidec: uint16
  CAN2_Fr_TMSpd_Nidec: uint16
  CAN2_Fr_TMTempWarn_Nidec: uint8
  CAN2_Fr_TMTemp_Nidec: uint16
  CAN2_L_Drv_Motor_Relay_Error: uint8
  CAN2_L_Drv_Motor_Ripple_Error: uint8
  CAN2_L_Drv_Val_Wdw_Opened: uint8
  CAN2_L_Pas_Motor_Relay_Error: uint8
  CAN2_L_Pas_Motor_Ripple_Error: uint8
  CAN2_L_Pas_Val_Wdw_Opened: uint8
  CAN2_L_RLD_Motor_Relay_Error: uint8
  CAN2_L_RLD_Motor_Ripple_Error: uint8
  CAN2_L_RLD_Val_Wdw_Opened: uint8
  CAN2_L_RRD_Motor_Relay_Error: uint8
  CAN2_L_RRD_Motor_Ripple_Error: uint8
  CAN2_L_RRD_Val_Wdw_Opened: uint8
  CAN2_PSEAT_Error_Sta: uint8
  CAN2_PSEAT_Mode: uint8
  CAN2_PSEAT_Vent_Sta: uint8
  CAN2_PSEAT_heater_sta: uint8
  CAN2_PTG_Active_Sta: uint8
  CAN2_PTG_AutoStaus: uint8
  CAN2_PTG_Exist: uint8
  CAN2_PTG_Is_Set_Height: uint8
  CAN2_PTG_Sys_Sta: uint8
  CAN2_RAPWL_01_LIN_Response_Error: uint8
  CAN2_Rr_EDUDrtSta_Nidec: uint8
  CAN2_Rr_EDURealTMTq_Nidec: uint16
  CAN2_Rr_MCUTempWarn_Nidec: uint8
  CAN2_Rr_MCUTemp_Nidec: uint16
  CAN2_Rr_MotorAvailTq_Nidec: uint16
  CAN2_Rr_TMSpd_Nidec: uint16
  CAN2_Rr_TMTempWarn_Nidec: uint8
  CAN2_Rr_TMTemp_Nidec: uint16

DT_CAN2_SG_CGW_GW2_CE200_0 = Simulink.Bus(HeaderFile="Rte_Type.h")
  CAN2_ACC_ObjDist: uint16
  CAN2_ACC_ObjDstLvl: uint8
  CAN2_ACC_ObjRelSpd: uint16
  CAN2_ACC_TakeoverReq: uint8
  CAN2_ADAS_ACC_Sta: uint8
  CAN2_ADAS_AEBReq: uint8
  CAN2_ADAS_AEB_Sta: uint8
  CAN2_ADAS_CAM_SpdLim: uint8
  CAN2_ADAS_FCW_Mute: uint8
  CAN2_ADAS_FCW_Sensitivity: uint8
  CAN2_ADAS_FCW_Sta: uint8
  CAN2_ADAS_FltWrnReq: uint8
  CAN2_ADAS_ISA_Sta: uint8
  CAN2_ADAS_LDW_Mute: uint8
  CAN2_ADAS_LDW_Sensitivity: uint8
  CAN2_ADAS_LDW_Sta: uint8
  CAN2_ADAS_LFC_Hands_Off_Warning: uint8
  CAN2_ADAS_LFC_Sta: uint8
  CAN2_ADAS_LFC_Warn_Sound: uint8
  CAN2_ADAS_LKA_Sta: uint8
  CAN2_ADAS_LaneModeL: uint8
  CAN2_ADAS_LaneModeR: uint8
  CAN2_ADAS_SLIF_SpdLim: uint8
  CAN2_ADAS_SLIF_Sta: uint8
  CAN2_ADAS_VehSpdLim: uint8
  CAN2_ADAS_WarningMsg: uint8
  CAN2_ActBrkLamp_Sta: uint8
  CAN2_CameraBlockage: uint8
  CAN2_ForceLowBeam: uint8
  CAN2_HVBSOH: uint8
  CAN2_HazardWarningReq: uint8
  CAN2_ISA_WarningMsg: uint8
  CAN2_LKA_HOD_Display_Warning: uint8
  CAN2_LKA_HOD_Sound_Warning: uint8
  CAN2_LVDA_ACCStatusInformation: uint8
  CAN2_LVDA_Disabled: uint8
  CAN2_LVDA_Failinfo: uint8
  CAN2_LVDA_Mute_Sta: uint8
  CAN2_LVDA_Warning: uint8
  CAN2_LeftTurnLightReq: uint8
  CAN2_MCU_B_F_RealPwrKw_Sta: uint16
  CAN2_MCU_B_R_RealPwrKw_Sta: uint16
  CAN2_RightTurnLightReq: uint8
  CAN2_Target_Type: uint8

DT_CAN3_SG_GW3_CE100_0 = Simulink.Bus(HeaderFile="Rte_Type.h")
  CAN3_AC_Chg_Cur_Set: uint8
  CAN3_COMP_ActualPwr: uint16
  CAN3_COMP_ConCur: uint16
  CAN3_COMP_ConVolt: uint16
  CAN3_ChargeInletLockSta: uint8
  CAN3_Charge_Percent_Set: uint8
  CAN3_CrashOutputSts: uint8
  CAN3_DriverSeatBeltCmd: uint8
  CAN3_IVI_Req_V2L: uint8
  CAN3_IVI_Start_Chg_req: uint8
  CAN3_IVI_Stop_Chg_req: uint8
  CAN3_IVI_Time_Day: uint8
  CAN3_IVI_Time_Hour: uint8
  CAN3_IVI_Time_Minute: uint8
  CAN3_IVI_Time_Month: uint8
  CAN3_IVI_Time_Second: uint8
  CAN3_IVI_Unlock_Chg_req: uint8
  CAN3_PTC1_PowerConsumption: uint8
  CAN3_Perd_V2L: uint8
  CAN3_ReserveChargeOFF_Day: uint8
  CAN3_ReserveChargeOFF_Hour: uint8
  CAN3_ReserveChargeOFF_Minute: uint8
  CAN3_ReserveChargeOFF_Month: uint8
  CAN3_ReserveChargeOFF_Year: uint8
  CAN3_ReserveChargeOn_Day: uint8
  CAN3_ReserveChargeOn_Hour: uint8
  CAN3_ReserveChargeOn_Minute: uint8
  CAN3_ReserveChargeOn_Month: uint8
  CAN3_ReserveChargeOn_Year: uint8
  CAN3_SOC_ADJ_BUTT: uint8
  CAN3_SOC_Limit_Set: uint8
  CAN3_SOC_V2LLimit: uint8
  CAN3_Sched_Chg_Start: uint8
  CAN3_Sched_Chg_Stop: uint8
  CAN3_Sched_Chg_butt: uint8
  CAN3_Sched_Chg_limit: uint8
  CAN3_VehSpeed: uint16

DT_CAN4_SG_GW4_CE200_0 = Simulink.Bus(HeaderFile="Rte_Type.h")
  CAN4_IVI_LSEATvent_Cmd: uint8
  CAN4_IVI_MLFMost_Cmd: uint8
  CAN4_IVI_MLFootLift_Cmd: uint8
  CAN4_IVI_MLNapMode_Cmd: uint8
  CAN4_IVI_MLRecliner_Cmd: uint8
  CAN4_IVI_MLRestore_Cmd: uint8
  CAN4_IVI_MLSEATvent_Cmd: uint8
  CAN4_IVI_MLSeatLift_Cmd: uint8
  CAN4_IVI_MLSldRestore_Cmd: uint8
  CAN4_IVI_MLSlider_Cmd: uint8
  CAN4_IVI_MLZeroGravity_Cmd: uint8
  CAN4_IVI_MRFMost_Cmd: uint8
  CAN4_IVI_MRFootLift_Cmd: uint8
  CAN4_IVI_MRNapMode_Cmd: uint8
  CAN4_IVI_MRRecliner_Cmd: uint8
  CAN4_IVI_MRRestore_Cmd: uint8
  CAN4_IVI_MRSEATvent_Cmd: uint8
  CAN4_IVI_MRSeatLift_Cmd: uint8
  CAN4_IVI_MRSldRestore_Cmd: uint8
  CAN4_IVI_MRSlider_Cmd: uint8
  CAN4_IVI_MRZeroGravity_Cmd: uint8
  CAN4_IVI_RSEATvent_Cmd: uint8

DT_CAN6_SG_CGW_GW6_CE100_0 = Simulink.Bus(HeaderFile="Rte_Type.h")
  CAN6_IVI_Time_Day: uint8
  CAN6_IVI_Time_Hour: uint8
  CAN6_IVI_Time_Minute: uint8
  CAN6_IVI_Time_Month: uint8
  CAN6_IVI_Time_Second: uint8
  CAN6_ODOMETER: uint32
  CAN6_SWC2_L_ADAS_Sta: uint8
  CAN6_SWC2_L_DriveMode_Sta: uint8
  CAN6_SWC2_L_ScrollDown_Sta: uint8
  CAN6_SWC2_L_ScrollPress_Sta: uint8
  CAN6_SWC2_L_ScrollUp_Sta: uint8
  CAN6_SWC2_R_Customize_Sta: uint8
  CAN6_SWC_ACC_Sta: uint8
  CAN6_SWC_CANCEL_Sta: uint8
  CAN6_SWC_Distance_Sta: uint8
  CAN6_SWC_LKA_Sta: uint8
  CAN6_SWC_Res_Up_Sta: uint8
  CAN6_SWC_Set_down_Sta: uint8

DT_CAN7_SG_GW7_C100_0 = Simulink.Bus(HeaderFile="Rte_Type.h")
  CAN7_VehSpeed: uint16

DT_CAN2_SG_FD2_OTA1 = Simulink.Bus(HeaderFile="Rte_Type.h")
  CAN2_OTA_DL_Available: uint8
  CAN2_OTA_DL_Speed: uint32
  CAN2_OTA_Debug_Code: uint8
  CAN2_OTA_Emergency_Sta: uint8
  CAN2_OTA_InVehicle_FW: uint8
  CAN2_OTA_Lock_Req: uint8
  CAN2_OTA_MDA_Status: uint8
  CAN2_OTA_Mode: uint8
  CAN2_OTA_Network_Type: uint8
  CAN2_OTA_Permit_Agreed: uint8
  CAN2_OTA_Progress_Rate: uint8
  CAN2_OTA_Remained_Time: uint16
  CAN2_OTA_TBOXResetReq: uint8
  CAN2_OTA_Update_Available: uint8
  CAN2_OTA_Updating_ECU_8bit: uint8

DT_CAN3_SG_FD3_OTA1 = Simulink.Bus(HeaderFile="Rte_Type.h")
  CAN3_OTA_DL_Available: uint8
  CAN3_OTA_DL_Speed: uint32
  CAN3_OTA_Debug_Code: uint8
  CAN3_OTA_Emergency_Sta: uint8
  CAN3_OTA_InVehicle_FW: uint8
  CAN3_OTA_Lock_Req: uint8
  CAN3_OTA_MDA_Status: uint8
  CAN3_OTA_Mode: uint8
  CAN3_OTA_Network_Type: uint8
  CAN3_OTA_Permit_Agreed: uint8
  CAN3_OTA_Progress_Rate: uint8
  CAN3_OTA_Remained_Time: uint16
  CAN3_OTA_TBOXResetReq: uint8
  CAN3_OTA_Update_Available: uint8
  CAN3_OTA_Updating_ECU_8bit: uint8

DT_CAN4_SG_FD4_OTA1 = Simulink.Bus(HeaderFile="Rte_Type.h")
  CAN4_OTA_DL_Available: uint8
  CAN4_OTA_DL_Speed: uint32
  CAN4_OTA_Debug_Code: uint8
  CAN4_OTA_Emergency_Sta: uint8
  CAN4_OTA_InVehicle_FW: uint8
  CAN4_OTA_Lock_Req: uint8
  CAN4_OTA_MDA_Status: uint8
  CAN4_OTA_Mode: uint8
  CAN4_OTA_Network_Type: uint8
  CAN4_OTA_Permit_Agreed: uint8
  CAN4_OTA_Progress_Rate: uint8
  CAN4_OTA_Remained_Time: uint16
  CAN4_OTA_TBOXResetReq: uint8
  CAN4_OTA_Update_Available: uint8
  CAN4_OTA_Updating_ECU_8bit: uint8

DT_CAN5_SG_FD5_OTA1 = Simulink.Bus(HeaderFile="Rte_Type.h")
  CAN5_OTA_DL_Available: uint8
  CAN5_OTA_DL_Speed: uint32
  CAN5_OTA_Debug_Code: uint8
  CAN5_OTA_Emergency_Sta: uint8
  CAN5_OTA_InVehicle_FW: uint8
  CAN5_OTA_Lock_Req: uint8
  CAN5_OTA_MDA_Status: uint8
  CAN5_OTA_Mode: uint8
  CAN5_OTA_Network_Type: uint8
  CAN5_OTA_Permit_Agreed: uint8
  CAN5_OTA_Progress_Rate: uint8
  CAN5_OTA_Remained_Time: uint16
  CAN5_OTA_TBOXResetReq: uint8
  CAN5_OTA_Update_Available: uint8
  CAN5_OTA_Updating_ECU_8bit: uint8

AppModeRequestType = enum(HeaderFile="Rte_Type.h", DefaultValue="APP_MODE_ACTIVE", StorageType="uint8")
  APP_MODE_ACTIVE = 0
  APP_MODE_INACTIVE = 1

DT_CAN1_SG_EPB1 = Simulink.Bus(HeaderFile="Rte_Type.h")
  CAN1_DOA_Sta: uint8
  CAN1_EPB1_CS: uint8
  CAN1_EPB1_RC: uint8
  CAN1_EPBCarWashMode: uint8
  CAN1_EPBErrSta: uint8
  CAN1_EPBExtApplyAvail: uint8
  CAN1_EPBExtReleaseAvail: uint8
  CAN1_EPBMsg: uint8
  CAN1_EPBRLampSta: uint8
  CAN1_EPBSta: uint8
  CAN1_EPBStaL: uint8
  CAN1_EPBStaR: uint8
  CAN1_TakeOverReq: uint8

DT_CAN3_SG_Shifter2 = Simulink.Bus(HeaderFile="Rte_Type.h")
  CAN3_CSW2_DimSw_Sta: uint8
  CAN3_CSW2_FWasSw_Sta: uint8
  CAN3_CSW2_FWipSw_Sta: uint8
  CAN3_CSW2_PassSW_Sta: uint8
  CAN3_CSW2_RWipWasSw_Sta: uint8
  CAN3_CSW2_TurnSw_Sta: uint8

uint64 = Simulink.NumericType(DataTypeMode="Fixed-point: binary point scaling", SignednessBool=false, WordLength=31, FixedExponent=0, HeaderFile="Rte_Type.h")

DT_CAN4_SG_DKC2 = Simulink.Bus(HeaderFile="Rte_Type.h")
  CAN4_EncryptionDATA_0_63: uint64
  CAN4_EncryptionDATA_64_127: uint64
  CAN4_Random_Number_X: uint64

DT_CAN4_SG_zGW_LINFr1 = Simulink.Bus(HeaderFile="Rte_Type.h")
  CAN4_AGS_Actual_Position: uint8
  CAN4_AGS_Actuator_Blocked: uint8
  CAN4_AGS_Actuator_Fault: uint8
  CAN4_AGS_Calibration_Active: uint8
  CAN4_AGS_Calibration_Indicated: uint8
  CAN4_AGS_Electrical_Error: uint8
  CAN4_AGS_LINResponse_Error: uint8
  CAN4_AGS_Low_Voltage_Error: uint8
  CAN4_AGS_Sensor_Error: uint8
  CAN4_AGS_Temperature_Error: uint8
  CAN4_FGS_BlowerErr_Sta: uint8
  CAN4_FGS_Channel1TypeRsp_Sta: uint8
  CAN4_FGS_Channel2TypeRsp_Sta: uint8
  CAN4_FGS_Channel3TypeRsp_Sta: uint8
  CAN4_FGS_Channel_Index_Sta: uint8
  CAN4_FGS_Channel_Type_Sta: uint8
  CAN4_FGS_IntenRsp_Sta: uint8
  CAN4_FGS_LINResponseErr_Sta: uint8
  CAN4_FGS_LifeHole1_Sta: uint16
  CAN4_FGS_LifeHole2_Sta: uint16
  CAN4_FGS_LifeHole3_Sta: uint16
  CAN4_FGS_MotorErr_Sta: uint8
  CAN4_FGS_StsRsp_Sta: uint8
  CAN4_FGS_TypRsp_Sta: uint8
  CAN4_ION_IONErr_Sta: uint8
  CAN4_ION_IONRespErr_Sta: uint8
  CAN4_ION_ION_Sta: uint8

DT_CAN6_SG_FCM3 = Simulink.Bus(HeaderFile="Rte_Type.h")
  CAN6_ME_Lane_CurvDervLt: uint16
  CAN6_ME_Lane_CurvDervLt2: uint16
  CAN6_ME_Lane_CurvDervRt: uint16
  CAN6_ME_Lane_CurvDervRt2: uint16
  CAN6_ME_Lane_CurvLt: uint16
  CAN6_ME_Lane_CurvLt2: uint16
  CAN6_ME_Lane_CurvRt: uint16
  CAN6_ME_Lane_CurvRt2: uint16
  CAN6_ME_Lane_HeadAngLt: uint16
  CAN6_ME_Lane_HeadAngLt2: uint16
  CAN6_ME_Lane_HeadAngRt: uint16
  CAN6_ME_Lane_HeadAngRt2: uint16
  CAN6_ME_Lane_PosLt: uint16
  CAN6_ME_Lane_PosLt2: uint16
  CAN6_ME_Lane_PosRt: uint16
  CAN6_ME_Lane_PosRt2: uint16

DT_CAN6_SG_FCM4 = Simulink.Bus(HeaderFile="Rte_Type.h")
  CAN6_ADAS_AngCtrlTqWeightGain: uint8
  CAN6_ADAS_DesStrWhlAngCtrlCmd: uint16
  CAN6_ADAS_DrvInputTqBoostAct: uint8
  CAN6_ADAS_DrvInputTqBoostGain: uint8
  CAN6_ADAS_MaxAngCtrlOutTqLimit: uint16
  CAN6_ADAS_StrWhlAngCtrlStatus: uint8
  CAN6_FCM4_Checksum: uint8
  CAN6_FCM4_LifeCount: uint8

DT_CAN6_SG_SRR1 = Simulink.Bus(HeaderFile="Rte_Type.h")
  CAN6_SRR1_Chksum: uint8
  CAN6_SRR1_LifeCount: uint8
  CAN6_SRR_BSD_Mute: uint8
  CAN6_SRR_BSD_SoundL: uint8
  CAN6_SRR_BSD_SoundR: uint8
  CAN6_SRR_BSD_Sta: uint8
  CAN6_SRR_BSD_WarnL: uint8
  CAN6_SRR_BSD_WarnR: uint8
  CAN6_SRR_ODA_Mute: uint8
  CAN6_SRR_ODA_SoundL: uint8
  CAN6_SRR_ODA_SoundR: uint8
  CAN6_SRR_ODA_Sta: uint8
  CAN6_SRR_ODA_WarnL: uint8
  CAN6_SRR_ODA_WarnR: uint8
  CAN6_SRR_RCTA_Sta: uint8
  CAN6_SRR_RCTA_WarnL: uint8
  CAN6_SRR_RCTA_WarnR: uint8

DT_CAN1_SG_FD1_BCM1 = Simulink.Bus(HeaderFile="Rte_Type.h")
  CAN1_AllDoorSW: uint8
  CAN1_AntiTheftSeatFold: uint8
  CAN1_AntitheftSta: uint8
  CAN1_BCM_Buzzer_Req: uint8
  CAN1_BCM_DoorLock_Sta: uint8
  CAN1_BrakeLamp: uint8
  CAN1_CTDCtrl: uint8
  CAN1_CTDLockSW: uint8
  CAN1_CTDUnlockSW: uint8
  CAN1_CrashDetd: uint8
  CAN1_Dimmer: uint8
  CAN1_DimmerEN: uint8
  CAN1_DoorLockIND: uint8
  CAN1_DrDoorSW: uint8
  CAN1_Fr_ChargingDoorCtrl: uint8
  CAN1_Fr_FogLamp: uint8
  CAN1_Fr_Wiper_H: uint8
  CAN1_Fr_Wiper_L: uint8
  CAN1_H_Beam: uint8
  CAN1_HazardSW: uint8
  CAN1_HoodSW: uint8
  CAN1_HornCtrl: uint8
  CAN1_LBSD: uint8
  CAN1_LDRL: uint8
  CAN1_LTurnLP: uint8
  CAN1_L_APM_WdwEnable: uint8
  CAN1_L_Beam: uint8
  CAN1_LockSetting: uint8
  CAN1_MirrorCtrl: uint8
  CAN1_MirrorDefog: uint8
  CAN1_PosLamp: uint8
  CAN1_PsDoorSW: uint8
  CAN1_RBSD: uint8
  CAN1_RDRL: uint8
  CAN1_RLDoorSW: uint8
  CAN1_RRDoorSW: uint8
  CAN1_RTurnLP: uint8
  CAN1_ReverseLamp: uint8
  CAN1_RoomLampH: uint8
  CAN1_RoomLampL: uint8
  CAN1_Rr_ChargingDoorCtrl: uint8
  CAN1_Rr_Defog: uint8
  CAN1_Rr_FogLamp: uint8
  CAN1_Rr_Wiper: uint8
  CAN1_TailgateHDSW: uint8
  CAN1_TailgateRemote: uint8
  CAN1_Tailgate_SW: uint8
  CAN1_TrunkRel: uint8
  CAN1_WasherCtrl: uint8
  CAN1_WiperFixMode: uint8

DT_CAN1_SG_FD1_VCU1 = Simulink.Bus(HeaderFile="Rte_Type.h")
  CAN1_CC_Crl_Sta: uint8
  CAN1_Eng_AGSCloseSta: uint8
  CAN1_Eng_ActvDmpDisabSta: uint8
  CAN1_Eng_CoastDwSta: uint8
  CAN1_Eng_PwrLockSta: uint8
  CAN1_HVPwrSta: uint8
  CAN1_LVPwrSta: uint8
  CAN1_MSA_Crl_Sta: uint8
  CAN1_P_Button_Sta: uint8
  CAN1_PrkReq: uint8
  CAN1_PrkReqValid: uint8
  CAN1_PwrSta: uint8
  CAN1_ShiftGearPosn: uint8
  CAN1_VehMalfunLevel: uint8
  CAN1_XWDMode: uint8

DT_CAN1_SG_FD1_VMC1 = Simulink.Bus(HeaderFile="Rte_Type.h")
  CAN1_AccCalcuPID: uint16
  CAN1_CCMSA_SpdWar: uint8
  CAN1_DISCReqAcc: uint16
  CAN1_DISC_ButtSta: uint8
  CAN1_DISC_DISCTargetSpd: uint16
  CAN1_DISC_DISCTurn: uint8
  CAN1_DISC_Sta: uint8
  CAN1_FeatArbitrFinal: uint8
  CAN1_FeatArbitrSta: uint8
  CAN1_FeatReqSpd: uint16
  CAN1_FeatSetSpdFinal_raw32: uint8
  CAN1_FrontRearSlipRatioCtrl: uint8
  CAN1_JerkPCT: uint8
  CAN1_LatAccCtrl: uint8
  CAN1_LateralCtrl: uint8
  CAN1_LimitPCT: uint8
  CAN1_MeterIndSpeed_raw32: uint8
  CAN1_RearWhlSlipRatioCtrl: uint8
  CAN1_SPD2ACCAct: uint8
  CAN1_SafetyCtrl: uint8
  CAN1_SingleWhlSlipRatioCtrl: uint8
  CAN1_TimeGapCalcu: uint8
  CAN1_VMC_ACCCtrlAvail: uint8
  CAN1_VMC_AEBCtrlAvail: uint8
  CAN1_VMC_CCCtrlAvail: uint8
  CAN1_VMC_MSACtrlAvail: uint8
  CAN1_VMC_VCU_ACC_CtrlAvail: uint8
  CAN1_VMC_VCU_APSCtrlAvail_flg: uint8
  CAN1_VMC_VCU_AccPedal_Override: uint8
  CAN1_VMC_VCU_CC_Crl_Sta: uint8
  CAN1_VMC_VCU_MSA_Crl_Sta: uint8
  CAN1_VehicleSpeed_kph: uint16
  CAN1_VehicleSpeed_mph: uint16

DT_CAN2_SG_GW2_CE100_0 = Simulink.Bus(HeaderFile="Rte_Type.h")
  CAN2_FDC_BCM_DimSw: uint8
  CAN2_FDC_BCM_FWipSw_Sta: uint8
  CAN2_FDC_BCM_TurnSw_Sta: uint8

DT_CAN2_SG_GW2_CE200_0 = Simulink.Bus(HeaderFile="Rte_Type.h")
  CAN2_FDC_BCM_TimeGapLevel_Sta: uint8

DT_CAN3_SG_FD3_BCM1 = Simulink.Bus(HeaderFile="Rte_Type.h")
  CAN3_AllDoorSW: uint8
  CAN3_AntiTheftSeatFold: uint8
  CAN3_AntitheftSta: uint8
  CAN3_BCM_Buzzer_Req: uint8
  CAN3_BCM_DoorLock_Sta: uint8
  CAN3_BrakeLamp: uint8
  CAN3_CTDCtrl: uint8
  CAN3_CTDLockSW: uint8
  CAN3_CTDUnlockSW: uint8
  CAN3_CrashDetd: uint8
  CAN3_Dimmer: uint8
  CAN3_DimmerEN: uint8
  CAN3_DoorLockIND: uint8
  CAN3_DrDoorSW: uint8
  CAN3_Fr_ChargingDoorCtrl: uint8
  CAN3_Fr_FogLamp: uint8
  CAN3_Fr_Wiper_H: uint8
  CAN3_Fr_Wiper_L: uint8
  CAN3_H_Beam: uint8
  CAN3_HazardSW: uint8
  CAN3_HoodSW: uint8
  CAN3_HornCtrl: uint8
  CAN3_LBSD: uint8
  CAN3_LDRL: uint8
  CAN3_LTurnLP: uint8
  CAN3_L_APM_WdwEnable: uint8
  CAN3_L_Beam: uint8
  CAN3_LockSetting: uint8
  CAN3_MirrorCtrl: uint8
  CAN3_MirrorDefog: uint8
  CAN3_PosLamp: uint8
  CAN3_PsDoorSW: uint8
  CAN3_RBSD: uint8
  CAN3_RDRL: uint8
  CAN3_RLDoorSW: uint8
  CAN3_RRDoorSW: uint8
  CAN3_RTurnLP: uint8
  CAN3_ReverseLamp: uint8
  CAN3_RoomLampH: uint8
  CAN3_RoomLampL: uint8
  CAN3_Rr_ChargingDoorCtrl: uint8
  CAN3_Rr_Defog: uint8
  CAN3_Rr_FogLamp: uint8
  CAN3_Rr_Wiper: uint8
  CAN3_TailgateHDSW: uint8
  CAN3_TailgateRemote: uint8
  CAN3_Tailgate_SW: uint8
  CAN3_TrunkRel: uint8
  CAN3_WasherCtrl: uint8
  CAN3_WiperFixMode: uint8

DT_CAN3_SG_FD3_THCM2 = Simulink.Bus(HeaderFile="Rte_Type.h")
  CAN3_ACSubMode: uint8
  CAN3_APTC_ActFrRiPwr: uint8
  CAN3_BatLoopActWtFlw: uint8
  CAN3_CCU_CbnPreACWkSts: uint8
  CAN3_CCU_CbnPreEstimdTi: uint8
  CAN3_CCU_CbnPreSts: uint8
  CAN3_CCU_HiVoltageReq: uint8
  CAN3_CoolgFanActDuty: uint8
  CAN3_DeiceModReq: uint8
  CAN3_FD_Blower_Cmd: uint8
  CAN3_FD_Comp_Cmd: uint16
  CAN3_FD_EWP1_Cmd: uint8
  CAN3_FD_EWP2_Cmd: uint8
  CAN3_FD_EWP3_Cmd: uint8
  CAN3_FD_EXV1_Cmd: uint16
  CAN3_FD_EXV2_Cmd: uint16
  CAN3_FD_FWV_Cmd: uint8
  CAN3_FD_FrLeAPTCHeatPwr_Cmd: uint8
  CAN3_FD_FrRiAPTCHeatPwr_Cmd: uint8
  CAN3_FD_FrWPTCHeatPwr_Cmd: uint16
  CAN3_FD_RrAPTCHeatPwr_Cmd: uint8
  CAN3_FD_SOTXV_Cmd: uint8
  CAN3_FD_SOV1_Cmd: uint8
  CAN3_FD_SOV2_Cmd: uint8
  CAN3_FD_SOV3_Cmd: uint8
  CAN3_FD_TWV_Cmd: uint8

DT_CAN3_SG_FD3_V2L1 = Simulink.Bus(HeaderFile="Rte_Type.h")
  CAN3_FDC_V2L_OBCExtrV2L_Cmd: uint8
  CAN3_FDC_V2L_OBCIntrV2L_Cmd: uint8
  CAN3_Req_OBCV2LEna: uint8
  CAN3_Req_V2LSwOn: uint8
  CAN3_Req_V2L_IVI_Popup: uint8

DT_CAN4_SG_FD4_CE100_1 = Simulink.Bus(HeaderFile="Rte_Type.h")
  CAN4_ACSubMode: uint8
  CAN4_APTC_ActFrRiPwr: uint8
  CAN4_BatLoopActWtFlw: uint8
  CAN4_BatteryMode: uint8
  CAN4_CCU_ACLampSts: uint8
  CAN4_CCU_ACMaxLampSts: uint8
  CAN4_CCU_AutoLampSts: uint8
  CAN4_CCU_AutoMidLampSts: uint8
  CAN4_CCU_CbnPreACWkSts: uint8
  CAN4_CCU_CbnPreEstimdTi: uint8
  CAN4_CCU_CbnPreSts: uint8
  CAN4_CCU_Dispaly_Request: uint8
  CAN4_CCU_EcoSts: uint8
  CAN4_CCU_FrtOnOffLampSts: uint8
  CAN4_CCU_HEATMaxLampSts: uint8
  CAN4_CCU_HiVoltageReq: uint8
  CAN4_CCU_RrOnOffLampSts: uint8
  CAN4_CCU_SyncLampSts: uint8
  CAN4_CabinMode: uint8
  CAN4_CoolgFanActDuty: uint8
  CAN4_DeiceModReq: uint8
  CAN4_EDriveMode: uint8
  CAN4_FDC_THCM_CLEVentY_Sta: uint8
  CAN4_FDC_THCM_CLEVentZ_Sta: uint8
  CAN4_FDC_THCM_CLVent_Sta: uint8
  CAN4_FDC_THCM_CREVentY_Sta: uint8
  CAN4_FDC_THCM_CREVentZ_Sta: uint8
  CAN4_FDC_THCM_CRVent_Sta: uint8
  CAN4_FDC_THCM_DrEVentMode_Sta: uint8
  CAN4_FDC_THCM_DrEVentY_Sta: uint8
  CAN4_FDC_THCM_DrEVentZ_Sta: uint8
  CAN4_FDC_THCM_DrVent_Sta: uint8
  CAN4_FDC_THCM_PsEVentMode_Sta: uint8
  CAN4_FDC_THCM_PsEVentY_Sta: uint8
  CAN4_FDC_THCM_PsEVentZ_Sta: uint8
  CAN4_FDC_THCM_PsVent_Sta: uint8
  CAN4_FD_AGS_Cmd: uint8
  CAN4_FD_Blower_Cmd: uint8
  CAN4_FD_Comp_Cmd: uint16
  CAN4_FD_EWP1_Cmd: uint8
  CAN4_FD_EWP2_Cmd: uint8
  CAN4_FD_EWP3_Cmd: uint8
  CAN4_FD_EXV1_Cmd: uint16
  CAN4_FD_EXV2_Cmd: uint16
  CAN4_FD_FWV_Cmd: uint8
  CAN4_FD_FrLeAPTCHeatPwr_Cmd: uint8
  CAN4_FD_FrRiAPTCHeatPwr_Cmd: uint8
  CAN4_FD_FrWPTCHeatPwr_Cmd: uint16
  CAN4_FD_RecyAuto_Cmd: uint8
  CAN4_FD_RrAPTCHeatPwr_Cmd: uint8
  CAN4_FD_SOTXV_Cmd: uint8
  CAN4_FD_SOV1_Cmd: uint8
  CAN4_FD_SOV2_Cmd: uint8
  CAN4_FD_SOV3_Cmd: uint8
  CAN4_FD_TWV_Cmd: uint8
  CAN4_Fr_Coolantflow: uint8
  CAN4_Fr_Coolanttemp: uint16
  CAN4_HPThermalRecoveryReq: uint8
  CAN4_Rr_Coolantflow: uint8
  CAN4_Rr_Coolanttemp: uint16
  CAN4_sigAirIntenZon1St: uint8
  CAN4_sigAirIntenZon3St: uint8
  CAN4_sigAmbAirT: uint8
  CAN4_sigCbnAirT: uint8
  CAN4_sigCbnPTCPwrAct: uint8
  CAN4_sigCbnSolarLeft: uint8
  CAN4_sigCbnSolarRight: uint8
  CAN4_sigClmtCmprPwrAct: uint8
  CAN4_sigClntTHvBattOut: uint8
  CAN4_sigDfrstSt: uint8
  CAN4_sigHvacSt: uint8
  CAN4_sigRecircSt: uint8
  CAN4_sigSetTempZon1St: uint8
  CAN4_sigSetTempZon2St: uint8
  CAN4_sigSetTempZon3St: uint8
  CAN4_sigWindDirZon1St: uint8
  CAN4_sigWindDirZon3St: uint8

DT_CAN5_SG_FD5_CE100_0 = Simulink.Bus(HeaderFile="Rte_Type.h")
  CAN5_AllDoorSW: uint8
  CAN5_AntitheftSta: uint8
  CAN5_BCM_DoorLock_Sta: uint8
  CAN5_CCU_ACLampSts: uint8
  CAN5_CCU_CbnPreACWkSts: uint8
  CAN5_CCU_CbnPreEstimdTi: uint8
  CAN5_CCU_CbnPreSts: uint8
  CAN5_FD_TBOX_DTCData_Err: uint8
  CAN5_FD_TBOX_DTCData_Sta: uint8
  CAN5_FD_TBOX_VehData_Err: uint8
  CAN5_FD_TBOX_VehData_Sta: uint8
  CAN5_HoodSW: uint8
  CAN5_LowSOCWarn: uint8
  CAN5_PwrSta: uint8
  CAN5_Re_VehThdChkSta: uint8
  CAN5_ShiftGearPosn: uint8
  CAN5_TCountSta: uint8
  CAN5_TailgateRemote: uint8
  CAN5_Tailgate_SW: uint8
  CAN5_VehMalfunLevel: uint8

DT_CAN5_SG_FD5_Debug1 = Simulink.Bus(HeaderFile="Rte_Type.h")
  CAN5_ID1_ALTU: uint32
  CAN5_ID1_Loc_ALTU: uint8
  CAN5_ID1_message_ALTU: uint8
  CAN5_ID2_ALTU: uint32
  CAN5_ID2_Loc_ALTU: uint8
  CAN5_ID2_message_ALTU: uint8
  CAN5_ID3_ALTU: uint32
  CAN5_ID3_Loc_ALTU: uint8
  CAN5_ID3_message_ALTU: uint8
  CAN5_ID4_ALTU: uint32
  CAN5_ID4_Loc_ALTU: uint8
  CAN5_ID4_message_ALTU: uint8
  CAN5_IDin_ALTU: uint32
  CAN5_LFSensorMode: uint8
  CAN5_LRSensorMode: uint8
  CAN5_RFSensorMode: uint8
  CAN5_RF_FAT_ALTU: uint8
  CAN5_RRSensorMode: uint8
  CAN5_S1WheelDebug_ALTU: uint8
  CAN5_S2WheelDebug_ALTU: uint8
  CAN5_S3WheelDebug_ALTU: uint8
  CAN5_S4WheelDebug_ALTU: uint8

DT_CAN6_SG_FD6_BCM1 = Simulink.Bus(HeaderFile="Rte_Type.h")
  CAN6_AllDoorSW: uint8
  CAN6_AntiTheftSeatFold: uint8
  CAN6_AntitheftSta: uint8
  CAN6_BCM_Buzzer_Req: uint8
  CAN6_BCM_DoorLock_Sta: uint8
  CAN6_BrakeLamp: uint8
  CAN6_CTDCtrl: uint8
  CAN6_CTDLockSW: uint8
  CAN6_CTDUnlockSW: uint8
  CAN6_CrashDetd: uint8
  CAN6_Dimmer: uint8
  CAN6_DimmerEN: uint8
  CAN6_DoorLockIND: uint8
  CAN6_DrDoorSW: uint8
  CAN6_Fr_ChargingDoorCtrl: uint8
  CAN6_Fr_FogLamp: uint8
  CAN6_Fr_Wiper_H: uint8
  CAN6_Fr_Wiper_L: uint8
  CAN6_H_Beam: uint8
  CAN6_HazardSW: uint8
  CAN6_HoodSW: uint8
  CAN6_HornCtrl: uint8
  CAN6_LBSD: uint8
  CAN6_LDRL: uint8
  CAN6_LTurnLP: uint8
  CAN6_L_APM_WdwEnable: uint8
  CAN6_L_Beam: uint8
  CAN6_LockSetting: uint8
  CAN6_MirrorCtrl: uint8
  CAN6_MirrorDefog: uint8
  CAN6_PosLamp: uint8
  CAN6_PsDoorSW: uint8
  CAN6_RBSD: uint8
  CAN6_RDRL: uint8
  CAN6_RLDoorSW: uint8
  CAN6_RRDoorSW: uint8
  CAN6_RTurnLP: uint8
  CAN6_ReverseLamp: uint8
  CAN6_RoomLampH: uint8
  CAN6_RoomLampL: uint8
  CAN6_Rr_ChargingDoorCtrl: uint8
  CAN6_Rr_Defog: uint8
  CAN6_Rr_FogLamp: uint8
  CAN6_Rr_Wiper: uint8
  CAN6_TailgateHDSW: uint8
  CAN6_TailgateRemote: uint8
  CAN6_Tailgate_SW: uint8
  CAN6_TrunkRel: uint8
  CAN6_WasherCtrl: uint8
  CAN6_WiperFixMode: uint8

DT_CAN6_SG_FD6_VCU1 = Simulink.Bus(HeaderFile="Rte_Type.h")
  CAN6_CC_Crl_Sta: uint8
  CAN6_Eng_AGSCloseSta: uint8
  CAN6_Eng_ActvDmpDisabSta: uint8
  CAN6_Eng_CoastDwSta: uint8
  CAN6_Eng_PwrLockSta: uint8
  CAN6_HVPwrSta: uint8
  CAN6_LVPwrSta: uint8
  CAN6_MSA_Crl_Sta: uint8
  CAN6_P_Button_Sta: uint8
  CAN6_PrkReq: uint8
  CAN6_PrkReqValid: uint8
  CAN6_PwrSta: uint8
  CAN6_ShiftGearPosn: uint8
  CAN6_VCU_OPDHold: uint8
  CAN6_VehMalfunLevel: uint8
  CAN6_XWDMode: uint8

DT_CAN6_SG_FD6_VMC1 = Simulink.Bus(HeaderFile="Rte_Type.h")
  CAN6_AccCalcuPID: uint16
  CAN6_CCMSA_SpdWar: uint8
  CAN6_DISCReqAcc: uint16
  CAN6_DISC_ButtSta: uint8
  CAN6_DISC_DISCTargetSpd: uint16
  CAN6_DISC_DISCTurn: uint8
  CAN6_DISC_Sta: uint8
  CAN6_FDC_VMC_LongAccel_Cmd: uint8
  CAN6_FeatArbitrFinal: uint8
  CAN6_FeatArbitrSta: uint8
  CAN6_FeatReqSpd: uint16
  CAN6_FeatSetSpdFinal_raw32: uint8
  CAN6_FrontRearSlipRatioCtrl: uint8
  CAN6_JerkPCT: uint8
  CAN6_LatAccCtrl: uint8
  CAN6_LateralCtrl: uint8
  CAN6_LimitPCT: uint8
  CAN6_MeterIndSpeed_raw32: uint8
  CAN6_RearWhlSlipRatioCtrl: uint8
  CAN6_SPD2ACCAct: uint8
  CAN6_SafetyCtrl: uint8
  CAN6_SingleWhlSlipRatioCtrl: uint8
  CAN6_TimeGapCalcu: uint8
  CAN6_VMC_ACCCtrlAvail: uint8
  CAN6_VMC_AEBCtrlAvail: uint8
  CAN6_VMC_CCCtrlAvail: uint8
  CAN6_VMC_MSACtrlAvail: uint8
  CAN6_VMC_VCU_ACC_CtrlAvail: uint8
  CAN6_VMC_VCU_APSCtrlAvail_flg: uint8
  CAN6_VMC_VCU_AccPedal_Override: uint8
  CAN6_VMC_VCU_CC_Crl_Sta: uint8
  CAN6_VMC_VCU_MSA_Crl_Sta: uint8
  CAN6_VehicleSpeed_kph: uint16
  CAN6_VehicleSpeed_mph: uint16

DT_CAN6_SG_GW6_CE100_0 = Simulink.Bus(HeaderFile="Rte_Type.h")
  CAN6_FDC_BCM_DimSw: uint8
  CAN6_FDC_BCM_FWipSw_Sta: uint8
  CAN6_FDC_BCM_LLeftSta_Cmd: uint8
  CAN6_FDC_BCM_LRightSta_Cmd: uint8
  CAN6_FDC_BCM_PassSW_Sta: uint8
  CAN6_FDC_BCM_TurnSw_Sta: uint8
  CAN6_FDC_VMC_SpdCtrlMode_Sta: uint8
  CAN6_FDC_VMC_SpdCtrl_Sta: uint8

DT_CAN1_SG_FD1_APS3 = Simulink.Bus(HeaderFile="Rte_Type.h")
  CAN1_APS3_LifeCount: uint8
  CAN1_APS3_checksum: uint8
  CAN1_APSOpenPTG: uint8
  CAN1_APS_DecReq: uint8
  CAN1_APS_DecReq_A: uint8
  CAN1_APS_Req: uint8
  CAN1_APS_Sta_System: uint8
  CAN1_CAAS_Sta: uint8
  CAN1_FDC_APS_Active_Sta: uint8
  CAN1_FDC_APS_CaasActive_Sta: uint8
  CAN1_FDC_APS_CaasCtrlAvail_Sta: uint8
  CAN1_FDC_APS_CaasVMCReqA_Cmd: uint8
  CAN1_FDC_APS_CtrlAvail_Sta: uint8
  CAN1_FDC_APS_ShftPosnReq_Cmd: uint8
  CAN1_FDC_APS_SpeedReq_Cmd: uint16
  CAN1_FDC_APS_VMCReqA_Cmd: uint8
  CAN1_FDC_RAPS_BCMLamp_Cmd: uint8
  CAN1_FDC_RAPS_BCMLockReq_Cmd: uint8
  CAN1_FDC_RAPS_ErrLv1_Flg: uint8
  CAN1_FDC_RAPS_PwrReqAvail_Sta: uint8
  CAN1_FDC_RAPS_PwrReq_Cmd: uint8
  CAN1_FDC_VCU_RAPSErrLv2_Flg: uint8
  CAN1_FDC_VCU_RAPSErrLv3_Flg: uint8
  CAN1_FDC_VMC_APS_Angle_Target: uint16
  CAN1_FDC_VMC_APS_Rq_EPS_Ctrl: uint8
  CAN1_FDC_VMC_APS_V_Rq_EPS_Ctrl: uint8
  CAN1_SPTGDet: uint8
  CAN1_SPTG_Sta: uint8

DT_CAN1_SG_FD1_VCU2 = Simulink.Bus(HeaderFile="Rte_Type.h")
  CAN1_ACC_CtrlAvail: uint8
  CAN1_AccPedal_Override: uint8
  CAN1_ActAPSPosn: uint8
  CAN1_CS_VCU2_CAN1: uint8
  CAN1_DriverTq: uint16
  CAN1_Fr_DriverTq: uint16
  CAN1_RC_VCU2_CAN1: uint8
  CAN1_Rr_DriverTq: uint16
  CAN1_VehActPwr: uint32

DT_CAN1_SG_FD1_VCU3 = Simulink.Bus(HeaderFile="Rte_Type.h")
  CAN1_CS_VCU3_CAN1: uint8
  CAN1_EquivAccPedalSWSta: uint8
  CAN1_Fr_EDUAvailBrkRgnTq: uint16
  CAN1_Fr_EDUAvailBrkRgnTqValid: uint8
  CAN1_Fr_EDURealARgnTq: uint16
  CAN1_Fr_EDURealDrvOrBRgnTq: uint16
  CAN1_Fr_EDUSpd: uint16
  CAN1_Fr_EDUSpdValid: uint8
  CAN1_Fr_RgnDecrSta: uint8
  CAN1_Fr_RgnPermSta: uint8
  CAN1_PTCS_PermSta: uint8
  CAN1_RC_VCU3_CAN1: uint8
  CAN1_RgnAbnorSta: uint8
  CAN1_Rr_EDUAvailBrkRgnTq: uint16
  CAN1_Rr_EDUAvailBrkRgnTqValid: uint8
  CAN1_Rr_EDURealARgnTq: uint16
  CAN1_Rr_EDURealDrvOrBRgnTq: uint16
  CAN1_Rr_EDUSpd: uint16
  CAN1_Rr_EDUSpdValid: uint8
  CAN1_Rr_RgnDecrSta: uint8
  CAN1_Rr_RgnPermSta: uint8

DT_CAN3_SG_FD3_VCU2 = Simulink.Bus(HeaderFile="Rte_Type.h")
  CAN3_CS_VCU2_CAN1: uint8
  CAN3_Fr_ActvDmpDisabReq: uint8
  CAN3_Fr_IdcMax: uint16
  CAN3_Fr_IdcMin: uint16
  CAN3_Fr_MCUEnaReq: uint8
  CAN3_Fr_TMTqReq: uint16
  CAN3_Fr_TorqMax: uint16
  CAN3_Fr_TorqMin: uint16
  CAN3_Fr_UdcMax: uint16
  CAN3_Fr_UdcMin: uint16
  CAN3_RC_VCU2_CAN1: uint8
  CAN3_Rr_ActvDmpDisabReq: uint8
  CAN3_Rr_IdcMax: uint16
  CAN3_Rr_IdcMin: uint16
  CAN3_Rr_MCUEnaReq: uint8
  CAN3_Rr_TMTqReq: uint16
  CAN3_Rr_TorqMax: uint16
  CAN3_Rr_TorqMin: uint16
  CAN3_Rr_UdcMax: uint16
  CAN3_Rr_UdcMin: uint16

DT_CAN3_SG_FD3_VCU2_toNIDEC = Simulink.Bus(HeaderFile="Rte_Type.h")
  CAN3_CS_VCU2_CAN1_toNidec: uint8
  CAN3_Fr_IdcMax_toNidec: uint16
  CAN3_Fr_IdcMin_toNidec: uint16
  CAN3_Fr_TMTqReq_toNidec: uint16
  CAN3_Fr_TorqMax_toNidec: uint16
  CAN3_Fr_TorqMin_toNidec: uint16
  CAN3_Fr_UdcMax_toNidec: uint16
  CAN3_Fr_UdcMin_toNidec: uint16
  CAN3_RC_VCU2_CAN1_toNidec: uint8
  CAN3_Rr_IdcMax_toNidec: uint16
  CAN3_Rr_IdcMin_toNidec: uint16
  CAN3_Rr_TMTqReq_toNidec: uint16
  CAN3_Rr_TorqMax_toNidec: uint16
  CAN3_Rr_TorqMin_toNidec: uint16
  CAN3_Rr_UdcMax_toNidec: uint16
  CAN3_Rr_UdcMin_toNidec: uint16

DT_CAN3_SG_FD3_VCU5 = Simulink.Bus(HeaderFile="Rte_Type.h")
  CAN3_ActAPSPosn: uint8
  CAN3_Fr_EDUSpd: uint16
  CAN3_Fr_EDUSpdValid: uint8
  CAN3_Rr_EDUSpd: uint16
  CAN3_Rr_EDUSpdValid: uint8

DT_CAN3_SG_GW_ESC1_toNIDEC = Simulink.Bus(HeaderFile="Rte_Type.h")
  CAN3_VehSpeed_toNidec: uint16

DT_CAN5_SG_FD5_Debug3 = Simulink.Bus(HeaderFile="Rte_Type.h")
  CAN5_FDC_VMC_ActReqAcc_Cmd: uint16
  CAN5_FDC_VMC_ExtraMSACtrl_Sta: uint8
  CAN5_FDC_VMC_IMUGx_Cmd: uint8
  CAN5_FDC_VMC_IMUGy_Cmd: uint8
  CAN5_FDC_VMC_IMUGz_Cmd: uint8
  CAN5_FDC_VMC_IMUPitchRate_Cmd: uint16
  CAN5_FDC_VMC_IMURollRate_Cmd: uint16
  CAN5_FDC_VMC_IMUYawRate_Cmd: uint16
  CAN5_FDC_VMC_LongAccel_Cmd: uint8

DT_CAN6_SG_FD6_APS3 = Simulink.Bus(HeaderFile="Rte_Type.h")
  CAN6_APS3_LifeCount: uint8
  CAN6_APS3_checksum: uint8
  CAN6_APSOpenPTG: uint8
  CAN6_APS_DecReq: uint8
  CAN6_APS_DecReq_A: uint8
  CAN6_APS_Req: uint8
  CAN6_APS_Sta_System: uint8
  CAN6_CAAS_Sta: uint8
  CAN6_FDC_VMC_APS_Angle_Target: uint16
  CAN6_FDC_VMC_APS_Rq_EPS_Ctrl: uint8
  CAN6_FDC_VMC_APS_V_Rq_EPS_Ctrl: uint8
  CAN6_SPTGDet: uint8
  CAN6_SPTG_Sta: uint8

DT_CAN6_SG_FD6_VCU2 = Simulink.Bus(HeaderFile="Rte_Type.h")
  CAN6_ACC_CtrlAvail: uint8
  CAN6_AccPedal_Override: uint8
  CAN6_ActAPSPosn: uint8
  CAN6_CS_VCU2_CAN6: uint8
  CAN6_DriverTq: uint16
  CAN6_Fr_DriverTq: uint16
  CAN6_RC_VCU2_CAN6: uint8
  CAN6_Rr_DriverTq: uint16
  CAN6_VehActPwr: uint32

DT_CAN1_SG_FD1_THCM1 = Simulink.Bus(HeaderFile="Rte_Type.h")
  CAN1_BatteryMode: uint8
  CAN1_CCU_ACLampSts: uint8
  CAN1_CCU_ACMaxLampSts: uint8
  CAN1_CCU_AutoLampSts: uint8
  CAN1_CCU_AutoMidLampSts: uint8
  CAN1_CCU_Dispaly_Request: uint8
  CAN1_CCU_EcoSts: uint8
  CAN1_CCU_FrtOnOffLampSts: uint8
  CAN1_CCU_HEATMaxLampSts: uint8
  CAN1_CCU_RrOnOffLampSts: uint8
  CAN1_CCU_SyncLampSts: uint8
  CAN1_CabinMode: uint8
  CAN1_EDriveMode: uint8
  CAN1_FD_AGS_Cmd: uint8
  CAN1_FD_RecyAuto_Cmd: uint8
  CAN1_Fr_Coolantflow: uint8
  CAN1_Fr_Coolanttemp: uint16
  CAN1_HPThermalRecoveryReq: uint8
  CAN1_Rr_Coolantflow: uint8
  CAN1_Rr_Coolanttemp: uint16
  CAN1_sigAirIntenZon1St: uint8
  CAN1_sigAirIntenZon3St: uint8
  CAN1_sigAmbAirT: uint8
  CAN1_sigCbnAirT: uint8
  CAN1_sigCbnPTCPwrAct: uint8
  CAN1_sigCbnSolarLeft: uint8
  CAN1_sigCbnSolarRight: uint8
  CAN1_sigClmtCmprPwrAct: uint8
  CAN1_sigClntTHvBattOut: uint8
  CAN1_sigDfrstSt: uint8
  CAN1_sigHvacSt: uint8
  CAN1_sigRecircSt: uint8
  CAN1_sigSetTempZon1St: uint8
  CAN1_sigSetTempZon2St: uint8
  CAN1_sigSetTempZon3St: uint8
  CAN1_sigWindDirZon1St: uint8
  CAN1_sigWindDirZon3St: uint8

DT_CAN3_SG_FD3_THCM1 = Simulink.Bus(HeaderFile="Rte_Type.h")
  CAN3_BatteryMode: uint8
  CAN3_CCU_ACLampSts: uint8
  CAN3_CCU_ACMaxLampSts: uint8
  CAN3_CCU_AutoLampSts: uint8
  CAN3_CCU_AutoMidLampSts: uint8
  CAN3_CCU_Dispaly_Request: uint8
  CAN3_CCU_EcoSts: uint8
  CAN3_CCU_FrtOnOffLampSts: uint8
  CAN3_CCU_HEATMaxLampSts: uint8
  CAN3_CCU_RrOnOffLampSts: uint8
  CAN3_CCU_SyncLampSts: uint8
  CAN3_CabinMode: uint8
  CAN3_EDriveMode: uint8
  CAN3_FD_AGS_Cmd: uint8
  CAN3_FD_RecyAuto_Cmd: uint8
  CAN3_Fr_Coolantflow: uint8
  CAN3_Fr_Coolanttemp: uint16
  CAN3_HPThermalRecoveryReq: uint8
  CAN3_Rr_Coolantflow: uint8
  CAN3_Rr_Coolanttemp: uint16
  CAN3_sigAirIntenZon1St: uint8
  CAN3_sigAirIntenZon3St: uint8
  CAN3_sigAmbAirT: uint8
  CAN3_sigCbnAirT: uint8
  CAN3_sigCbnPTCPwrAct: uint8
  CAN3_sigCbnSolarLeft: uint8
  CAN3_sigCbnSolarRight: uint8
  CAN3_sigClmtCmprPwrAct: uint8
  CAN3_sigClntTHvBattOut: uint8
  CAN3_sigDfrstSt: uint8
  CAN3_sigHvacSt: uint8
  CAN3_sigRecircSt: uint8
  CAN3_sigSetTempZon1St: uint8
  CAN3_sigSetTempZon2St: uint8
  CAN3_sigSetTempZon3St: uint8
  CAN3_sigWindDirZon1St: uint8
  CAN3_sigWindDirZon3St: uint8

DT_CAN3_SG_GW_IVI6_toNIDEC = Simulink.Bus(HeaderFile="Rte_Type.h")
  CAN3_IVI_Time_Day_toNidec: uint8
  CAN3_IVI_Time_Hour_toNidec: uint8
  CAN3_IVI_Time_Minute_toNidec: uint8
  CAN3_IVI_Time_Month_toNidec: uint8
  CAN3_IVI_Time_Second_toNidec: uint8

DT_CAN1_SG_FD1_APS2 = Simulink.Bus(HeaderFile="Rte_Type.h")
  CAN1_APS_D_FLL: uint16
  CAN1_APS_D_FLR: uint16
  CAN1_APS_D_RLL: uint16
  CAN1_APS_D_RLR: uint16
  CAN1_APS_ExitCondition: uint8
  CAN1_APS_HW_Ver: uint8
  CAN1_APS_Progress_PCT: uint8
  CAN1_APS_RQ_Display: uint8
  CAN1_APS_SW_Ver: uint8
  CAN1_PAS_A_FCL: uint8
  CAN1_PAS_A_FCR: uint8
  CAN1_PAS_A_FML: uint8
  CAN1_PAS_A_FMR: uint8
  CAN1_PAS_A_RCL: uint8
  CAN1_PAS_A_RCR: uint8
  CAN1_PAS_A_RML: uint8
  CAN1_PAS_A_RMR: uint8
  CAN1_PAS_Chime: uint8
  CAN1_PAS_D_FCL: uint8
  CAN1_PAS_D_FCR: uint8
  CAN1_PAS_D_FML: uint8
  CAN1_PAS_D_FMR: uint8
  CAN1_PAS_D_RCL: uint8
  CAN1_PAS_D_RCR: uint8
  CAN1_PAS_D_RML: uint8
  CAN1_PAS_D_RMR: uint8
  CAN1_PAS_Mod_Operation: uint8
  CAN1_PAS_SNSR_Layout: uint8
  CAN1_PAS_Sta_F_Sys: uint8
  CAN1_USS_Sta_FCL: uint8
  CAN1_USS_Sta_FCR: uint8
  CAN1_USS_Sta_FLL: uint8
  CAN1_USS_Sta_FLR: uint8
  CAN1_USS_Sta_FML: uint8
  CAN1_USS_Sta_FMR: uint8
  CAN1_USS_Sta_RCL: uint8
  CAN1_USS_Sta_RCR: uint8
  CAN1_USS_Sta_RLL: uint8
  CAN1_USS_Sta_RLR: uint8
  CAN1_USS_Sta_RML: uint8
  CAN1_USS_Sta_RMR: uint8

DT_CAN2_SG_FD2_C20_0 = Simulink.Bus(HeaderFile="Rte_Type.h")
  CAN2_APS_ExitCondition: uint8
  CAN2_APS_RQ_Display: uint8
  CAN2_APS_SW_Ver: uint8
  CAN2_APS_Sta_System: uint8
  CAN2_CAAS_Sta: uint8
  CAN2_DISC_DISCTargetSpd: uint16
  CAN2_FDC_VCU_RegenLimInd_Sta: uint8
  CAN2_FDC_VCU_RegenMode_Sta: uint8
  CAN2_FDC_VCU_SmartEcoSpdLim_Sta: uint8
  CAN2_FDC_VCU_SmartEco_Sta: uint8
  CAN2_FDC_VMC_SetSpdDisp_Sta: uint8
  CAN2_FDC_VMC_SetSpd_Sta: uint8
  CAN2_FDC_VMC_SpdCtrlMode_Sta: uint8
  CAN2_FDC_VMC_SpdCtrl_Sta: uint8
  CAN2_PAS_A_FCL: uint8
  CAN2_PAS_A_FCR: uint8
  CAN2_PAS_A_FML: uint8
  CAN2_PAS_A_FMR: uint8
  CAN2_PAS_A_RCL: uint8
  CAN2_PAS_A_RCR: uint8
  CAN2_PAS_A_RML: uint8
  CAN2_PAS_A_RMR: uint8
  CAN2_PAS_Chime: uint8
  CAN2_PAS_D_FCL: uint8
  CAN2_PAS_D_FCR: uint8
  CAN2_PAS_D_FML: uint8
  CAN2_PAS_D_FMR: uint8
  CAN2_PAS_D_RCL: uint8
  CAN2_PAS_D_RCR: uint8
  CAN2_PAS_D_RML: uint8
  CAN2_PAS_D_RMR: uint8
  CAN2_PAS_SNSR_Layout: uint8
  CAN2_USS_Sta_FCL: uint8
  CAN2_USS_Sta_FCR: uint8
  CAN2_USS_Sta_FLL: uint8
  CAN2_USS_Sta_FLR: uint8
  CAN2_USS_Sta_FML: uint8
  CAN2_USS_Sta_FMR: uint8
  CAN2_USS_Sta_RCL: uint8
  CAN2_USS_Sta_RCR: uint8
  CAN2_USS_Sta_RLL: uint8
  CAN2_USS_Sta_RLR: uint8
  CAN2_USS_Sta_RML: uint8
  CAN2_USS_Sta_RMR: uint8
  CAN2_VMC_VCU_CC_Crl_Sta: uint8
  CAN2_VMC_VCU_MSA_Crl_Sta: uint8

DT_CAN1_SG_FD1_VMC2 = Simulink.Bus(HeaderFile="Rte_Type.h")
  CAN1_FDC_VMC_RWS_Actv_Sta: uint8
  CAN1_FDC_VMC_RWS_Dfctv_Sta: uint8
  CAN1_FDC_VMC_RWS_PositionReq_Cmd: uint16
  CAN1_FDC_VMC_SteerFaultReq_Cmd: uint8

DT_CAN2_SG_FD2_Version = Simulink.Bus(HeaderFile="Rte_Type.h")
  CAN2_FUSION_HW_Ver1: uint8
  CAN2_FUSION_HW_Ver2: uint8
  CAN2_FUSION_HW_Ver3: uint8
  CAN2_FUSION_SW_CarModel1: uint8
  CAN2_FUSION_SW_CarModel2: uint8
  CAN2_FUSION_SW_CarModel3: uint8
  CAN2_FUSION_SW_Controller1: uint8
  CAN2_FUSION_SW_Controller2: uint8
  CAN2_FUSION_SW_Country1: uint8
  CAN2_FUSION_SW_Country2: uint8
  CAN2_FUSION_SW_ECUGen1: uint8
  CAN2_FUSION_SW_ECUGen2: uint8
  CAN2_FUSION_SW_Major1: uint8
  CAN2_FUSION_SW_Major2: uint8
  CAN2_FUSION_SW_Minor1: uint8
  CAN2_FUSION_SW_Minor2: uint8
  CAN2_FUSION_SW_Patch1: uint8
  CAN2_FUSION_SW_Patch2: uint8
  CAN2_FUSION_SW_SHA1: uint8
  CAN2_FUSION_SW_SHA2: uint8
  CAN2_FUSION_SW_SHA3: uint8
  CAN2_FUSION_SW_SHA4: uint8
  CAN2_FUSION_SW_SHA5: uint8
  CAN2_FUSION_SW_SHA6: uint8
  CAN2_FUSION_SW_SHA7: uint8
  CAN2_FUSION_SW_SHA8: uint8
  CAN2_FUSION_SW_Var1: uint8
  CAN2_FUSION_SW_Var2: uint8
  CAN2_FUSION_SW_Var3: uint8
  CAN2_FUSION_SW_Var4: uint8
  CAN2_FUSION_SW_Var5: uint8
  CAN2_FUSION_SW_change1: uint8
  CAN2_FUSION_SW_change2: uint8
  CAN2_FUSION_SW_dash1: uint8
  CAN2_FUSION_SW_dash2: uint8

DT_CAN3_SG_FD3_VCU1 = Simulink.Bus(HeaderFile="Rte_Type.h")
  CAN3_ActiveDischReq: uint8
  CAN3_CS_VCU1: uint8
  CAN3_CoastDwModeStaChk: uint8
  CAN3_DCDCEnaReq: uint8
  CAN3_DCDCVoltSetpoint: uint8
  CAN3_DemoModeStaChk: uint8
  CAN3_Dr_SeatSta: uint8
  CAN3_DynoModeStaChk: uint8
  CAN3_HVBatCnctReq: uint8
  CAN3_HVSysReadyToCharge: uint8
  CAN3_LVChrgFuncStaChk: uint8
  CAN3_MSA_Crl_Sta: uint8
  CAN3_P_Button_Sta: uint8
  CAN3_PrkReq: uint8
  CAN3_PrkReqValid: uint8
  CAN3_PwrSta: uint8
  CAN3_RC_VCU1: uint8
  CAN3_ShiftGearPosn: uint8

DT_CAN3_SG_FD3_VCU1_toNIDEC = Simulink.Bus(HeaderFile="Rte_Type.h")
  CAN3_ActiveDischReq_toNidec: uint8
  CAN3_CS_VCU1_toNidec: uint8
  CAN3_CoastDwModeStaChk_toNidec: uint8
  CAN3_DCDCEnaReq_toNidec: uint8
  CAN3_DCDCVoltSetpoint_toNidec: uint8
  CAN3_DemoModeStaChk_toNidec: uint8
  CAN3_Dr_SeatSta_toNidec: uint8
  CAN3_DynoModeStaChk_toNidec: uint8
  CAN3_Fr_ActvDmpDisabReq_toNidec: uint8
  CAN3_Fr_MCUEnaReq_toNidec: uint8
  CAN3_HVBatCnctReq_toNidec: uint8
  CAN3_HVSysReadyToCharge_toNidec: uint8
  CAN3_LVChrgFuncStaChk_toNidec: uint8
  CAN3_MSA_Crl_Sta_toNidec: uint8
  CAN3_PrkReq_toNidec: uint8
  CAN3_PwrSta_toNidec: uint8
  CAN3_RC_VCU1_toNidec: uint8
  CAN3_Rr_ActvDmpDisabReq_toNidec: uint8
  CAN3_Rr_MCUEnaReq_toNidec: uint8
  CAN3_ShiftGearPosn_toNidec: uint8

P_boolean = Simulink.Parameter(0, DataType="uint8")

DT_CAN1_SG_EPS1 = Simulink.Bus(HeaderFile="Rte_Type.h")
  CAN1_DriIntend: uint8
  CAN1_EPS_AOI_Control: uint8
  CAN1_EPS_AOI_Dis_R: uint8
  CAN1_EPS_CS: uint8
  CAN1_EPS_DMSMode_Sta: uint8
  CAN1_EPS_ESABoostOut_Trq: uint8
  CAN1_EPS_ESAInpBoost_Sta: uint8
  CAN1_EPS_LDW_Activation: uint8
  CAN1_EPS_LDW_Unavailable: uint8
  CAN1_EPS_Pwr_Consumpt: uint16
  CAN1_EPS_Pwr_Consumpt_V: uint8
  CAN1_EPS_Pwr_Limit: uint16
  CAN1_EPS_Pwr_Limit_V: uint8
  CAN1_EPS_RC: uint8
  CAN1_EPS_TOI_Activation: uint8
  CAN1_EPS_TOI_Dis_R: uint8
  CAN1_EPS_TOI_Fault: uint8
  CAN1_EPS_TOI_Unavailable: uint8
  CAN1_EPS_Temp: uint8
  CAN1_EPS_Temp_V: uint8
  CAN1_EPS_VOL: uint8
  CAN1_EPS_VOL_V: uint8
  CAN1_EpasFailed: uint8
  CAN1_SAS_Angle: uint16
  CAN1_SAS_CAL: uint8
  CAN1_SAS_Speed: uint8
  CAN1_SAS_Speed_Valid: uint8
  CAN1_SAS_V: uint8
  CAN1_Steering_Torque: uint16
  CAN1_Steering_Torque_V: uint8

DT_CAN2_SG_IVI1 = Simulink.Bus(HeaderFile="Rte_Type.h")
  CAN2_A2B_Node_sta: uint8
  CAN2_AmbLigh_LowBatAlert_SW: uint8
  CAN2_AmbLigh_SafetyAlert_SW: uint8
  CAN2_AmbLightBrightnessSet: uint8
  CAN2_AmbLightColorSet: uint8
  CAN2_AmbLight_DimInDark_SW: uint8
  CAN2_AmbLight_SW: uint8
  CAN2_AmbLight_WlcmLight_SW: uint8
  CAN2_BrkAbn_GoReady_SW: uint8
  CAN2_FCP_FrEvt_BtnACMaxReq: uint8
  CAN2_FCP_FrEvt_BtnACReq: uint8
  CAN2_FCP_FrEvt_BtnAutoReq: uint8
  CAN2_FCP_FrEvt_BtnSyncReq: uint8
  CAN2_FCP_MidEvt_BtnAutoReq: uint8
  CAN2_IVI_AirRefresh_ByDMS_Sta: uint8
  CAN2_IVI_AutoTheme_But_Sta: uint8
  CAN2_IVI_AutoWipHSpdSW_Cmd: uint8
  CAN2_IVI_CLWin_LockDoorSW_Sta: uint8
  CAN2_IVI_CreateAccReq_Sta: uint8
  CAN2_IVI_DMS_SW_Sta: uint8
  CAN2_IVI_DSEAT_StopKeepMove_Sta: uint8
  CAN2_IVI_DSEAT_anti_set_Sta: uint8
  CAN2_IVI_DSEAT_entryfun_set_Sta: uint8
  CAN2_IVI_DelAccReq_Sta: uint8
  CAN2_IVI_Driving_Lock_SW_Sta: uint8
  CAN2_IVI_EPS_Force_Cmd: uint8
  CAN2_IVI_FrTrunk_UnlockReq_Sta: uint8
  CAN2_IVI_HMI_Undefined_Sta: uint8
  CAN2_IVI_LinkAccReq_Sta: uint8
  CAN2_IVI_LinkAcc_Sta: uint8
  CAN2_IVI_LinkKey_Sta: uint8
  CAN2_IVI_Located_STA: uint8
  CAN2_IVI_Lock_SoundSW_Sta: uint8
  CAN2_IVI_MirrorFolded_SW_Sta: uint8
  CAN2_IVI_NAVI_Foreground_Sta: uint8
  CAN2_IVI_OTA_Upd_Sta: uint8
  CAN2_IVI_QuickRefresh_Sta: uint8
  CAN2_IVI_SWC_VibMode_Sta: uint8
  CAN2_IVI_SilentChrg_Alert_Sta: uint8
  CAN2_IVI_Stopping_Unlock_SW_Sta: uint8
  CAN2_IVI_Theme_Sta: uint8
  CAN2_IVI_Time_Check: uint8
  CAN2_IVI_Time_Day: uint8
  CAN2_IVI_Time_Hour: uint8
  CAN2_IVI_Time_Minute: uint8
  CAN2_IVI_Time_Month: uint8
  CAN2_IVI_Time_Second: uint8
  CAN2_IVI_Time_Year: uint8
  CAN2_IVI_WPTC_SW_Sta: uint8
  CAN2_IVI_WirelessCharge_Cmd: uint8
  CAN2_IVI_sigScreenReq_Sta: uint8
  CAN2_LINKtoDrive: uint8
  CAN2_OTA_CancelDL_Req: uint8
  CAN2_OTA_CompNTFY_Pres: uint8
  CAN2_OTA_DL_Req: uint8
  CAN2_OTA_SuspendDL_Req: uint8
  CAN2_OTA_UpdStart_Req: uint8
  CAN2_OpenDrOpenWdo_SW: uint8
  CAN2_PW_CLOSE_IMD: uint8
  CAN2_PW_CONTINUE_USE: uint8
  CAN2_Re_Radio_Sta: uint8
  CAN2_Sched_Chg_Day_Set: uint8
  CAN2_Sched_Chg_End_Time_HR: uint8
  CAN2_Sched_Chg_End_Time_Min: uint8
  CAN2_Sched_Chg_St_Time_HR: uint8
  CAN2_Sched_Chg_St_Time_Min: uint8
  CAN2_Sched_OTA_wake: uint8
  CAN2_SmartEco_Mode_SW: uint8
  CAN2_Upd_Countdown_Cancel: uint8
  CAN2_Upd_Countdown_Skip: uint8
  CAN2_UserSet: uint8
  CAN2_VehACModReq: uint8
  CAN2_mFRD_link_Sta: uint8

DT_CAN4_SG_BodyZone_DR1 = Simulink.Bus(HeaderFile="Rte_Type.h")
  CAN4_BD_DSEAT_AntiAct_Sta: uint8
  CAN4_BD_DSEAT_Anti_Sta: uint8
  CAN4_BD_DSEAT_EntryAct_Sta: uint8
  CAN4_BD_DSEAT_EntryFun_Sta: uint8
  CAN4_BD_DSEAT_Error_Sta: uint8
  CAN4_BD_DSEAT_FLPos_Sta: uint16
  CAN4_BD_DSEAT_MemSet_Sta: uint8
  CAN4_BD_DSEAT_Mode_Sta: uint8
  CAN4_BD_DSEAT_RLPos_Sta: uint16
  CAN4_BD_DSEAT_RecPos_Sta: uint16
  CAN4_BD_DSEAT_SlidPos_Sta: uint16
  CAN4_BD_DSEAT_StopKeepMove_Sta: uint8
  CAN4_BD_DSEAT_Vent_Sta: uint8
  CAN4_BD_DSEAT_heater_Sta: uint8

DT_CAN1_SG_GW1_CE100_0 = Simulink.Bus(HeaderFile="Rte_Type.h")
  CAN1_BMS_READY: uint8
  CAN1_Fr_TMSpd: uint16
  CAN1_Rr_TMSpd: uint16

DT_CAN4_SG_CGW_GW4_CE100_0 = Simulink.Bus(HeaderFile="Rte_Type.h")
  CAN4_AVM_parking_excute: uint8
  CAN4_Approach_Unlock_SW: uint8
  CAN4_BMS_Warn_4: uint8
  CAN4_BMS_Warn_5: uint8
  CAN4_BrkPedalPos: uint8
  CAN4_BrkPedalPos_Sta: uint8
  CAN4_BrkSw_Sta: uint8
  CAN4_BrkSw_V: uint8
  CAN4_ChrgInLockReq: uint8
  CAN4_ChrgPlugSta: uint8
  CAN4_DSEAT_anti_set: uint8
  CAN4_DSEAT_entryfun_set: uint8
  CAN4_DSEAT_vent_req: uint8
  CAN4_Distance_unit: uint8
  CAN4_ExtChrgSta: uint8
  CAN4_HMI_DSEAT_LevelDown_Cmd: uint8
  CAN4_HMI_DSEAT_LevelUp_Cmd: uint8
  CAN4_HMI_PSEAT_LevelDown_Cmd: uint8
  CAN4_HMI_PSEAT_LevelUp_Cmd: uint8
  CAN4_HeadLampSW: uint8
  CAN4_Hood_Latch_SW: uint8
  CAN4_IVI_CarWash_Mode_Cmd: uint8
  CAN4_IVI_ChargePortSW_Sta: uint8
  CAN4_IVI_DSEATHeater_Cmd: uint8
  CAN4_IVI_DSEAT_FroEdge_Height_Cmd: uint8
  CAN4_IVI_DSEAT_Height_Cmd: uint8
  CAN4_IVI_DSEAT_Memory1_Sta: uint8
  CAN4_IVI_DSEAT_Memory2_Sta: uint8
  CAN4_IVI_DSEAT_Memory_OPTCLS_Sta: uint8
  CAN4_IVI_DSEAT_Recline_Cmd: uint8
  CAN4_IVI_DSEAT_Slide_Cmd: uint8
  CAN4_IVI_DSEAT_StopKeepMove_Sta: uint8
  CAN4_IVI_DSEAT_entryfun_set_Sta: uint8
  CAN4_IVI_ISA_OffsetSpd: uint8
  CAN4_IVI_Located_STA: uint8
  CAN4_IVI_PSEATHeater_Cmd: uint8
  CAN4_IVI_PSEAT_Recline_Cmd: uint8
  CAN4_IVI_PSEAT_Slide_Cmd: uint8
  CAN4_IVI_PTG_Mode_SW: uint8
  CAN4_IVI_PTG_Open_Height: uint8
  CAN4_IVI_PTG_Sta_SW: uint8
  CAN4_IVI_Time_Check: uint8
  CAN4_IVI_Time_Day: uint8
  CAN4_IVI_Time_Hour: uint8
  CAN4_IVI_Time_Minute: uint8
  CAN4_IVI_Time_Month: uint8
  CAN4_IVI_Time_Second: uint8
  CAN4_IVI_Time_Year: uint8
  CAN4_IVI_TrailerCheckReq_Sta: uint8
  CAN4_IVI_TrailerModeSW_Sta: uint8
  CAN4_Light_ShowStart_Req: uint8
  CAN4_Light_ShowStop_Req: uint8
  CAN4_MCPressure: uint16
  CAN4_MCPressure_V: uint8
  CAN4_METER_KPH_Calcu: uint8
  CAN4_OBCV2LSta: uint8
  CAN4_OFF_AC_MODE: uint8
  CAN4_PSEAT_vent_req: uint8
  CAN4_TBOX_Remote_PW: uint8
  CAN4_V2LSta: uint8
  CAN4_VehSpeed: uint16
  CAN4_Walkaway_Lock_SW: uint8
  CAN4_WlcmLight_Mode: uint8

DT_CAN2_SG_FD2_CE100_0 = Simulink.Bus(HeaderFile="Rte_Type.h")
  CAN2_APMDoorControlSta: uint8
  CAN2_ActAPSPosn: uint8
  CAN2_AllDoorSW: uint8
  CAN2_AntitheftSta: uint8
  CAN2_BCM_DoorLock_Sta: uint8
  CAN2_BrakeLamp: uint8
  CAN2_CCMSA_SpdWar: uint8
  CAN2_CCU_ACLampSts: uint8
  CAN2_CCU_ACMaxLampSts: uint8
  CAN2_CCU_AutoLampSts: uint8
  CAN2_CCU_AutoMidLampSts: uint8
  CAN2_CCU_Dispaly_Request: uint8
  CAN2_CCU_EcoSts: uint8
  CAN2_CCU_FrtOnOffLampSts: uint8
  CAN2_CCU_RrOnOffLampSts: uint8
  CAN2_CCU_SyncLampSts: uint8
  CAN2_CC_Crl_Sta: uint8
  CAN2_CoastDwModeStaChk: uint8
  CAN2_CreepSW_Sta: uint8
  CAN2_DISC_ButtSta: uint8
  CAN2_DISC_Sta: uint8
  CAN2_DemoModeStaChk: uint8
  CAN2_Dimmer: uint8
  CAN2_DimmerEN: uint8
  CAN2_DisengageP_Fail: uint8
  CAN2_DoorLockIND: uint8
  CAN2_DrDoorSW: uint8
  CAN2_Dr_SeatSta: uint8
  CAN2_DynoModeStaChk: uint8
  CAN2_EDriveSysErr_AccPedalErr: uint8
  CAN2_EDriveSysErr_MCUErr: uint8
  CAN2_EDriveSysErr_ShifterErr: uint8
  CAN2_EDriveSysErr_VCUErr: uint8
  CAN2_EVDriveMode: uint8
  CAN2_Eng_AGSCloseSta: uint8
  CAN2_Eng_ActvDmpDisabSta: uint8
  CAN2_Eng_CoastDwSta: uint8
  CAN2_Eng_PwrLockSta: uint8
  CAN2_EngageP_Fail: uint8
  CAN2_FDC_BCM_AutoWipHSpdEN_Sta: uint8
  CAN2_FDC_BCM_HMIKey1Func_Sta: uint8
  CAN2_FDC_BCM_HMIKey2Func_Sta: uint8
  CAN2_FDC_BCM_HMIKey3Func_Sta: uint8
  CAN2_FDC_BCM_HMIKey4Func_Sta: uint8
  CAN2_FDC_BCM_HMIKey5Func_Sta: uint8
  CAN2_FDC_BCM_HMIKey6Func_Sta: uint8
  CAN2_FDC_BCM_HMIKey7Func_Sta: uint8
  CAN2_FDC_BCM_HMIKey8Func_Sta: uint8
  CAN2_FDC_RAPS_ErrWarn_Sta: uint8
  CAN2_FDC_THCM_CLEVentY_Sta: uint8
  CAN2_FDC_THCM_CLEVentZ_Sta: uint8
  CAN2_FDC_THCM_CLVent_Sta: uint8
  CAN2_FDC_THCM_CREVentY_Sta: uint8
  CAN2_FDC_THCM_CREVentZ_Sta: uint8
  CAN2_FDC_THCM_CRVent_Sta: uint8
  CAN2_FDC_THCM_DrEVentMode_Sta: uint8
  CAN2_FDC_THCM_DrEVentY_Sta: uint8
  CAN2_FDC_THCM_DrEVentZ_Sta: uint8
  CAN2_FDC_THCM_DrVent_Sta: uint8
  CAN2_FDC_THCM_PreWPTCHeat_Sta: uint8
  CAN2_FDC_THCM_PsEVentMode_Sta: uint8
  CAN2_FDC_THCM_PsEVentY_Sta: uint8
  CAN2_FDC_THCM_PsEVentZ_Sta: uint8
  CAN2_FDC_THCM_PsVent_Sta: uint8
  CAN2_FDC_V2L_IVIV2LDischarg_Cmd: uint8
  CAN2_FDC_VCU_LVChrgFreq_Sta: uint8
  CAN2_FDC_VCU_LVStaDropQuick_Sta: uint8
  CAN2_FDC_VCU_LVStaTooLow_Sta: uint8
  CAN2_FDC_VCU_PwrSaveReq_Cmd: uint8
  CAN2_FDC_VCU_TrailerDisOPD_Sta: uint8
  CAN2_FD_ABS_Warning: uint8
  CAN2_FD_AGS_Cmd: uint8
  CAN2_FD_Battery_Charge_Warning: uint8
  CAN2_FD_EBMErrSta: uint8
  CAN2_FD_EDrive_System: uint8
  CAN2_FD_EPB_Error: uint8
  CAN2_FD_HV_Battery_Fault: uint8
  CAN2_FD_Park_Brake_Warning: uint8
  CAN2_FD_Power_limitation: uint8
  CAN2_FD_Steering_Warning: uint8
  CAN2_FD_TCS_Indicator: uint8
  CAN2_FD_Telltale_Fail: uint8
  CAN2_FalseNPrevent_Sta: uint8
  CAN2_FeatSetSpdFinal_raw32: uint8
  CAN2_FollowMe: uint8
  CAN2_Fr_FogLamp: uint8
  CAN2_HVRlyOpFail: uint8
  CAN2_HVSysErr_IsolationErr: uint8
  CAN2_HVSysErr_PackErr: uint8
  CAN2_HVSysErr_RelayErr: uint8
  CAN2_H_Beam: uint8
  CAN2_HazardSW: uint8
  CAN2_HoodSW: uint8
  CAN2_LBSD: uint8
  CAN2_LDRL: uint8
  CAN2_LTurnLP: uint8
  CAN2_LVChrgFuncStaChk: uint8
  CAN2_LVSilentChrgReq: uint8
  CAN2_LVSilentChrgSta: uint8
  CAN2_LVSysErr_PwrOutpErr: uint8
  CAN2_L_Beam: uint8
  CAN2_LimphomeAct: uint8
  CAN2_LockSetting: uint8
  CAN2_MCUActDisFail: uint8
  CAN2_MSA_Crl_Sta: uint8
  CAN2_MeterIndSpeed_raw32: uint8
  CAN2_PAS_Sta_F_Sys: uint8
  CAN2_PosLamp: uint8
  CAN2_PsDoorSW: uint8
  CAN2_PwrSta: uint8
  CAN2_PwrStaErr: uint8
  CAN2_PwrStaONTOIVIPopReq: uint8
  CAN2_PwrStaONTOIVIPopT: uint16
  CAN2_RBSD: uint8
  CAN2_RDRL: uint8
  CAN2_RLDoorSW: uint8
  CAN2_RRDoorSW: uint8
  CAN2_RTurnLP: uint8
  CAN2_Req_Internal_V2L_Status_Lamp: uint8
  CAN2_Req_V2LSwOn: uint8
  CAN2_Req_V2L_IVI_Popup: uint8
  CAN2_ReverseLamp: uint8
  CAN2_Rr_Defog: uint8
  CAN2_Rr_FogLamp: uint8
  CAN2_ShiftGearPosn: uint8
  CAN2_SysAllowReadySta: uint8
  CAN2_SysPwrSta: uint8
  CAN2_Tailgate_SW: uint8
  CAN2_VCUBrkSWSta: uint8
  CAN2_VCUFLDoorSta: uint8
  CAN2_VCUFRDoorSta: uint8
  CAN2_VCUHoodSWSta: uint8
  CAN2_VCURLDoorSta: uint8
  CAN2_VCURRDoorSta: uint8
  CAN2_VCUTailgateSWSta: uint8
  CAN2_VCU_OPDHold: uint8
  CAN2_VehMalfunLevel: uint8
  CAN2_XWDMode: uint8
  CAN2_sigAirIntenZon1St: uint8
  CAN2_sigAirIntenZon3St: uint8
  CAN2_sigAmbAirT: uint8
  CAN2_sigCbnAirT: uint8
  CAN2_sigDfrstSt: uint8
  CAN2_sigHvacSt: uint8
  CAN2_sigRecircSt: uint8
  CAN2_sigSetTempZon1St: uint8
  CAN2_sigSetTempZon2St: uint8
  CAN2_sigSetTempZon3St: uint8
  CAN2_sigWindDirZon1St: uint8
  CAN2_sigWindDirZon3St: uint8

DT_CAN1_SG_VMC_FCM1 = Simulink.Bus(HeaderFile="Rte_Type.h")
  CAN1_FDC_VMC_AngCtrlTqWtGn: uint8
  CAN1_FDC_VMC_DMSMode_Cmd: uint8
  CAN1_FDC_VMC_DrInpTqBstAct: uint8
  CAN1_FDC_VMC_DrInpTqBstGn: uint8
  CAN1_FDC_VMC_MaxAngCtrlOutTqLim: uint16
  CAN1_VMC_ACC_ComfortBandLower: uint16
  CAN1_VMC_ACC_ComfortBandUpper: uint16
  CAN1_VMC_ACC_JerkLowerLInit: uint8
  CAN1_VMC_ACC_JerkUpperLInit: uint8
  CAN1_VMC_ACC_RequiredAccel: uint16
  CAN1_VMC_ACC_VehHoldReq: uint8
  CAN1_VMC_ADAS_ACC_Sta: uint8
  CAN1_VMC_ADAS_AEBReq: uint8
  CAN1_VMC_ADAS_AEB_Sta: uint8
  CAN1_VMC_ADAS_DBSReq: uint8
  CAN1_VMC_ADAS_FaultSta: uint8
  CAN1_VMC_AEB_VehHoldReq: uint8
  CAN1_VMC_FCM1_Checksum: uint8
  CAN1_VMC_FCM1_LifeCount: uint8
  CAN1_VMC_FCM_LDW_Fault: uint8
  CAN1_VMC_FCM_LDW_Request: uint8
  CAN1_VMC_FCM_LKA_StrToqReq: uint16
  CAN1_VMC_FCM_LKA_TOIAct: uint8
  CAN1_VMC_FCM_LKA_TOIFault: uint8

DT_CAN3_SG_FD3_VCU0 = Simulink.Bus(HeaderFile="Rte_Type.h")
  CAN3_EVCCAplusPwrUpReq: uint8
  CAN3_FDADC12VDet: uint8
  CAN3_FDADC12VDetAvg: uint8
  CAN3_FDC_SYS_PmicBootPath: uint32
  CAN3_FDC_VCU_ActMaxSlideRate_Sta: uint16
  CAN3_FDC_VCU_AllowMovThd_OTA_Sta: uint8
  CAN3_FDC_VCU_BrakeSigMatrix_Sta: uint8
  CAN3_FDC_VCU_BrkPedalPosSta_Sta: uint8
  CAN3_FDC_VCU_CANBrkSW2Sta_Sta: uint8
  CAN3_FDC_VCU_DTCCarousel_Sta: uint8
  CAN3_FDC_VCU_EAPS1Min_Sta: uint8
  CAN3_FDC_VCU_EAPS1Raw_Sta: uint8
  CAN3_FDC_VCU_EAPS2Min_Sta: uint8
  CAN3_FDC_VCU_EAPS2Raw_Sta: uint8
  CAN3_FDC_VCU_ForceP_Cmd: uint8
  CAN3_FDC_VCU_LVChrgFreqCnt_Sta: uint8
  CAN3_FDC_VCU_LVStaDropQukCnt_Sta: uint8
  CAN3_FDC_VCU_LowIdleAccPedal_Sta: uint8
  CAN3_FDC_VCU_OTAPwrReqOFFChk_Sta: uint8
  CAN3_FDC_VCU_OTAPwrReqStdChk_Sta: uint8
  CAN3_FDC_VCU_PwrReq_OTA_Sta: uint8
  CAN3_FDC_VCU_RWDRDCActive_Sta: uint8
  CAN3_FDC_VCU_RegenTqLimitEn_Sta: uint8
  CAN3_FDC_VCU_SlideRegenLimTq_Sta: uint16
  CAN3_FDC_VCU_VehActSpd_Sta: uint16
  CAN3_FDC_VCU_VehMalfunLevel_Sta: uint8
  CAN3_FDC_VMC_ActStESCYaw_Sta: uint16
  CAN3_FDC_VMC_LongAcc_Sta: uint16
  CAN3_FUSION_CMM1: uint8
  CAN3_FUSION_CMM10: uint8
  CAN3_FUSION_CMM2: uint8
  CAN3_FUSION_CMM3: uint8
  CAN3_FUSION_CMM4: uint8
  CAN3_FUSION_CMM5: uint8
  CAN3_FUSION_CMM6: uint8
  CAN3_FUSION_CMM7: uint8
  CAN3_FUSION_CMM8: uint8
  CAN3_FUSION_CMM9: uint8
  CAN3_Fr_TqSource: uint8
  CAN3_HVRlyOpFail: uint8
  CAN3_HVTHCMSysAvail: uint8
  CAN3_LVBattChrgtimeAct: uint16
  CAN3_LVBattVoltSta: uint8
  CAN3_LVChrgHoldTAct: uint16
  CAN3_LVSilentChrgLv: uint8
  CAN3_LVSilentChrgReq: uint8
  CAN3_LVSilentChrgSta: uint8
  CAN3_MCUActDisFail: uint8
  CAN3_PMMAllowECUSleep: uint8
  CAN3_PmicBootReason: uint8
  CAN3_PowerDownFault: uint8
  CAN3_PowerDownState: uint8
  CAN3_PowerUpFault: uint8
  CAN3_PowerUpState: uint8
  CAN3_PwrDownReq: uint8
  CAN3_PwrStaConstraint: uint8
  CAN3_PwrStaONTOIVIPopReq: uint8
  CAN3_PwrStaONTOIVIPopT: uint16
  CAN3_PwrStaSelect: uint8
  CAN3_PwrStaTOSta: uint8
  CAN3_PwrUpReq: uint8
  CAN3_Rr_TqSource: uint8
  CAN3_SchedChgTOSta: uint8
  CAN3_SilentChkAllowSleep: uint8
  CAN3_SysAllowReadySta: uint8
  CAN3_SysPwrSta: uint8
  CAN3_TCountSta: uint8
  CAN3_TimerAllowSleep: uint8
  CAN3_VCUBrkSWSta: uint8
  CAN3_VCUFLDoorSta: uint8
  CAN3_VCUFRDoorSta: uint8
  CAN3_VCURLDoorSta: uint8
  CAN3_VCURRDoorSta: uint8
  CAN3_VehHVPwrAvail4THCM: uint8
  CAN3_WisrBootReason: uint32

DT_CAN4_SG_zGW_LINDr2 = Simulink.Bus(HeaderFile="Rte_Type.h")
  CAN4_ACT1_Actual_position_of_actuator: uint16
  CAN4_ACT1_Actuator_address_status: uint8
  CAN4_ACT1_Applied_holding_current_status: uint8
  CAN4_ACT1_Electrical_defect: uint8
  CAN4_ACT1_Emergency_run_occurred: uint8
  CAN4_ACT1_Emergency_run_position_status: uint8
  CAN4_ACT1_Emergency_run_release_status: uint8
  CAN4_ACT1_Movement_direction: uint8
  CAN4_ACT1_Over_temperature: uint8
  CAN4_ACT1_Position_specification_status: uint8
  CAN4_ACT1_Reset: uint8
  CAN4_ACT1_Response_Error: uint8
  CAN4_ACT1_Rotation_direction_status: uint8
  CAN4_ACT1_Self_holding_torque: uint8
  CAN4_ACT1_Special_functions: uint8
  CAN4_ACT1_Speed_status: uint8
  CAN4_ACT1_Stall_detection_release_status: uint8
  CAN4_ACT1_Stall_occurred: uint8
  CAN4_ACT1_Stop_mode_status: uint8
  CAN4_ACT1_Supply_voltage: uint8
  CAN4_ACT2_Actual_position_of_actuator: uint16
  CAN4_ACT2_Actuator_address_status: uint8
  CAN4_ACT2_Applied_holding_current_status: uint8
  CAN4_ACT2_Electrical_defect: uint8
  CAN4_ACT2_Emergency_run_occurred: uint8
  CAN4_ACT2_Emergency_run_position_status: uint8
  CAN4_ACT2_Emergency_run_release_status: uint8
  CAN4_ACT2_Movement_direction: uint8
  CAN4_ACT2_Over_temperature: uint8
  CAN4_ACT2_Position_specification_status: uint8
  CAN4_ACT2_Reset: uint8
  CAN4_ACT2_Response_Error: uint8
  CAN4_ACT2_Rotation_direction_status: uint8
  CAN4_ACT2_Self_holding_torque: uint8
  CAN4_ACT2_Special_functions: uint8
  CAN4_ACT2_Speed_status: uint8
  CAN4_ACT2_Stall_detection_release_status: uint8
  CAN4_ACT2_Stall_occurred: uint8
  CAN4_ACT2_Stop_mode_status: uint8
  CAN4_ACT2_Supply_voltage: uint8
  CAN4_ACT3_Actual_position_of_actuator: uint16
  CAN4_ACT3_Actuator_address_status: uint8
  CAN4_ACT3_Applied_holding_current_status: uint8
  CAN4_ACT3_Electrical_defect: uint8
  CAN4_ACT3_Emergency_run_occurred: uint8
  CAN4_ACT3_Emergency_run_position_status: uint8
  CAN4_ACT3_Emergency_run_release_status: uint8
  CAN4_ACT3_Movement_direction: uint8
  CAN4_ACT3_Over_temperature: uint8
  CAN4_ACT3_Position_specification_status: uint8
  CAN4_ACT3_Reset: uint8
  CAN4_ACT3_Response_Error: uint8
  CAN4_ACT3_Rotation_direction_status: uint8
  CAN4_ACT3_Self_holding_torque: uint8
  CAN4_ACT3_Special_functions: uint8
  CAN4_ACT3_Speed_status: uint8
  CAN4_ACT3_Stall_detection_release_status: uint8
  CAN4_ACT3_Stall_occurred: uint8
  CAN4_ACT3_Stop_mode_status: uint8
  CAN4_ACT3_Supply_voltage: uint8
  CAN4_ACT4_Actual_position_of_actuator: uint16
  CAN4_ACT4_Actuator_address_status: uint8
  CAN4_ACT4_Applied_holding_current_status: uint8
  CAN4_ACT4_Electrical_defect: uint8
  CAN4_ACT4_Emergency_run_occurred: uint8
  CAN4_ACT4_Emergency_run_position_status: uint8
  CAN4_ACT4_Emergency_run_release_status: uint8
  CAN4_ACT4_Movement_direction: uint8
  CAN4_ACT4_Over_temperature: uint8
  CAN4_ACT4_Position_specification_status: uint8
  CAN4_ACT4_Reset: uint8
  CAN4_ACT4_Response_Error: uint8
  CAN4_ACT4_Rotation_direction_status: uint8
  CAN4_ACT4_Self_holding_torque: uint8
  CAN4_ACT4_Special_functions: uint8
  CAN4_ACT4_Speed_status: uint8
  CAN4_ACT4_Stall_detection_release_status: uint8
  CAN4_ACT4_Stall_occurred: uint8
  CAN4_ACT4_Stop_mode_status: uint8
  CAN4_ACT4_Supply_voltage: uint8
  CAN4_ACT5_Actual_position_of_actuator: uint16
  CAN4_ACT5_Actuator_address_status: uint8
  CAN4_ACT5_Applied_holding_current_status: uint8
  CAN4_ACT5_Electrical_defect: uint8
  CAN4_ACT5_Emergency_run_occurred: uint8
  CAN4_ACT5_Emergency_run_position_status: uint8
  CAN4_ACT5_Emergency_run_release_status: uint8
  CAN4_ACT5_Movement_direction: uint8
  CAN4_ACT5_Over_temperature: uint8
  CAN4_ACT5_Position_specification_status: uint8
  CAN4_ACT5_Reset: uint8
  CAN4_ACT5_Response_Error: uint8
  CAN4_ACT5_Rotation_direction_status: uint8
  CAN4_ACT5_Self_holding_torque: uint8
  CAN4_ACT5_Special_functions: uint8
  CAN4_ACT5_Speed_status: uint8
  CAN4_ACT5_Stall_detection_release_status: uint8
  CAN4_ACT5_Stall_occurred: uint8
  CAN4_ACT5_Stop_mode_status: uint8
  CAN4_ACT5_Supply_voltage: uint8

DT_CAN4_SG_zGW_LINFr2 = Simulink.Bus(HeaderFile="Rte_Type.h")
  CAN4_BDC_1_Fault_Signal: uint8
  CAN4_BDC_1_MotorStatus: uint8
  CAN4_BDC_1_RespPos: uint8
  CAN4_BDC_1_Rsp_Comm_Err: uint8
  CAN4_BDC_1_TempWarn: uint8
  CAN4_BDC_1_voltageErr: uint8
  CAN4_CCV4_Fault_Signal: uint8
  CAN4_CCV4_MotorStatus: uint8
  CAN4_CCV4_RespPos: uint8
  CAN4_CCV4_Rsp_Comm_Err: uint8
  CAN4_CCV4_TempWarn: uint8
  CAN4_CCV4_voltageErr: uint8
  CAN4_EWP1_Block_Error: uint8
  CAN4_EWP1_Curr_Stat: uint8
  CAN4_EWP1_DryRun_Error: uint8
  CAN4_EWP1_OverCurr_Error: uint8
  CAN4_EWP1_OverTemp_Error: uint8
  CAN4_EWP1_RPM_ActlVal_Stat: uint8
  CAN4_EWP1_RPM_Target_Stat: uint8
  CAN4_EWP1_RsErr_EWP: uint8
  CAN4_EWP1_SupVolt_Error: uint8
  CAN4_EWP1_Temp_Stat: uint8
  CAN4_EWP1_Volt_Stat: uint8
  CAN4_EWP2_Block_Error: uint8
  CAN4_EWP2_Curr_Stat: uint8
  CAN4_EWP2_DryRun_Error: uint8
  CAN4_EWP2_OverCurr_Error: uint8
  CAN4_EWP2_OverTemp_Error: uint8
  CAN4_EWP2_RPM_ActlVal_Stat: uint8
  CAN4_EWP2_RPM_Target_Stat: uint8
  CAN4_EWP2_RsErr_EWP: uint8
  CAN4_EWP2_SupVolt_Error: uint8
  CAN4_EWP2_Temp_Stat: uint8
  CAN4_EWP2_Volt_Stat: uint8
  CAN4_EWP3_Block_Error: uint8
  CAN4_EWP3_Curr_Stat: uint8
  CAN4_EWP3_DryRun_Error: uint8
  CAN4_EWP3_OverCurr_Error: uint8
  CAN4_EWP3_OverTemp_Error: uint8
  CAN4_EWP3_RPM_ActlVal_Stat: uint8
  CAN4_EWP3_RPM_Target_Stat: uint8
  CAN4_EWP3_RsErr_EWP: uint8
  CAN4_EWP3_SupVolt_Error: uint8
  CAN4_EWP3_Temp_Stat: uint8
  CAN4_EWP3_Volt_Stat: uint8
  CAN4_EXV2_RsErr_EXV: uint8
  CAN4_EXV2_Rsp_CurInit_Stat: uint8
  CAN4_EXV2_Rsp_Fault_Stat: uint8
  CAN4_EXV2_Rsp_OvrTemp_Warn: uint8
  CAN4_EXV2_Rsp_Pos: uint16
  CAN4_EXV2_Rsp_Run_Stat: uint8
  CAN4_EXV2_Rsp_Volt_Stat: uint8
  CAN4_EXV_RsErr_EXV: uint8
  CAN4_EXV_Rsp_CurInit_Stat: uint8
  CAN4_EXV_Rsp_Fault_Stat: uint8
  CAN4_EXV_Rsp_OvrTemp_Warn: uint8
  CAN4_EXV_Rsp_Pos: uint16
  CAN4_EXV_Rsp_Run_Stat: uint8
  CAN4_EXV_Rsp_Volt_Stat: uint8

DT_CAN6_SG_FCM2 = Simulink.Bus(HeaderFile="Rte_Type.h")
  CAN6_ADB_FR_CMR_Sta: uint8
  CAN6_ADB_ILLAmbtSta: uint8
  CAN6_ADB_VehDst10Val: uint8
  CAN6_ADB_VehDst1Val: uint8
  CAN6_ADB_VehDst2Val: uint8
  CAN6_ADB_VehDst3Val: uint8
  CAN6_ADB_VehDst4Val: uint8
  CAN6_ADB_VehDst5Val: uint8
  CAN6_ADB_VehDst6Val: uint8
  CAN6_ADB_VehDst7Val: uint8
  CAN6_ADB_VehDst8Val: uint8
  CAN6_ADB_VehDst9Val: uint8
  CAN6_ADB_VehLtAngl10Val: uint16
  CAN6_ADB_VehLtAngl1Val: uint16
  CAN6_ADB_VehLtAngl2Val: uint16
  CAN6_ADB_VehLtAngl3Val: uint16
  CAN6_ADB_VehLtAngl4Val: uint16
  CAN6_ADB_VehLtAngl5Val: uint16
  CAN6_ADB_VehLtAngl6Val: uint16
  CAN6_ADB_VehLtAngl7Val: uint16
  CAN6_ADB_VehLtAngl8Val: uint16
  CAN6_ADB_VehLtAngl9Val: uint16
  CAN6_ADB_VehNumVal: uint8
  CAN6_ADB_VehRtAngl10Val: uint16
  CAN6_ADB_VehRtAngl1Val: uint16
  CAN6_ADB_VehRtAngl2Val: uint16
  CAN6_ADB_VehRtAngl3Val: uint16
  CAN6_ADB_VehRtAngl4Val: uint16
  CAN6_ADB_VehRtAngl5Val: uint16
  CAN6_ADB_VehRtAngl6Val: uint16
  CAN6_ADB_VehRtAngl7Val: uint16
  CAN6_ADB_VehRtAngl8Val: uint16
  CAN6_ADB_VehRtAngl9Val: uint16
  CAN6_FCM2_Checksum: uint8
  CAN6_FCM2_LifeCount: uint8

DT_CAN2_SG_HMI1 = Simulink.Bus(HeaderFile="Rte_Type.h")
  CAN2_HMI_ACAirIntM_Cmd: uint8
  CAN2_HMI_ACAirIntP_Cmd: uint8
  CAN2_HMI_ACAutoBtn_Cmd: uint8
  CAN2_HMI_ACBtn_Cmd: uint8
  CAN2_HMI_ACFrDefogBtn_Cmd: uint8
  CAN2_HMI_ACRecycleBtn_Cmd: uint8
  CAN2_HMI_ACWindDirM_Cmd: uint8
  CAN2_HMI_ACWindDirP_Cmd: uint8
  CAN2_HMI_AutoInterLight_Cmd: uint8
  CAN2_HMI_BCMPostDefogBtn_Cmd: uint8
  CAN2_HMI_DSEAT_LevelDown_Cmd: uint8
  CAN2_HMI_DSEAT_LevelUp_Cmd: uint8
  CAN2_HMI_Function1_LevelDown_Cmd: uint8
  CAN2_HMI_Function1_LevelUp_Cmd: uint8
  CAN2_HMI_Function2_LevelDown_Cmd: uint8
  CAN2_HMI_Function2_LevelUp_Cmd: uint8
  CAN2_HMI_Function3_LevelDown_Cmd: uint8
  CAN2_HMI_Function3_LevelUp_Cmd: uint8
  CAN2_HMI_Function4_LevelDown_Cmd: uint8
  CAN2_HMI_Function4_LevelUp_Cmd: uint8
  CAN2_HMI_Function5_LevelDown_Cmd: uint8
  CAN2_HMI_Function5_LevelUp_Cmd: uint8
  CAN2_HMI_Function6_LevelDown_Cmd: uint8
  CAN2_HMI_Function6_LevelUp_Cmd: uint8
  CAN2_HMI_PSEAT_LevelDown_Cmd: uint8
  CAN2_HMI_PSEAT_LevelUp_Cmd: uint8
  CAN2_HMI_Z1SetTM_Cmd: uint8
  CAN2_HMI_Z1SetTP_Cmd: uint8
  CAN2_HMI_Z2SetTM_Cmd: uint8
  CAN2_HMI_Z2SetTP_Cmd: uint8

DT_CAN2_SG_IVI2 = Simulink.Bus(HeaderFile="Rte_Type.h")
  CAN2_AC_Chg_Cur_Set: uint8
  CAN2_AEB_BUTT: uint8
  CAN2_AVM_Err_STA: uint8
  CAN2_AVM_OFF_Rec_Butt: uint8
  CAN2_AVM_Parking_mode: uint8
  CAN2_AVM_parking_cancel: uint8
  CAN2_AVM_parking_excute: uint8
  CAN2_Approach_Unlock_SW: uint8
  CAN2_BSDMute_BUTT: uint8
  CAN2_CAAS_Sw: uint8
  CAN2_CDL_Lock_Butt: uint8
  CAN2_CDL_Unlock_Butt: uint8
  CAN2_CameraWrn: uint8
  CAN2_DMS_Status: uint8
  CAN2_DMS_Warning_Distraction: uint8
  CAN2_DMS_Warning_Fatigue: uint8
  CAN2_DMS_Warning_Unresponsive: uint8
  CAN2_DSEAT_anti_set: uint8
  CAN2_DSEAT_entryfun_set: uint8
  CAN2_DSEAT_vent_req: uint8
  CAN2_Distance_unit: uint8
  CAN2_ESC_SW_Cmd: uint8
  CAN2_FCWMute_BUTT: uint8
  CAN2_FFogLampSW: uint8
  CAN2_FS_Off_Sw: uint8
  CAN2_FalseNPrevent_SW: uint8
  CAN2_FollowMeSW: uint8
  CAN2_GPS_LAT: uint32
  CAN2_GPS_LONG: uint32
  CAN2_HeadLampSW: uint8
  CAN2_Hood_Latch_SW: uint8
  CAN2_IVI_ACC_Adaptive_Sta: uint8
  CAN2_IVI_AGSCloseSW: uint8
  CAN2_IVI_ActvDmpDisabSW: uint8
  CAN2_IVI_AirIntZ3_Cmd: uint8
  CAN2_IVI_Backlight_Sta: uint8
  CAN2_IVI_CarWash_Mode_Cmd: uint8
  CAN2_IVI_CfmTo_Rdy: uint8
  CAN2_IVI_ChargePortSW_Sta: uint8
  CAN2_IVI_CoastDwSW: uint8
  CAN2_IVI_CreepSW_Req: uint8
  CAN2_IVI_DSEATHeater_Cmd: uint8
  CAN2_IVI_DSEAT_FroEdge_Height_Cmd: uint8
  CAN2_IVI_DSEAT_Height_Cmd: uint8
  CAN2_IVI_DSEAT_Memory1_Sta: uint8
  CAN2_IVI_DSEAT_Memory2_Sta: uint8
  CAN2_IVI_DSEAT_Memory_OPTCLS_Sta: uint8
  CAN2_IVI_DSEAT_Recline_Cmd: uint8
  CAN2_IVI_DSEAT_Slide_Cmd: uint8
  CAN2_IVI_FGSAirInt_Cmd: uint8
  CAN2_IVI_FGSCh_Cmd: uint8
  CAN2_IVI_FWipIntTSet_Cmd: uint8
  CAN2_IVI_GPS_Lat_Dir_Sta: uint8
  CAN2_IVI_GPS_Long_Dir_Sta: uint8
  CAN2_IVI_IC_Brightness_Sta: uint8
  CAN2_IVI_IONSW_Cmd: uint8
  CAN2_IVI_ISA_OffsetSpd: uint8
  CAN2_IVI_LVChrgFuncSW: uint8
  CAN2_IVI_Mute_Sta: uint8
  CAN2_IVI_Night_Mode_Sta: uint8
  CAN2_IVI_PSEATHeater_Cmd: uint8
  CAN2_IVI_PSEAT_Recline_Cmd: uint8
  CAN2_IVI_PSEAT_Slide_Cmd: uint8
  CAN2_IVI_PTG_Mode_SW: uint8
  CAN2_IVI_PTG_Open_Height: uint8
  CAN2_IVI_PTG_Sta_SW: uint8
  CAN2_IVI_PTG_USSta_SW: uint8
  CAN2_IVI_PW_Mode_Req: uint8
  CAN2_IVI_Panel_Act: uint8
  CAN2_IVI_Panel_X_Coor: uint16
  CAN2_IVI_Panel_Y_Coor: uint16
  CAN2_IVI_PwrLockSW: uint8
  CAN2_IVI_Pwroff_req: uint8
  CAN2_IVI_RR_Def_Req: uint8
  CAN2_IVI_Req_V2L: uint8
  CAN2_IVI_SLIF_Warning_Sta: uint8
  CAN2_IVI_SWC_ACCMode_Sta: uint8
  CAN2_IVI_SWC_LUndefined_Sta: uint8
  CAN2_IVI_SWC_RUndefined_Sta: uint8
  CAN2_IVI_Screen: uint8
  CAN2_IVI_SetTempZon1_Sta: uint8
  CAN2_IVI_SetTempZon2_Sta: uint8
  CAN2_IVI_Start_Chg_req: uint8
  CAN2_IVI_Status: uint8
  CAN2_IVI_Stop_Chg_req: uint8
  CAN2_IVI_TrailerCheckReq_Sta: uint8
  CAN2_IVI_TrailerModeSW_Sta: uint8
  CAN2_IVI_Trigger_req: uint8
  CAN2_IVI_Unlock_Chg_req: uint8
  CAN2_IVI_WI_MAIN_SW: uint8
  CAN2_LDWMute_BUTT: uint8
  CAN2_LKA_BUTT: uint8
  CAN2_LVDAMute_BUTT: uint8
  CAN2_L_Drv_ControlCommand: uint8
  CAN2_L_Pas_ControlCommand: uint8
  CAN2_L_RLD_ControlCommand: uint8
  CAN2_L_RRD_ControlCommand: uint8
  CAN2_Light_ShowStart_Req: uint8
  CAN2_Light_ShowStop_Req: uint8
  CAN2_METER_Malfunc_Sta: uint8
  CAN2_MFRD_N_Bright_Req: uint8
  CAN2_NAVI_Cam_Dist_info: uint8
  CAN2_NAVI_Direction_STA: uint8
  CAN2_NAVI_Distance_info: uint32
  CAN2_NAVI_ForwardLinkLevel: uint8
  CAN2_NAVI_LinkClass: uint8
  CAN2_NAVI_RoadClass: uint8
  CAN2_NAVI_SpeedLimit: uint8
  CAN2_NAVI_Speed_Limit_A: uint8
  CAN2_NAVI_State: uint8
  CAN2_NAVI_Tollgate: uint16
  CAN2_NAVI_Tunnel: uint16
  CAN2_ODAMute_BUTT: uint8
  CAN2_OFF_AC_MODE: uint8
  CAN2_PSEAT_vent_req: uint8
  CAN2_Perd_V2L: uint8
  CAN2_Pressure_unit: uint8
  CAN2_RCTA_BUTT: uint8
  CAN2_RFogLampSW: uint8
  CAN2_Roll_Eng_Mode: uint8
  CAN2_Roll_Mode_SW_Cmd: uint8
  CAN2_RoomLampMode: uint8
  CAN2_SLG_Sw: uint8
  CAN2_SLIF_BUTT: uint8
  CAN2_SOC_ADJ_BUTT: uint8
  CAN2_SOC_Limit_Set: uint8
  CAN2_SOC_V2LLimit: uint8
  CAN2_Sched_Chg_Start: uint8
  CAN2_Sched_Chg_Stop: uint8
  CAN2_Sched_Chg_butt: uint8
  CAN2_Sched_Chg_limit: uint8
  CAN2_Sched_Chg_wake: uint8
  CAN2_SenstivityPosition: uint8
  CAN2_SetUnlockSingle: uint8
  CAN2_TCS_SW_Cmd: uint8
  CAN2_TPMS_Cali_Butt: uint8
  CAN2_TPMS_Res_Butt: uint8
  CAN2_Temperature_unit: uint8
  CAN2_Time_system: uint8
  CAN2_TurnSwTimeSet: uint8
  CAN2_User_p_download: uint8
  CAN2_User_p_upload: uint8
  CAN2_Walkaway_Lock_SW: uint8
  CAN2_Wifi_Reset: uint8
  CAN2_Wifi_Sta_IVI_TBOX: uint8
  CAN2_WlcmLight_Mode: uint8
  CAN2_sigAirIntenZon1Req: uint8
  CAN2_sigAirIntenZon3Req: uint8
  CAN2_sigDfrstReq: uint8
  CAN2_sigFaceReq: uint8
  CAN2_sigFootReq: uint8
  CAN2_sigHvacFrontReq: uint8
  CAN2_sigHvacRearReq: uint8
  CAN2_sigHvacReq: uint8
  CAN2_sigRecircReq: uint8
  CAN2_sigSetTempZon1Req: uint8
  CAN2_sigSetTempZon2Req: uint8
  CAN2_sigSetTempZon3Req: uint8
  CAN2_sigWindDirZon3Req: uint8

DT_CAN4_SG_zGW_LINDr1 = Simulink.Bus(HeaderFile="Rte_Type.h")
  CAN4_CSW_DimSw: uint8
  CAN4_CSW_FWasSw_Sta: uint8
  CAN4_CSW_FWipSw_Sta: uint8
  CAN4_CSW_PassSW_Sta: uint8
  CAN4_CSW_RWasSW_Sta: uint8
  CAN4_CSW_RWipIntSw_Sta: uint8
  CAN4_CSW_TurnSw_Sta: uint8
  CAN4_CSW_resp_error: uint8
  CAN4_FAPWL_01_LIN_Response_Error: uint8
  CAN4_HVPO_OtltCvrStsRw_Sta: uint8
  CAN4_L_Drv_Motor_Relay_Error: uint8
  CAN4_L_Drv_Motor_Ripple_Error: uint8
  CAN4_L_Drv_OverHeat_Protect: uint8
  CAN4_L_Drv_Val_Wdw_Opened: uint8
  CAN4_L_Drv_Wdw_Init: uint8
  CAN4_L_Drv_Wdw_LocalSwitch: uint8
  CAN4_L_Drv_Wdw_OD_Sts: uint8
  CAN4_L_Drv_Wdw_Obs_InhibitSts: uint8
  CAN4_L_Drv_Wdw_Pas_Switch: uint8
  CAN4_L_Drv_Wdw_PositionSts: uint8
  CAN4_L_Drv_Wdw_RLD_Switch: uint8
  CAN4_L_Drv_Wdw_RRD_Switch: uint8
  CAN4_L_Drv_Wdw_Running_Sts: uint8
  CAN4_L_Pas_Motor_Relay_Error: uint8
  CAN4_L_Pas_Motor_Ripple_Error: uint8
  CAN4_L_Pas_OverHeat_Protect: uint8
  CAN4_L_Pas_Val_Wdw_Opened: uint8
  CAN4_L_Pas_Wdw_Init: uint8
  CAN4_L_Pas_Wdw_LocalSwitch: uint8
  CAN4_L_Pas_Wdw_OD_Sts: uint8
  CAN4_L_Pas_Wdw_Obs_InhibitSts: uint8
  CAN4_L_Pas_Wdw_PositionSts: uint8
  CAN4_L_Pas_Wdw_Running_Sts: uint8
  CAN4_L_Power_Status: uint8
  CAN4_L_RLD_Motor_Relay_Error: uint8
  CAN4_L_RLD_Motor_Ripple_Error: uint8
  CAN4_L_RLD_OverHeat_Protect: uint8
  CAN4_L_RLD_Val_Wdw_Opened: uint8
  CAN4_L_RLD_Wdw_Init: uint8
  CAN4_L_RLD_Wdw_LocalSwitch: uint8
  CAN4_L_RLD_Wdw_OD_Sts: uint8
  CAN4_L_RLD_Wdw_Obs_InhibitSts: uint8
  CAN4_L_RLD_Wdw_PositionSts: uint8
  CAN4_L_RLD_Wdw_Running_Sts: uint8
  CAN4_L_RRD_Motor_Relay_Error: uint8
  CAN4_L_RRD_Motor_Ripple_Error: uint8
  CAN4_L_RRD_OverHeat_Protect: uint8
  CAN4_L_RRD_Val_Wdw_Opened: uint8
  CAN4_L_RRD_Wdw_Init: uint8
  CAN4_L_RRD_Wdw_LocalSwitch: uint8
  CAN4_L_RRD_Wdw_OD_Sts: uint8
  CAN4_L_RRD_Wdw_Obs_InhibitSts: uint8
  CAN4_L_RRD_Wdw_PositionSts: uint8
  CAN4_L_RRD_Wdw_Running_Sts: uint8
  CAN4_RAPWL_01_LIN_Response_Error: uint8
  CAN4_RLS_LIN_Resp_Err: uint8
  CAN4_RLS_Lamp_Sta: uint8
  CAN4_RLS_LightSnrErr: uint8
  CAN4_RLS_RainSnrErr: uint8
  CAN4_RLS_RainSnrWiperCmd: uint8
  CAN4_SWC2_L_ADAS_Sta: uint8
  CAN4_SWC2_L_DriveMode_Sta: uint8
  CAN4_SWC2_L_Home_Sta: uint8
  CAN4_SWC2_L_Left_Sta: uint8
  CAN4_SWC2_L_RegenUp_Sta: uint8
  CAN4_SWC2_L_Right_Sta: uint8
  CAN4_SWC2_L_ScrollDown_Sta: uint8
  CAN4_SWC2_L_ScrollPress_Sta: uint8
  CAN4_SWC2_L_ScrollUp_Sta: uint8
  CAN4_SWC2_R_Customize_Sta: uint8
  CAN4_SWC2_R_Left_Sta: uint8
  CAN4_SWC2_R_PageSwitch_Sta: uint8
  CAN4_SWC2_R_RegenDown_Sta: uint8
  CAN4_SWC2_R_Right_Sta: uint8
  CAN4_SWC2_R_ScrollDown_Sta: uint8
  CAN4_SWC2_R_ScrollPress_Sta: uint8
  CAN4_SWC2_R_ScrollUp_Sta: uint8
  CAN4_SWC2_R_VR_Sta: uint8
  CAN4_SWC2_ResponseError: uint8
  CAN4_SWC_ACC_Sta: uint8
  CAN4_SWC_A_Resp_Err: uint8
  CAN4_SWC_CANCEL_Sta: uint8
  CAN4_SWC_Distance_Sta: uint8
  CAN4_SWC_Down_Sta: uint8
  CAN4_SWC_Drivemode_Sta: uint8
  CAN4_SWC_LKA_Sta: uint8
  CAN4_SWC_Left_Sta: uint8
  CAN4_SWC_RegenDown: uint8
  CAN4_SWC_RegenUp: uint8
  CAN4_SWC_Res_Up_Sta: uint8
  CAN4_SWC_Right_Sta: uint8
  CAN4_SWC_Set_down_Sta: uint8
  CAN4_SWC_Trip_Sta: uint8
  CAN4_SWC_Undefined_Sta: uint8
  CAN4_SWC_Up_Sta: uint8
  CAN4_SWC_VR_Sta: uint8
  CAN4_SWC_mode_Sta: uint8
  CAN4_SWC_resp_error: uint8

DT_CAN1_SG_GW1_CE200_0 = Simulink.Bus(HeaderFile="Rte_Type.h")
  CAN1_ESC_SW_Cmd: uint8
  CAN1_Roll_Eng_Mode: uint8
  CAN1_Roll_Mode_SW_Cmd: uint8
  CAN1_TCS_SW_Cmd: uint8

DT_CAN2_SG_GW2_CE1000_0 = Simulink.Bus(HeaderFile="Rte_Type.h")
  CAN2_ACChrgCurrDis: uint16
  CAN2_Charge_Percent_Set: uint8
  CAN2_DSEAT_HW_Ver: uint16
  CAN2_DSEAT_SW_Ver: uint16
  CAN2_Fr_MCU_HW_Ver: uint16
  CAN2_Fr_MCU_HW_Ver_Nidec: uint16
  CAN2_Fr_MCU_SW_Ver: uint16
  CAN2_Fr_MCU_SW_Ver_Nidec: uint16
  CAN2_HVBChrgPwr: uint16
  CAN2_HVBChrgPwrTotal: uint32
  CAN2_HVBDrvPwr: uint16
  CAN2_HVBDrvPwrTotal: uint32
  CAN2_HVBattSOC: uint8
  CAN2_HVBattSOCDis: uint8
  CAN2_PSEAT_HW_Ver: uint16
  CAN2_PSEAT_SW_Ver: uint16
  CAN2_PTG_HW_Ver: uint8
  CAN2_PTG_SW_Ver: uint8
  CAN2_RemainChrgTime: uint16
  CAN2_Rr_MCU3_HW_Ver: uint16
  CAN2_Rr_MCU3_HW_Ver_Nidec: uint16
  CAN2_Rr_MCU3_SW_Ver: uint16
  CAN2_Rr_MCU3_SW_Ver_Nidec: uint16
  CAN2_TBOX_HW_VER: uint32
  CAN2_TBOX_SW_VER: uint32

DT_CAN2_SG_FD2_CE200_1 = Simulink.Bus(HeaderFile="Rte_Type.h")
  CAN2_AutoLTips: uint8
  CAN2_CWheelTips: uint8
  CAN2_FDC_BCM_Acc1Sta_Sta: uint8
  CAN2_FDC_BCM_Acc2Sta_Sta: uint8
  CAN2_FDC_BCM_Acc3Sta_Sta: uint8
  CAN2_FDC_BCM_Acc4Sta_Sta: uint8
  CAN2_FDC_BCM_Acc5Sta_Sta: uint8
  CAN2_FDC_BCM_AmbBrightSta_Sta: uint8
  CAN2_FDC_BCM_AmbColorSta_Sta: uint8
  CAN2_FDC_BCM_AmbDimEN_Sta: uint8
  CAN2_FDC_BCM_AmbFunEN_Sta: uint8
  CAN2_FDC_BCM_AmbLinkDriSta_Sta: uint8
  CAN2_FDC_BCM_AmbODAEN_Sta: uint8
  CAN2_FDC_BCM_AmbPwrWarnEN_Sta: uint8
  CAN2_FDC_BCM_AmbWelEN_Sta: uint8
  CAN2_FDC_BCM_AutoLock_Sta: uint8
  CAN2_FDC_BCM_AutoUnlock_Sta: uint8
  CAN2_FDC_BCM_CLWinLockDr_Sta: uint8
  CAN2_FDC_BCM_DSEATentryfset_Sta: uint8
  CAN2_FDC_BCM_FollowMeENFun_Sta: uint8
  CAN2_FDC_BCM_Key10Acc_Sta: uint8
  CAN2_FDC_BCM_Key1Acc_Sta: uint8
  CAN2_FDC_BCM_Key2Acc_Sta: uint8
  CAN2_FDC_BCM_Key3Acc_Sta: uint8
  CAN2_FDC_BCM_Key4Acc_Sta: uint8
  CAN2_FDC_BCM_Key5Acc_Sta: uint8
  CAN2_FDC_BCM_Key6Acc_Sta: uint8
  CAN2_FDC_BCM_Key7Acc_Sta: uint8
  CAN2_FDC_BCM_Key8Acc_Sta: uint8
  CAN2_FDC_BCM_Key9Acc_Sta: uint8
  CAN2_FDC_BCM_LockAlarm_Cmd: uint8
  CAN2_FDC_BCM_PTGOpenHeight_Sta: uint8
  CAN2_FDC_BCM_RmLpModeENFun_Sta: uint8
  CAN2_FDC_BCM_TurnSwTSetSta_Sta: uint8
  CAN2_FDC_BCM_UserNow_Sta: uint8
  CAN2_FDC_BCM_WalkInUnLkEnFun_Sta: uint8
  CAN2_FDC_BCM_WalkOutLkEnFun_Sta: uint8
  CAN2_FDC_DKC_DkeyShowIVI_Sta: uint8
  CAN2_FDC_DKC_KeyMiss_Sta: uint8
  CAN2_FDC_DKC_KeyNum_Sta: uint8
  CAN2_FDC_DKC_KeyType_Sta: uint8
  CAN2_FDC_DKC_UIDLowPower_Sta: uint8
  CAN2_FDC_FGS_AirInt_Sta: uint8
  CAN2_FDC_FGS_FGSCh_Sta: uint8
  CAN2_FDC_FGS_IONSW_Sta: uint8
  CAN2_FDC_SPTG_SPTGENFun_Sta: uint8
  CAN2_FDC_THCM_APTCForceOFF_Sta: uint8
  CAN2_FDC_THCM_APTCWarning_Sta: uint8
  CAN2_FDC_THCM_AirIntZ3_Sta: uint8
  CAN2_LFBatWarn: uint8
  CAN2_LFPressIndi: uint8
  CAN2_LFSensorFail: uint8
  CAN2_LFWheelDebug: uint8
  CAN2_LFWheelPSW: uint8
  CAN2_LFWheelPress: uint8
  CAN2_LFWheelShield: uint8
  CAN2_LFWheelTemp: uint8
  CAN2_LFWheelTmpIndi: uint8
  CAN2_LRBatWarn: uint8
  CAN2_LRPressIndi: uint8
  CAN2_LRSensorFail: uint8
  CAN2_LRWheelDebug: uint8
  CAN2_LRWheelPSW: uint8
  CAN2_LRWheelPress: uint8
  CAN2_LRWheelShield: uint8
  CAN2_LRWheelTemp: uint8
  CAN2_LRWheelTmpIndi: uint8
  CAN2_RFBatWarn: uint8
  CAN2_RFPressIndi: uint8
  CAN2_RFSensorFail: uint8
  CAN2_RFWheelDebug: uint8
  CAN2_RFWheelPSW: uint8
  CAN2_RFWheelPress: uint8
  CAN2_RFWheelShield: uint8
  CAN2_RFWheelTemp: uint8
  CAN2_RFWheelTmpIndi: uint8
  CAN2_RRBatWarn: uint8
  CAN2_RRPressIndi: uint8
  CAN2_RRSensorFail: uint8
  CAN2_RRWheelDebug: uint8
  CAN2_RRWheelPSW: uint8
  CAN2_RRWheelPress: uint8
  CAN2_RRWheelShield: uint8
  CAN2_RRWheelTemp: uint8
  CAN2_RRWheelTmpIndi: uint8
  CAN2_TPMSWarnIndi: uint8
  CAN2_TPMS_Cali_Butt_Allow: uint8
  CAN2_TPMS_Res_Butt_Allow: uint8

DT_CAN3_SG_BMS4 = Simulink.Bus(HeaderFile="Rte_Type.h")
  CAN3_CellTempAvg: uint8
  CAN3_HVBCellVoltMax: uint16
  CAN3_HVBCellVoltMin: uint16
  CAN3_HVBMTempMax: uint8
  CAN3_HVBMTempMin: uint8
  CAN3_MaxCellTemp_Num: uint8
  CAN3_MaxCellVolt_Num: uint8
  CAN3_MinCellTemp_Num: uint8
  CAN3_MinCellVolt_Num: uint8
  CAN3_Mtemp01: uint8
  CAN3_Mtemp02: uint8
  CAN3_Mtemp03: uint8
  CAN3_Mtemp04: uint8
  CAN3_Mtemp05: uint8
  CAN3_Mtemp06: uint8
  CAN3_Mtemp07: uint8
  CAN3_Mtemp08: uint8
  CAN3_Mtemp09: uint8
  CAN3_Mtemp10: uint8
  CAN3_Mtemp11: uint8
  CAN3_Mtemp12: uint8
  CAN3_Mtemp13: uint8
  CAN3_Mtemp14: uint8
  CAN3_Mtemp15: uint8
  CAN3_Mtemp16: uint8
  CAN3_Mtemp17: uint8
  CAN3_Mtemp18: uint8
  CAN3_Mtemp19: uint8
  CAN3_Mtemp20: uint8
  CAN3_Mtemp21: uint8
  CAN3_Mtemp22: uint8
  CAN3_Mtemp23: uint8
  CAN3_Mtemp24: uint8

DT_CAN3_SG_BMS8 = Simulink.Bus(HeaderFile="Rte_Type.h")
  CAN3_ACChrgStop: uint8
  CAN3_BMS_HVBChrgCap_Sta: uint32
  CAN3_BMS_HVBDchrgCap_Sta: uint32
  CAN3_CurrentErrorID: uint16
  CAN3_DCChrgCurrent: uint32
  CAN3_DCChrgStop: uint8
  CAN3_DCChrgVoltage: uint16
  CAN3_G0standard: uint16
  CAN3_MainChrgRlyNegDriReq: uint8
  CAN3_MainChrgRlyNegOutterVoltage: uint16
  CAN3_MainChrgRlyNegSta: uint8
  CAN3_MainChrgRlyPosDriReq: uint8
  CAN3_MainChrgRlyPosOutterVoltage: uint16
  CAN3_MainChrgRlyPosSta: uint8
  CAN3_MainPosstandard: uint16
  CAN3_MainRlyNegDriReq: uint8
  CAN3_MainRlyNegOutterVoltage: uint16
  CAN3_MainRlyNegSta: uint8
  CAN3_MainRlyPosDriReq: uint8
  CAN3_MainRlyPosInnerVoltage: uint16
  CAN3_MainRlyPosOutterVoltage: uint16
  CAN3_MainRlyPosSta: uint8
  CAN3_TherRunawayErrMask: uint32

DT_CAN4_SG_BodyZone_PS2 = Simulink.Bus(HeaderFile="Rte_Type.h")
  CAN4_BP_APM_WinFOpened_Sta: uint8
  CAN4_BP_APM_WinROpened_Sta: uint8
  CAN4_BP_Door_FHandleClose_Sta: uint8
  CAN4_BP_Door_FHandleHalf_Sta: uint8
  CAN4_BP_Door_RHandleClose_Sta: uint8
  CAN4_BP_Door_RHandleHalf_Sta: uint8
  CAN4_BP_SEAT_LVent_Sta: uint8
  CAN4_BP_SEAT_MLVent_Sta: uint8
  CAN4_BP_SEAT_MRVent_Sta: uint8
  CAN4_BP_SEAT_RVent_Sta: uint8
  CAN4_BP_SYS_LampPwrSTS_Sta: uint8

DT_CAN4_SG_ZONE_DR_VCU = Simulink.Bus(HeaderFile="Rte_Type.h")
  CAN4_APTC_Err: uint8
  CAN4_Blower_Err: uint8
  CAN4_Blower_FB: uint8
  CAN4_DrAPWLINErr: uint8
  CAN4_DrAPWStaErr: uint8
  CAN4_DrColumnSWFault: uint8
  CAN4_DrEOBDFault: uint8
  CAN4_DrIVIFault: uint8
  CAN4_DrInfoErrSta: uint8
  CAN4_DrInfoFault: uint8
  CAN4_DrONA1ErrSta: uint8
  CAN4_DrPMMLVOutPErrLmp: uint8
  CAN4_DrPMMLimpHomeActReq: uint8
  CAN4_DrPMMSysErrLmp: uint8
  CAN4_DrPwrInformationSta: uint8
  CAN4_DrPwrSta: uint8
  CAN4_DrPwrWinErrSta: uint8
  CAN4_DrPwrWindowECUFault: uint8
  CAN4_DrSCPSysErrLmp: uint8
  CAN4_DrStdAErrSta: uint8
  CAN4_DrTHCMFault: uint8
  CAN4_LeftHall_Pos: uint16
  CAN4_RegenSW_Err: uint8
  CAN4_SolarL: uint8
  CAN4_SolarL_Err: uint8
  CAN4_SolarR: uint8
  CAN4_SolarR_Err: uint8
  CAN4_T_Face_L: uint8
  CAN4_T_Face_L_Err: uint8
  CAN4_T_Face_R: uint8
  CAN4_T_Face_R_Err: uint8
  CAN4_T_Face_Rr: uint8
  CAN4_T_Face_Rr_Err: uint8
  CAN4_T_Foot_L: uint8
  CAN4_T_Foot_L_Err: uint8
  CAN4_T_Foot_R: uint8
  CAN4_T_Foot_R_Err: uint8
  CAN4_T_Foot_Rr: uint8
  CAN4_T_Foot_Rr_Err: uint8
  CAN4_Tevap: uint8
  CAN4_Tevap_Err: uint8
  CAN4_Tincar: uint8
  CAN4_Tincar_Err: uint8
  CAN4_ZDR_SYS_APMRetryCnt_Sta: uint8
  CAN4_ZDR_SYS_BSWSleepReq_Sta: uint8
  CAN4_ZDR_SYS_CSWRetryCnt_Sta: uint8
  CAN4_ZDR_SYS_HWMismatchFW_Sta: uint8
  CAN4_ZDR_VCU_AlcoDet_Sta: uint8
  CAN4_ZDR_VCU_HWReset_Sta: uint8
  CAN4_ZDR_VCU_PwrSupply_Sta: uint8
  CAN4_ZoneDrMalfunLevel: uint8

DT_CAN4_SG_ZONE_FR1 = Simulink.Bus(HeaderFile="Rte_Type.h")
  CAN4_AGS_Calibration_Enabled: uint8
  CAN4_AGS_Position_Request: uint8
  CAN4_BDC_1_MoveEnable: uint8
  CAN4_BDC_1_ReqMovePos: uint8
  CAN4_BMSChksmHSC6: uint8
  CAN4_BMSEnbPTCHSC6: uint8
  CAN4_BMSInptClntTemHSC6: uint16
  CAN4_BMSPackVol_h6HSC6: uint16
  CAN4_BMSReqMdHSC6: uint8
  CAN4_BMSReqPWMHSC6: uint8
  CAN4_BMSReqPwrHSC6: uint16
  CAN4_BMSReqRlngCtrHSC6: uint8
  CAN4_BMSReqTapPosHSC6: uint8
  CAN4_CCM_SpdCmd: uint16
  CAN4_CCV4_MoveEnable: uint8
  CAN4_CCV4_ReqMovePos: uint8
  CAN4_ChargeInletLockSta: uint8
  CAN4_CompProEN: uint8
  CAN4_EWP1_Default_Operation_EWP_Rq: uint8
  CAN4_EWP1_RPM_Target_EWP_Rq: uint8
  CAN4_EWP2_Default_Operation_EWP_Rq: uint8
  CAN4_EWP2_RPM_Target_EWP_Rq: uint8
  CAN4_EWP3_Default_Operation_EWP_Rq: uint8
  CAN4_EWP3_RPM_Target_EWP_Rq: uint8
  CAN4_EXV2_Cmd_Init_Rq: uint8
  CAN4_EXV2_Cmd_Move_Enbl: uint8
  CAN4_EXV2_Cmd_Set_Rq: uint16
  CAN4_EXV_Cmd_Init_Rq: uint8
  CAN4_EXV_Cmd_Move_Enbl: uint8
  CAN4_EXV_Cmd_Set_Rq: uint16
  CAN4_FLPosLPErr: uint8
  CAN4_FLTurnLPErr: uint8
  CAN4_FLTurnLampC: uint8
  CAN4_FLTurn_Light_Warning: uint8
  CAN4_FRPosLPErr: uint8
  CAN4_FRTurnLPErr: uint8
  CAN4_FRTurnLampC: uint8
  CAN4_FRTurn_Light_Warning: uint8
  CAN4_FWiperAS: uint8
  CAN4_FWiperProtection: uint8
  CAN4_LADBErr: uint8
  CAN4_LADB_Hibeam_Indication: uint8
  CAN4_LADB_Operation_Status: uint8
  CAN4_LADB_Warning: uint8
  CAN4_LAHB_Warning: uint8
  CAN4_LDRLErr: uint8
  CAN4_LDRL_Warning: uint8
  CAN4_LH_BeamErr: uint8
  CAN4_LLB_Warning: uint8
  CAN4_LL_BeamErr: uint8
  CAN4_Lposition_Lamp_Warning: uint8
  CAN4_RADBErr: uint8
  CAN4_RADB_Hibeam_Indication: uint8
  CAN4_RADB_Operation_Status: uint8
  CAN4_RADB_Warning: uint8
  CAN4_RAHB_Warning: uint8
  CAN4_RDRLErr: uint8
  CAN4_RDRL_Warning: uint8
  CAN4_RH_BeamErr: uint8
  CAN4_RLB_Warning: uint8
  CAN4_RL_BeamErr: uint8
  CAN4_Rposition_Lamp_Warning: uint8
  CAN4_TrailerCheck: uint8
  CAN4_TrailerModeSta: uint8
  CAN4_ZFR_BCM_ChargerDoorSW_Sta: uint8
  CAN4_ZFR_BCM_HRLTurnLPNormal_Sta: uint8
  CAN4_ZFR_BCM_HRRTurnLPHNormal_Sta: uint8
  CAN4_ZFR_EChrg_Active_Sta: uint8
  CAN4_ZFR_EChrg_OperationDeny_Cmd: uint8
  CAN4_ZFR_EChrg_Sys_Sta: uint8
  CAN4_ZFR_EChrg_WashMode_Sta: uint8
  CAN4_ZFR_SYS_HWMismatchFW_Sta: uint8
  CAN4_ZFR_THCM_CLEVentActY_Sta: uint8
  CAN4_ZFR_THCM_CLEVentActZ_Sta: uint8
  CAN4_ZFR_THCM_CREVentActY_Sta: uint8
  CAN4_ZFR_THCM_CREVentActZ_Sta: uint8
  CAN4_ZFR_THCM_DrEVentActY_Sta: uint8
  CAN4_ZFR_THCM_DrEVentActZ_Sta: uint8
  CAN4_ZFR_THCM_EACV1Stallpos_Sta: uint16
  CAN4_ZFR_THCM_EACV2Stallpos_Sta: uint16
  CAN4_ZFR_THCM_EACV3Stallpos_Sta: uint16
  CAN4_ZFR_THCM_EACV4Stallpos_Sta: uint16
  CAN4_ZFR_THCM_EACV5Stallpos_Sta: uint16
  CAN4_ZFR_THCM_EACV6Stallpos_Sta: uint16
  CAN4_ZFR_THCM_EACV7Stallpos_Sta: uint16
  CAN4_ZFR_THCM_EACV8Stallpos_Sta: uint16
  CAN4_ZFR_THCM_PsEVentActY_Sta: uint8
  CAN4_ZFR_THCM_PsEVentActZ_Sta: uint8

DT_CAN4_SG_ZONE_FR_VCU = Simulink.Bus(HeaderFile="Rte_Type.h")
  CAN4_AGS_Err: uint8
  CAN4_Bat_In_Temp: uint8
  CAN4_Bat_In_Temp_Err: uint8
  CAN4_Bat_Out_Temp: uint8
  CAN4_Bat_Out_Temp_Err: uint8
  CAN4_COMP_Err: uint8
  CAN4_EACProtectEnable: uint8
  CAN4_EWP1_Err: uint8
  CAN4_EWP2_Err: uint8
  CAN4_EWP3_Err: uint8
  CAN4_EXV1_Err: uint8
  CAN4_EXV2_Err: uint8
  CAN4_FWV_Err: uint8
  CAN4_Fan_Err: uint8
  CAN4_FrBMSCCUCErr: uint8
  CAN4_FrBMS_CCU_CIRFault: uint8
  CAN4_FrEDUErr: uint8
  CAN4_FrEDU_INVERTERFault: uint8
  CAN4_FrPMMLVOutPErrLmp: uint8
  CAN4_FrPMMLimpHomeActReq: uint8
  CAN4_FrPMMSysErrLmp: uint8
  CAN4_FrPwrONA1Fault: uint8
  CAN4_FrPwrSta: uint8
  CAN4_FrPwrStdbyA1Fault: uint8
  CAN4_FrPwrStdbyA1PlusFault: uint8
  CAN4_FrPwrStdbyA2PlusFault: uint8
  CAN4_FrStdA1PCErr: uint8
  CAN4_FrStdA2PCErr: uint8
  CAN4_FrStdA2PErr: uint8
  CAN4_Motor_In_Temp: uint8
  CAN4_Motor_In_Temp_Err: uint8
  CAN4_Motor_Out_Temp: uint8
  CAN4_Motor_Out_Temp_Err: uint8
  CAN4_PT_High_P: uint16
  CAN4_PT_High_P_Err: uint8
  CAN4_PT_High_T: uint8
  CAN4_PT_High_Tact: uint8
  CAN4_PT_High_Tact_Err: uint8
  CAN4_PT_Low_P1: uint16
  CAN4_PT_Low_P1_Err: uint8
  CAN4_PT_Low_P2: uint16
  CAN4_PT_Low_P2_Err: uint8
  CAN4_PT_Low_T1: uint8
  CAN4_PT_Low_T1_Err: uint8
  CAN4_PT_Low_T2: uint8
  CAN4_PT_Low_T2_Err: uint8
  CAN4_SOTXV_Err: uint8
  CAN4_SOV1_Err: uint8
  CAN4_SOV2_Err: uint8
  CAN4_SOV3_Err: uint8
  CAN4_TWV_Err: uint8
  CAN4_Tamb: uint8
  CAN4_Tamb_Err: uint8
  CAN4_WPTC_Err: uint8
  CAN4_ZFR_SYS_BMSCCURetryCnt_Sta: uint8
  CAN4_ZFR_SYS_BSWSleepReq_Sta: uint8
  CAN4_ZFR_SYS_MCURetryCnt_Sta: uint8
  CAN4_ZFR_VCU_HWReset_Sta: uint8
  CAN4_ZFR_VCU_PwrSupply_Sta: uint8
  CAN4_ZoneFrMalfunLevel: uint8

DT_CAN2_SG_GW2_CE100_1 = Simulink.Bus(HeaderFile="Rte_Type.h")
  CAN2_BD_DSEAT_Anti_Sta: uint8
  CAN2_BD_DSEAT_EntryFun_Sta: uint8
  CAN2_BD_DSEAT_Error_Sta: uint8
  CAN2_BD_DSEAT_MemSet_Sta: uint8
  CAN2_BD_DSEAT_Mode_Sta: uint8
  CAN2_BD_DSEAT_StopKeepMove_Sta: uint8
  CAN2_BD_DSEAT_Vent_Sta: uint8
  CAN2_BD_DSEAT_heater_Sta: uint8
  CAN2_BP_PSEAT_Error_Sta: uint8
  CAN2_BP_PSEAT_Mode_Sta: uint8
  CAN2_BP_PSEAT_Vent_Sta: uint8
  CAN2_BP_PSEAT_heater_Sta: uint8
  CAN2_BP_PTG_Active_Sta: uint8
  CAN2_BP_PTG_Exist_Sta: uint8
  CAN2_BP_PTG_IsSetHeight_Sta: uint8
  CAN2_BP_PTG_Sys_Sta: uint8
  CAN2_BP_SEAT_LVent_Sta: uint8
  CAN2_BP_SEAT_MLVent_Sta: uint8
  CAN2_BP_SEAT_MRVent_Sta: uint8
  CAN2_BP_SEAT_RVent_Sta: uint8
  CAN2_FDC_BCM_WinLFOpened_Sta: uint8
  CAN2_FDC_BCM_WinLROpened_Sta: uint8
  CAN2_FDC_BCM_WinRFOpened_Sta: uint8
  CAN2_FDC_BCM_WinRROpened_Sta: uint8
  CAN2_Fr_EDUDrtSta: uint8
  CAN2_Fr_EDURealTMTq: uint16
  CAN2_Fr_MCUTemp: uint16
  CAN2_Fr_MCUTempWarn: uint8
  CAN2_Fr_MotorAvailTq: uint16
  CAN2_Fr_TMSpd: uint16
  CAN2_Fr_TMTemp: uint16
  CAN2_Fr_TMTempWarn: uint8
  CAN2_MCU_B_F_LLCTempWarn_Sta: uint8
  CAN2_MCU_B_R_LLCTempWarn_Sta: uint8
  CAN2_Rr_EDUDrtSta: uint8
  CAN2_Rr_EDURealTMTq: uint16
  CAN2_Rr_MCUTemp: uint16
  CAN2_Rr_MCUTempWarn: uint8
  CAN2_Rr_MotorAvailTq: uint16
  CAN2_Rr_TMSpd: uint16
  CAN2_Rr_TMTemp: uint16
  CAN2_Rr_TMTempWarn: uint8
  CAN2_SWC2_L_DriveMode_Sta: uint8
  CAN2_SWC2_L_Home_Sta: uint8
  CAN2_SWC2_R_Customize_Sta: uint8
  CAN2_SWC2_R_Left_Sta: uint8
  CAN2_SWC2_R_PageSwitch_Sta: uint8
  CAN2_SWC2_R_Right_Sta: uint8
  CAN2_SWC2_R_ScrollDown_Sta: uint8
  CAN2_SWC2_R_ScrollPress_Sta: uint8
  CAN2_SWC2_R_ScrollUp_Sta: uint8
  CAN2_SWC2_R_VR_Sta: uint8

DT_CAN5_SG_GW5_CE100_0 = Simulink.Bus(HeaderFile="Rte_Type.h")
  CAN5_BP_PTG_Active_Sta: uint8
  CAN5_BP_PTG_Exist_Sta: uint8
  CAN5_BP_PTG_Sys_Sta: uint8
  CAN5_BrkSw_Sta: uint8
  CAN5_CrashOutputSts: uint8
  CAN5_FDC_BCM_WinLFOpened_Sta: uint8
  CAN5_FDC_BCM_WinLROpened_Sta: uint8
  CAN5_FDC_BCM_WinRFOpened_Sta: uint8
  CAN5_FDC_BCM_WinRROpened_Sta: uint8
  CAN5_L_Drv_Val_Wdw_Opened: uint8
  CAN5_L_Drv_Wdw_PositionSts: uint8
  CAN5_L_Pas_Val_Wdw_Opened: uint8
  CAN5_L_Pas_Wdw_PositionSts: uint8
  CAN5_L_RLD_Val_Wdw_Opened: uint8
  CAN5_L_RLD_Wdw_PositionSts: uint8
  CAN5_L_RRD_Val_Wdw_Opened: uint8
  CAN5_L_RRD_Wdw_PositionSts: uint8
  CAN5_PTG_Active_Sta: uint8
  CAN5_PTG_Exist: uint8
  CAN5_PTG_Sys_Sta: uint8
  CAN5_VehSpeed: uint16

DT_CAN4_SG_FD4_CE200_0 = Simulink.Bus(HeaderFile="Rte_Type.h")
  CAN4_AmbLightBreath1: uint8
  CAN4_AmbLightBreath2: uint8
  CAN4_AmbLightBreath3: uint8
  CAN4_AmbLightBreath4: uint8
  CAN4_AmbLightBreath5: uint8
  CAN4_AmbLightBreath6: uint8
  CAN4_AmbLightBrightness1: uint8
  CAN4_AmbLightBrightness2: uint8
  CAN4_AmbLightBrightness3: uint8
  CAN4_AmbLightBrightness4: uint8
  CAN4_AmbLightBrightness5: uint8
  CAN4_AmbLightBrightness6: uint8
  CAN4_AmbLightColor1: uint8
  CAN4_AmbLightColor2: uint8
  CAN4_AmbLightColor3: uint8
  CAN4_AmbLightColor4: uint8
  CAN4_AmbLightColor5: uint8
  CAN4_AmbLightColor6: uint8
  CAN4_BCM_Buzzer_Req: uint8
  CAN4_FDC_BCM_ATCtrl_Cmd: uint8
  CAN4_FDC_BCM_DSEATentryfset_Sta: uint8
  CAN4_FDC_BCM_DimSw: uint8
  CAN4_FDC_BCM_DrHandleLamp_Cmd: uint8
  CAN4_FDC_BCM_DrRWdwReqAP_Sta: uint8
  CAN4_FDC_BCM_DrvWdwReqAP_Sta: uint8
  CAN4_FDC_BCM_FWasSw_Sta: uint8
  CAN4_FDC_BCM_FWipSw_Sta: uint8
  CAN4_FDC_BCM_HandleControl_Cmd: uint8
  CAN4_FDC_BCM_HazardIND_Cmd: uint8
  CAN4_FDC_BCM_HoodRel_Cmd: uint8
  CAN4_FDC_BCM_LockAlarm_Cmd: uint8
  CAN4_FDC_BCM_OtHandleLamp_Cmd: uint8
  CAN4_FDC_BCM_OutMode_Cmd: uint8
  CAN4_FDC_BCM_PTGOpenHeight_Sta: uint8
  CAN4_FDC_BCM_PasWdwReqAP_Sta: uint8
  CAN4_FDC_BCM_PassSW_Sta: uint8
  CAN4_FDC_BCM_PsRWdwReqAP_Sta: uint8
  CAN4_FDC_BCM_SettingUpdateReq_Cmd: uint8
  CAN4_FDC_BCM_TurnSwTSetSta_Sta: uint8
  CAN4_FDC_BCM_TurnSw_Sta: uint8
  CAN4_FDC_BCM_UserHeightSet_Sta: uint16
  CAN4_FDC_BCM_UserNow_Sta: uint8
  CAN4_FDC_DKC_CommandToBCM_Cmd: uint8
  CAN4_FDC_DKC_DKeyAreaPE_Sta: uint8
  CAN4_FDC_DKC_SPTGDet_Cmd: uint8
  CAN4_FDC_DKC_SPTGOpen_Cmd: uint8
  CAN4_FDC_FGS_AirInt_Cmd: uint8
  CAN4_FDC_FGS_FGSCh_Cmd: uint8
  CAN4_FDC_FGS_FuncSta_Cmd: uint8
  CAN4_FDC_FGS_ION_Cmd: uint8
  CAN4_FDC_THCM_ACTInitial_Cmd: uint8
  CAN4_FDC_THCM_AirIntZ3_Sta: uint8
  CAN4_FDC_V2L_HVPOBklgting_Cmd: uint8
  CAN4_FDC_V2L_HVPOLEDSts_Cmd: uint8
  CAN4_WelcomeLight: uint8

DT_CAN4_SG_GW4_CE100_0 = Simulink.Bus(HeaderFile="Rte_Type.h")
  CAN4_FDC_BCM_DrRWdwCtrl_Cmd: uint8
  CAN4_FDC_BCM_DrvWdwCtrl_Cmd: uint8
  CAN4_FDC_BCM_PasWdwCtrl_Cmd: uint8
  CAN4_FDC_BCM_PsRWdwCtrl_Cmd: uint8
  CAN4_FDC_BCM_SenstivityPosn_Cmd: uint8
  CAN4_FDC_PTG_inner_SW_2: uint8

DT_CAN5_SG_FD5_Debug2 = Simulink.Bus(HeaderFile="Rte_Type.h")
  CAN5_FDC_DKC_A0_UWB_Event_Sta: uint8
  CAN5_FDC_DKC_AllowSleep_Sta: uint8
  CAN5_FDC_DKC_BLERSSI_Sta: uint8
  CAN5_FDC_DKC_BLEdcEvent_Sta: uint8
  CAN5_FDC_DKC_CalDistance_Sta: uint8
  CAN5_FDC_DKC_CommandToBCM_Cmd: uint8
  CAN5_FDC_DKC_CoordinateX_Sta: uint8
  CAN5_FDC_DKC_CoordinateY_Sta: uint8
  CAN5_FDC_DKC_DKeyAreaPE_Sta: uint8
  CAN5_FDC_DKC_DKeyAreaPS_Sta: uint8
  CAN5_FDC_DKC_DKeyAreaPTG_Sta: uint8
  CAN5_FDC_DKC_DKeyAreaSPTG_Sta: uint8
  CAN5_FDC_DKC_DKeyWelcome_Sta: uint8
  CAN5_FDC_DKC_DkeyAreaRAPS_Sta: uint8
  CAN5_FDC_DKC_DkeyShowIVI_Sta: uint8
  CAN5_FDC_DKC_KeyMiss_Sta: uint8
  CAN5_FDC_DKC_KeyMode_Sta: uint8
  CAN5_FDC_DKC_KeyNum_Sta: uint8
  CAN5_FDC_DKC_KeyType_Sta: uint8
  CAN5_FDC_DKC_OutputPCMDModule_Sta: uint8
  CAN5_FDC_DKC_ParkingMode_Cmd: uint8
  CAN5_FDC_DKC_ReVehData_Sta: uint8
  CAN5_FDC_DKC_SPTGDet_Cmd: uint8
  CAN5_FDC_DKC_SPTGOpen_Cmd: uint8
  CAN5_FDC_DKC_ShippingMode_Sta: uint8
  CAN5_FDC_DKC_UIDBatVolt_Sta: uint16
  CAN5_FDC_DKC_UIDLowPower_Sta: uint8
  CAN5_FDC_DKC_UWB0_Distance_Sta: uint8
  CAN5_FDC_DKC_UWB0_FPP_Sta: uint8
  CAN5_FDC_DKC_UWB0_Invalid_Sta: uint8
  CAN5_FDC_DKC_UWB1_Distance_Sta: uint8
  CAN5_FDC_DKC_UWB1_FPP_Sta: uint8
  CAN5_FDC_DKC_UWB1_Invalid_Sta: uint8
  CAN5_FDC_DKC_UWB2_Distance_Sta: uint8
  CAN5_FDC_DKC_UWB2_FPP_Sta: uint8
  CAN5_FDC_DKC_UWB2_Invalid_Sta: uint8
  CAN5_FDC_DKC_UWB3_Distance_Sta: uint8
  CAN5_FDC_DKC_UWB3_FPP_Sta: uint8
  CAN5_FDC_DKC_UWB3_Invalid_Sta: uint8
  CAN5_FDC_DKC_UWB4_Distance_Sta: uint8
  CAN5_FDC_DKC_UWB4_FPP_Sta: uint8
  CAN5_FDC_DKC_UWB4_Invalid_Sta: uint8
  CAN5_FDC_DKC_UWBDetArea_Sta: uint8
  CAN5_FDC_DKC_UWBDetPTGArea_Sta: uint8
  CAN5_FDC_DKC_UWB_OnOff_Sta: uint8

DT_CAN4_SG_FD4_CE100_0 = Simulink.Bus(HeaderFile="Rte_Type.h")
  CAN4_APS_Sta_System: uint8
  CAN4_AllDoorSW: uint8
  CAN4_AntiTheftSeatFold: uint8
  CAN4_AntitheftSta: uint8
  CAN4_BCM_DoorLock_Sta: uint8
  CAN4_BrakeLamp: uint8
  CAN4_CC_Crl_Sta: uint8
  CAN4_CS_VCU1_CAN4: uint8
  CAN4_CTDCtrl: uint8
  CAN4_CTDLockSW: uint8
  CAN4_CTDUnlockSW: uint8
  CAN4_CrashDetd: uint8
  CAN4_CtrlDrPwrStbA2: uint8
  CAN4_CtrlFrBMSCCUCIR: uint8
  CAN4_CtrlFrEDUINVERTER: uint8
  CAN4_CtrlFrIRC1: uint8
  CAN4_CtrlFrPwrStbA1P: uint8
  CAN4_DKCAuthSta: uint8
  CAN4_DKCTimeSN: uint32
  CAN4_Dimmer: uint8
  CAN4_DimmerEN: uint8
  CAN4_DoorLockIND: uint8
  CAN4_DrDoorSW: uint8
  CAN4_Dr_SeatSta: uint8
  CAN4_EquivAccPedalSWSta: uint8
  CAN4_FDC_VMC_VehPitchAngle_Sta: uint8
  CAN4_FD_DKC_VehData_Err: uint8
  CAN4_FD_DKC_VehData_Sta: uint8
  CAN4_FD_TBOX_DTCData_Err: uint8
  CAN4_FD_TBOX_DTCData_Sta: uint8
  CAN4_FD_TBOX_VehData_Err: uint8
  CAN4_FD_TBOX_VehData_Sta: uint8
  CAN4_Fr_ChargingDoorCtrl: uint8
  CAN4_Fr_FogLamp: uint8
  CAN4_Fr_Wiper_H: uint8
  CAN4_Fr_Wiper_L: uint8
  CAN4_HWResetSta: uint8
  CAN4_H_Beam: uint8
  CAN4_H_Beam_ADB: uint8
  CAN4_HazardSW: uint8
  CAN4_HoodSW: uint8
  CAN4_HornCtrl: uint8
  CAN4_LBSD: uint8
  CAN4_LDRL: uint8
  CAN4_LTurnLP: uint8
  CAN4_L_APM_WdwEnable: uint8
  CAN4_L_Beam: uint8
  CAN4_LampPwr: uint8
  CAN4_LockSetting: uint8
  CAN4_MSA_Crl_Sta: uint8
  CAN4_MirrorCtrl: uint8
  CAN4_MirrorDefog: uint8
  CAN4_PosLamp: uint8
  CAN4_PsDoorSW: uint8
  CAN4_PwrSta: uint8
  CAN4_RBSD: uint8
  CAN4_RC_VCU1_CAN4: uint8
  CAN4_RDRL: uint8
  CAN4_RLDoorSW: uint8
  CAN4_RRDoorSW: uint8
  CAN4_RTurnLP: uint8
  CAN4_ReBrakeLPReq: uint8
  CAN4_ReverseLamp: uint8
  CAN4_RoomLampH: uint8
  CAN4_RoomLampL: uint8
  CAN4_Rr_ChargingDoorCtrl: uint8
  CAN4_Rr_Defog: uint8
  CAN4_Rr_FogLamp: uint8
  CAN4_Rr_Wiper: uint8
  CAN4_ShiftGearPosn: uint8
  CAN4_TailgateHDSW: uint8
  CAN4_TailgateRemote: uint8
  CAN4_Tailgate_SW: uint8
  CAN4_TimeSNDKCFbk: uint32
  CAN4_TrunkRel: uint8
  CAN4_WasherCtrl: uint8
  CAN4_WiperFixMode: uint8

DT_CAN4_SG_BodyZone_DR2 = Simulink.Bus(HeaderFile="Rte_Type.h")
  CAN4_BD_APM_WinFOpened_Sta: uint8
  CAN4_BD_APM_WinROpened_Sta: uint8
  CAN4_BD_Door_FHandleClose_Sta: uint8
  CAN4_BD_Door_FHandleHalf_Sta: uint8
  CAN4_BD_Door_RHandleClose_Sta: uint8
  CAN4_BD_Door_RHandleHalf_Sta: uint8