% Simulink data dictionary APPTypes.sldd

DT_CAN2_SG_FD_OTA1 = Simulink.Bus(HeaderFile="Rte_Type.h")
  CAN2_OTA_DL_Available: uint8
  CAN2_OTA_DL_Speed: uint32
  CAN2_OTA_Debug_Code: uint8
  CAN2_OTA_InVehicle_FW: uint8
  CAN2_OTA_Lock_Req: uint8
  CAN2_OTA_MDA_Status: uint8
  CAN2_OTA_Mode: uint8
  CAN2_OTA_Network_Type: uint8
  CAN2_OTA_Permit_Agreed: uint8
  CAN2_OTA_Progress_Rate: uint8
  CAN2_OTA_Remained_Time: uint16
  CAN2_OTA_TBOXResetReq: uint8
  CAN2_OTA_Up_Backcount: uint8
  CAN2_OTA_Update_Available: uint8
  CAN2_OTA_Updating_ECU: uint8
  CAN2_OTA_Updating_ECU_8bit: uint8

DT_CAN3_SG_FD_OTA1 = Simulink.Bus(HeaderFile="Rte_Type.h")
  CAN3_OTA_DL_Available: uint8
  CAN3_OTA_DL_Speed: uint32
  CAN3_OTA_InVehicle_FW: uint8
  CAN3_OTA_Lock_Req: uint8
  CAN3_OTA_MDA_Status: uint8
  CAN3_OTA_Mode: uint8
  CAN3_OTA_Network_Type: uint8
  CAN3_OTA_Progress_Rate: uint8
  CAN3_OTA_TBOXResetReq: uint8
  CAN3_OTA_Up_Backcount: uint8
  CAN3_OTA_Update_Available: uint8
  CAN3_OTA_Updating_ECU: uint8

DT_CAN4_SG_FD_OTA1 = Simulink.Bus(HeaderFile="Rte_Type.h")
  CAN4_OTA_DL_Available: uint8
  CAN4_OTA_DL_Speed: uint32
  CAN4_OTA_InVehicle_FW: uint8
  CAN4_OTA_Lock_Req: uint8
  CAN4_OTA_MDA_Status: uint8
  CAN4_OTA_Mode: uint8
  CAN4_OTA_Network_Type: uint8
  CAN4_OTA_Progress_Rate: uint8
  CAN4_OTA_TBOXResetReq: uint8
  CAN4_OTA_Up_Backcount: uint8
  CAN4_OTA_Update_Available: uint8
  CAN4_OTA_Updating_ECU: uint8

AppModeRequestType = enum(HeaderFile="Rte_Type.h", DefaultValue="APP_MODE_ACTIVE", StorageType="uint8")
  APP_MODE_ACTIVE = 0
  APP_MODE_INACTIVE = 1

DT_CAN1_SG_ABM1 = Simulink.Bus(HeaderFile="Rte_Type.h")
  CAN1_AirBagFailCmd: uint8
  CAN1_Checksum_ABM1: uint8
  CAN1_CrashOutputSts: uint8
  CAN1_DriverSeatBeltCmd: uint8
  CAN1_LifeCount_ABM1: uint8
  CAN1_PABSwitchCmd: uint8
  CAN1_PsngrSeatBeltCmd: uint8
  CAN1_RCenterSeatBeltCmd: uint8
  CAN1_RDriverSeatBeltCmd: uint8
  CAN1_RPsngrSeatBeltCmd: uint8
  CAN1_TLHPsngrSeatBeltCmd: uint8
  CAN1_TRHPsngrSeatBeltCmd: uint8

DT_CAN1_SG_EPAS1 = Simulink.Bus(HeaderFile="Rte_Type.h")
  CAN1_DriIntend: uint8
  CAN1_EPAS1_Checksum: uint8
  CAN1_EPAS1_LifeCount: uint8
  CAN1_EPS_AOI_Control: uint8
  CAN1_EPS_TOI_Fault: uint8

DT_CAN1_SG_EPAS2 = Simulink.Bus(HeaderFile="Rte_Type.h")
  CAN1_SAS_Angle: uint16
  CAN1_SAS_CAL: uint8
  CAN1_SAS_CheckSum: uint8
  CAN1_SAS_MsgCount: uint8
  CAN1_SAS_Speed: uint8
  CAN1_SAS_Speed_Valid: uint8
  CAN1_SAS_V: uint8

DT_CAN1_SG_EPB1 = Simulink.Bus(HeaderFile="Rte_Type.h")
  CAN1_DOA_Sta: uint8
  CAN1_EPB1_CS: uint8
  CAN1_EPB1_RC: uint8
  CAN1_EPBCarWashMode: uint8
  CAN1_EPBErrSta: uint8
  CAN1_EPBExtApplyAvail: uint8
  CAN1_EPBExtReleaseAvail: uint8
  CAN1_EPBMsg: uint8
  CAN1_EPBRLampSta: uint8
  CAN1_EPBSta: uint8
  CAN1_EPBStaL: uint8
  CAN1_EPBStaR: uint8
  CAN1_TakeOverReq: uint8

DT_CAN1_SG_ESC1 = Simulink.Bus(HeaderFile="Rte_Type.h")
  CAN1_ESC1_CS: uint8
  CAN1_ESC1_RC: uint8
  CAN1_Fr_PTCS_Active: uint8
  CAN1_FrntAxlTrqReq_Drv: uint16
  CAN1_RearAxlTrqReq_Drv: uint16
  CAN1_Rr_PTCS_Active: uint8
  CAN1_VehSpeed: uint16

DT_CAN1_SG_ESC2 = Simulink.Bus(HeaderFile="Rte_Type.h")
  CAN1_F_WhlSpeed_CRC_8: uint8
  CAN1_F_WhlSpeed_Count: uint8
  CAN1_LF_PulseCount: uint8
  CAN1_LF_PulseCount_V: uint8
  CAN1_LF_RawWhlSpeed: uint16
  CAN1_LF_RawWhlSpeed_V: uint8
  CAN1_LF_WhlRotDir: uint8
  CAN1_RF_PulseCount: uint8
  CAN1_RF_PulseCount_V: uint8
  CAN1_RF_RawWhlSpeed: uint16
  CAN1_RF_RawWhlSpeed_V: uint8
  CAN1_RF_WhlRotDir: uint8

DT_CAN1_SG_ESC3 = Simulink.Bus(HeaderFile="Rte_Type.h")
  CAN1_LR_PulseCount: uint8
  CAN1_LR_PulseCount_V: uint8
  CAN1_LR_RawWhlSpeed: uint16
  CAN1_LR_RawWhlSpeed_V: uint8
  CAN1_LR_WhlRotDir: uint8
  CAN1_RR_PulseCount: uint8
  CAN1_RR_PulseCount_V: uint8
  CAN1_RR_RawWhlSpeed: uint16
  CAN1_RR_RawWhlSpeed_V: uint8
  CAN1_RR_WhlRotDir: uint8
  CAN1_R_WhlSpeed_CRC_8: uint8
  CAN1_R_WhlSpeed_Count: uint8

DT_CAN1_SG_ESC4 = Simulink.Bus(HeaderFile="Rte_Type.h")
  CAN1_ABS_Active: uint8
  CAN1_ABS_Failed: uint8
  CAN1_ABS_WnlmpSta: uint8
  CAN1_AVH_Active: uint8
  CAN1_AVH_Failed: uint8
  CAN1_Amber_WnlmpSta: uint8
  CAN1_BTCS_Active: uint8
  CAN1_EBD_Active: uint8
  CAN1_EBD_Failed: uint8
  CAN1_ESC_Active: uint8
  CAN1_ESC_BeepReq: uint8
  CAN1_ESC_Failed: uint8
  CAN1_ESC_OFF_Status: uint8
  CAN1_ESC_Off_lmpSta: uint8
  CAN1_ESC_WnlmpSta: uint8
  CAN1_ESS_Active: uint8
  CAN1_GRADE: uint8
  CAN1_HBB_Active: uint8
  CAN1_HBB_Failed: uint8
  CAN1_HDD_Active: uint8
  CAN1_HDD_Failed: uint8
  CAN1_HSA_Active: uint8
  CAN1_HSA_Failed: uint8
  CAN1_PBA_Active: uint8
  CAN1_PBA_Failed: uint8
  CAN1_Red_WnlmpSta: uint8
  CAN1_SystemVoltage: uint8
  CAN1_TCS_Active: uint8
  CAN1_TCS_Failed: uint8

DT_CAN1_SG_ESC5 = Simulink.Bus(HeaderFile="Rte_Type.h")
  CAN1_BrkSw_Sta: uint8
  CAN1_BrkSw_V: uint8
  CAN1_ESC5_CRC8: uint8
  CAN1_ESC5_RC: uint8
  CAN1_LatAccel: uint8
  CAN1_LatAccel_V: uint8
  CAN1_LongAccel: uint8
  CAN1_LongAccel_V: uint8
  CAN1_MCPressure: uint16
  CAN1_MCPressure_V: uint8
  CAN1_YawRate: uint16
  CAN1_YawRate_V: uint8

DT_CAN1_SG_ESC6 = Simulink.Bus(HeaderFile="Rte_Type.h")
  CAN1_ACCAvail: uint8
  CAN1_AEBAvail: uint8
  CAN1_ActBrkLamp_Sta: uint8
  CAN1_BrkDiscTempSta: uint8
  CAN1_DecErrSta: uint8
  CAN1_ESC6_CS: uint8
  CAN1_ESC6_RC: uint8
  CAN1_ESC_ADAS_Sta: uint8
  CAN1_ESC_APS_Sta: uint8
  CAN1_ESC_Standstill: uint8
  CAN1_Meter_Ind_VehSpeed: uint16

DT_CAN1_SG_ESC7 = Simulink.Bus(HeaderFile="Rte_Type.h")
  CAN1_BrkPedalPos: uint8
  CAN1_BrkPedalPos_Sta: uint8
  CAN1_ESC7_CS: uint8
  CAN1_ESC7_RC: uint8
  CAN1_Fr_RBC_Active: uint8
  CAN1_FrntAxlTrqReq_Brk: uint16
  CAN1_RDC_Active: uint8
  CAN1_RearAxlTrqReq_Brk: uint16
  CAN1_Rr_RBC_Active: uint8

DT_CAN1_SG_FCM2 = Simulink.Bus(HeaderFile="Rte_Type.h")
  CAN1_ACC_ComfortBandLower: uint16
  CAN1_ACC_ComfortBandUpper: uint16
  CAN1_ACC_JerkLowerLimit: uint8
  CAN1_ACC_JerkUpperLimit: uint8
  CAN1_ACC_RequiredAccel: uint16
  CAN1_ACC_VehHoldReq: uint8
  CAN1_ADAS_AEBReq: uint8
  CAN1_ADAS_DBSReq: uint8
  CAN1_ADAS_FaultSta: uint8
  CAN1_AEB_VehHoldReq: uint8
  CAN1_FCM2_Checksum: uint8
  CAN1_FCM2_LifeCount: uint8

DT_CAN1_SG_FCM3 = Simulink.Bus(HeaderFile="Rte_Type.h")
  CAN1_ACC_ObjDist: uint16
  CAN1_ACC_ObjRelSpd: uint16
  CAN1_ADAS_ForceIdle: uint8
  CAN1_ADAS_ShftPosnReq: uint8
  CAN1_ADAS_ShftPosnReq_A: uint8
  CAN1_ADAS_VehSpdLim: uint8
  CAN1_FCM3_Checksum: uint8
  CAN1_FCM3_LifeCount: uint8

DT_CAN1_SG_FCM4 = Simulink.Bus(HeaderFile="Rte_Type.h")
  CAN1_ACCSetSpeed: uint8
  CAN1_ACCSetSpeed_Disp: uint8
  CAN1_ACC_ObjDstLvl: uint8
  CAN1_ACC_TakeoverReq: uint8
  CAN1_ADAS_ACC_Sta: uint8
  CAN1_ADAS_AEB_Sta: uint8
  CAN1_ADAS_CAM_SpdLim: uint8
  CAN1_ADAS_FCW_Sta: uint8
  CAN1_ADAS_FltWrnReq: uint8
  CAN1_ADAS_LDW_Sta: uint8
  CAN1_ADAS_SLIF_SpdLim: uint8
  CAN1_ADAS_WarningMsg: uint8
  CAN1_FCM4_Checksum: uint8
  CAN1_ForceLowBeam: uint8
  CAN1_HazardWarningReq: uint8
  CAN1_LeftTurnLightReq: uint8
  CAN1_RightTurnLightReq: uint8
  CAN1_Target_Type: uint8
  CAN1_TimeGapLevel: uint8

DT_CAN1_SG_SRR1 = Simulink.Bus(HeaderFile="Rte_Type.h")
  CAN1_SRR1_Chksum: uint8
  CAN1_SRR1_LifeCount: uint8
  CAN1_SRR_BSD_Mute: uint8
  CAN1_SRR_BSD_SoundL: uint8
  CAN1_SRR_BSD_SoundR: uint8
  CAN1_SRR_BSD_Sta: uint8
  CAN1_SRR_BSD_WarnL: uint8
  CAN1_SRR_BSD_WarnR: uint8
  CAN1_SRR_FltWrnReq: uint8
  CAN1_SRR_ODA_Mute: uint8
  CAN1_SRR_ODA_SoundL: uint8
  CAN1_SRR_ODA_SoundR: uint8
  CAN1_SRR_ODA_Sta: uint8
  CAN1_SRR_ODA_WarnL: uint8
  CAN1_SRR_ODA_WarnR: uint8
  CAN1_SRR_RCTA_Sta: uint8
  CAN1_SRR_RCTA_WarnL: uint8
  CAN1_SRR_RCTA_WarnR: uint8

DT_CAN2_SG_IVI1 = Simulink.Bus(HeaderFile="Rte_Type.h")
  CAN2_AmbLightColorSet: uint8
  CAN2_AmbLightUserSet: uint8
  CAN2_BrkAbn_GoReady_SW: uint8
  CAN2_DRAmbLightBrightnessSet: uint8
  CAN2_FCP_FrEvt_BtnACMaxReq: uint8
  CAN2_FCP_FrEvt_BtnACReq: uint8
  CAN2_FCP_FrEvt_BtnAutoReq: uint8
  CAN2_FCP_FrEvt_BtnSyncReq: uint8
  CAN2_FCP_MidEvt_BtnAutoReq: uint8
  CAN2_IPAmbLightBrightnessSet: uint8
  CAN2_IVI_Lock_SoundSW_Sta: uint8
  CAN2_IVI_OTA_Upd_Sta: uint8
  CAN2_LINKtoDrive: uint8
  CAN2_OTA_CancelDL_Req: uint8
  CAN2_OTA_CompNTFY_Pres: uint8
  CAN2_OTA_DL_Req: uint8
  CAN2_OTA_SuspendDL_Req: uint8
  CAN2_OTA_UpdStart_Req: uint8
  CAN2_OpenDrOpenWdo_SW: uint8
  CAN2_PW_CLOSE_IMD: uint8
  CAN2_PW_CONTINUE_USE: uint8
  CAN2_Sched_OTA_wake: uint8
  CAN2_SmartEco_Mode_SW: uint8
  CAN2_Upd_Countdown_Cancel: uint8
  CAN2_Upd_Countdown_Skip: uint8
  CAN2_VehACModReq: uint8

DT_CAN2_SG_IVI2 = Simulink.Bus(HeaderFile="Rte_Type.h")
  CAN2_AC_Chg_Cur_Set: uint8
  CAN2_AEB_BUTT: uint8
  CAN2_AVM_Err_STA: uint8
  CAN2_AVM_OFF_Rec_Butt: uint8
  CAN2_AVM_Parking_mode: uint8
  CAN2_AVM_parking_cancel: uint8
  CAN2_AVM_parking_excute: uint8
  CAN2_Approach_Unlock_SW: uint8
  CAN2_BSDMute_BUTT: uint8
  CAN2_CAAS_Sw: uint8
  CAN2_CDL_Lock_Butt: uint8
  CAN2_CDL_Unlock_Butt: uint8
  CAN2_CameraWrn: uint8
  CAN2_DSEAT_anti_set: uint8
  CAN2_DSEAT_entryfun_set: uint8
  CAN2_DSEAT_vent_req: uint8
  CAN2_Distance_unit: uint8
  CAN2_ESC_SW_Cmd: uint8
  CAN2_FCWMute_BUTT: uint8
  CAN2_FFogLampSW: uint8
  CAN2_FS_Off_Sw: uint8
  CAN2_FalseNPrevent_SW: uint8
  CAN2_FollowMeSW: uint8
  CAN2_GPS_LAT: uint32
  CAN2_GPS_LONG: uint32
  CAN2_HeadLampSW: uint8
  CAN2_Hood_Latch_SW: uint8
  CAN2_IVI_AGSCloseSW: uint8
  CAN2_IVI_ActvDmpDisabSW: uint8
  CAN2_IVI_CoastDwSW: uint8
  CAN2_IVI_CreepSW_Req: uint8
  CAN2_IVI_ISA_OffsetSpd: uint8
  CAN2_IVI_LVChrgFuncSW: uint8
  CAN2_IVI_Mute_Sta: uint8
  CAN2_IVI_Night_Mode_Sta: uint8
  CAN2_IVI_PTG_Mode_SW: uint8
  CAN2_IVI_PTG_Open_Height: uint8
  CAN2_IVI_PTG_Sta_SW: uint8
  CAN2_IVI_PTG_USSta_SW: uint8
  CAN2_IVI_PW_Mode_Req: uint8
  CAN2_IVI_Panel_Act: uint8
  CAN2_IVI_Panel_X_Coor: uint16
  CAN2_IVI_Panel_Y_Coor: uint16
  CAN2_IVI_PwrLockSW: uint8
  CAN2_IVI_Pwroff_req: uint8
  CAN2_IVI_RR_Def_Req: uint8
  CAN2_IVI_Req_V2L: uint8
  CAN2_IVI_Screen: uint8
  CAN2_IVI_Start_Chg_req: uint8
  CAN2_IVI_Status: uint8
  CAN2_IVI_Stop_Chg_req: uint8
  CAN2_IVI_Trigger_req: uint8
  CAN2_IVI_Unlock_Chg_req: uint8
  CAN2_IVI_WI_MAIN_SW: uint8
  CAN2_LDWMute_BUTT: uint8
  CAN2_LKA_BUTT: uint8
  CAN2_LVDAMute_BUTT: uint8
  CAN2_L_Drv_ControlCommand: uint8
  CAN2_L_Pas_ControlCommand: uint8
  CAN2_L_RLD_ControlCommand: uint8
  CAN2_L_RRD_ControlCommand: uint8
  CAN2_METER_Malfunc_Sta: uint8
  CAN2_MFRD_N_Bright_Req: uint8
  CAN2_NAVI_Cam_Dist_info: uint8
  CAN2_NAVI_Direction_STA: uint8
  CAN2_NAVI_Distance_info: uint32
  CAN2_NAVI_ForwardLinkLevel: uint8
  CAN2_NAVI_LinkClass: uint8
  CAN2_NAVI_RoadClass: uint8
  CAN2_NAVI_SpeedLimit: uint8
  CAN2_NAVI_Speed_Limit_A: uint8
  CAN2_NAVI_State: uint8
  CAN2_NAVI_Tollgate: uint16
  CAN2_NAVI_Tunnel: uint16
  CAN2_ODAMute_BUTT: uint8
  CAN2_OFF_AC_MODE: uint8
  CAN2_PSEAT_vent_req: uint8
  CAN2_Perd_V2L: uint8
  CAN2_Pressure_unit: uint8
  CAN2_RCTA_BUTT: uint8
  CAN2_RFogLampSW: uint8
  CAN2_Roll_Eng_Mode: uint8
  CAN2_Roll_Mode_SW_Cmd: uint8
  CAN2_RoomLampMode: uint8
  CAN2_SLG_Sw: uint8
  CAN2_SLIF_BUTT: uint8
  CAN2_SOC_ADJ_BUTT: uint8
  CAN2_SOC_Limit_Set: uint8
  CAN2_SOC_V2LLimit: uint8
  CAN2_Sched_Chg_Start: uint8
  CAN2_Sched_Chg_Stop: uint8
  CAN2_Sched_Chg_butt: uint8
  CAN2_Sched_Chg_limit: uint8
  CAN2_Sched_Chg_wake: uint8
  CAN2_SenstivityPosition: uint8
  CAN2_SetUnlockSingle: uint8
  CAN2_TCS_SW_Cmd: uint8
  CAN2_TPMS_Cali_Butt: uint8
  CAN2_TPMS_Res_Butt: uint8
  CAN2_Temperature_unit: uint8
  CAN2_Time_system: uint8
  CAN2_TurnSwTimeSet: uint8
  CAN2_User_p_download: uint8
  CAN2_User_p_upload: uint8
  CAN2_Walkaway_Lock_SW: uint8
  CAN2_Wifi_Reset: uint8
  CAN2_Wifi_Sta_IVI_TBOX: uint8
  CAN2_sigAirIntenZon1Req: uint8
  CAN2_sigAirIntenZon3Req: uint8
  CAN2_sigDfrstReq: uint8
  CAN2_sigFaceReq: uint8
  CAN2_sigFootReq: uint8
  CAN2_sigHvacFrontReq: uint8
  CAN2_sigHvacRearReq: uint8
  CAN2_sigHvacReq: uint8
  CAN2_sigRecircReq: uint8
  CAN2_sigSetTempZon1Req: uint8
  CAN2_sigSetTempZon2Req: uint8
  CAN2_sigSetTempZon3Req: uint8
  CAN2_sigWindDirZon3Req: uint8

DT_CAN2_SG_IVI6 = Simulink.Bus(HeaderFile="Rte_Type.h")
  CAN2_IVI_Located_STA: uint8
  CAN2_IVI_Time_Check: uint8
  CAN2_IVI_Time_Day: uint8
  CAN2_IVI_Time_Hour: uint8
  CAN2_IVI_Time_Minute: uint8
  CAN2_IVI_Time_Month: uint8
  CAN2_IVI_Time_Second: uint8
  CAN2_IVI_Time_Year: uint8

DT_CAN2_SG_METER1 = Simulink.Bus(HeaderFile="Rte_Type.h")
  CAN2_APCforDTE: uint16
  CAN2_AVGPwrConsumption: uint16
  CAN2_AvailableTrip: uint16
  CAN2_Averaged_vehspeed: uint16
  CAN2_Charge: uint8
  CAN2_LEDlitWarnReq: uint8
  CAN2_METER_KPH_Calcu: uint8
  CAN2_METER_KPH_Real: uint16
  CAN2_METER_MPH_Calcu: uint8
  CAN2_METER_MPH_Real: uint16
  CAN2_ODOMETER: uint32
  CAN2_ParkBrake: uint8
  CAN2_Spd_Crl_Mode: uint8
  CAN2_Spd_Crl_Sta: uint8
  CAN2_Trip_A: uint32
  CAN2_Trip_B: uint32

DT_CAN3_SG_BMS1 = Simulink.Bus(HeaderFile="Rte_Type.h")
  CAN3_BMSChckSum_1: uint8
  CAN3_BMSRolCnct_1: uint8
  CAN3_HVBPwrAvailChrg: uint16
  CAN3_HVBPwrAvailChrg30: uint16
  CAN3_HVBPwrAvailChrg60: uint16
  CAN3_HVBPwrAvailDchrg: uint16
  CAN3_HVBPwrAvailDchrg30: uint16
  CAN3_HVBPwrAvailDchrg60: uint16
  CAN3_HVBattCurr: uint16
  CAN3_HVBattVolt: uint16

DT_CAN3_SG_BMS2 = Simulink.Bus(HeaderFile="Rte_Type.h")
  CAN3_HVInVolt: uint16
  CAN3_LVBattDet12V: uint8
  CAN3_OBCDCCurLm: uint16
  CAN3_OBCDCVoltLm: uint16
  CAN3_ReChargerStaFromEvcc: uint8

DT_CAN3_SG_BMS3 = Simulink.Bus(HeaderFile="Rte_Type.h")
  CAN3_ACChrgCurrDis: uint16
  CAN3_BMS_HVBattCellBalance_Sta: uint8
  CAN3_Battsystfail_Num: uint8
  CAN3_CellType: uint8
  CAN3_HVBChrgPwr: uint16
  CAN3_HVBChrgPwrTotal: uint32
  CAN3_HVBDrvPwr: uint16
  CAN3_HVBDrvPwrTotal: uint32
  CAN3_HVBFullChrgPwr: uint16
  CAN3_HVBIsoImpedenceN: uint16
  CAN3_HVBIsoImpedenceP: uint16
  CAN3_HVBSOH: uint8
  CAN3_HVBattPackVolt: uint16
  CAN3_HVBattSOC: uint8
  CAN3_HVBattSOCDiff: uint8
  CAN3_HVBattSOCDis: uint8
  CAN3_RechrgCyc: uint32
  CAN3_RemainChrgTime: uint16
  CAN3_SOC_UseLimit: uint8

DT_CAN3_SG_BMS4 = Simulink.Bus(HeaderFile="Rte_Type.h")
  CAN3_CellTempAvg: uint8
  CAN3_HVBCellVoltMax: uint16
  CAN3_HVBCellVoltMin: uint16
  CAN3_HVBMTempMax: uint8
  CAN3_HVBMTempMin: uint8
  CAN3_MaxCellTemp_Num: uint8
  CAN3_MaxCellVolt_Num: uint8
  CAN3_MinCellTemp_Num: uint8
  CAN3_MinCellVolt_Num: uint8
  CAN3_Mtemp01: uint8
  CAN3_Mtemp02: uint8
  CAN3_Mtemp03: uint8
  CAN3_Mtemp04: uint8
  CAN3_Mtemp05: uint8
  CAN3_Mtemp06: uint8
  CAN3_Mtemp07: uint8
  CAN3_Mtemp08: uint8
  CAN3_Mtemp09: uint8
  CAN3_Mtemp10: uint8
  CAN3_Mtemp11: uint8
  CAN3_Mtemp12: uint8
  CAN3_Mtemp13: uint8
  CAN3_Mtemp14: uint8
  CAN3_Mtemp15: uint8
  CAN3_Mtemp16: uint8
  CAN3_Mtemp17: uint8
  CAN3_Mtemp18: uint8
  CAN3_Mtemp19: uint8
  CAN3_Mtemp20: uint8

DT_CAN3_SG_BMS6 = Simulink.Bus(HeaderFile="Rte_Type.h")
  CAN3_BMSChckSum: uint8
  CAN3_BMSRolCnct: uint8
  CAN3_BMS_READY: uint8
  CAN3_BMS_Warn_1: uint8
  CAN3_BMS_Warn_2: uint8
  CAN3_BMS_Warn_3: uint8
  CAN3_BMS_Warn_4: uint8
  CAN3_BMS_Warn_5: uint8
  CAN3_BMS_Warn_6: uint8
  CAN3_BMS_Warn_7: uint8
  CAN3_BMS_Warn_8: uint8
  CAN3_CellUnconsistErr: uint8
  CAN3_ChrgInLockReq: uint8
  CAN3_ChrgPlugSta: uint8
  CAN3_DCChrgSysShockErr: uint8
  CAN3_DisChrgPlugErr: uint8
  CAN3_ExtChrgSta: uint8
  CAN3_HVBCellOvrVoltErr: uint8
  CAN3_HVBCellOvrVoltWarn: uint8
  CAN3_HVBCellUdrVoltWarn: uint8
  CAN3_HVBCellUnbalanErr: uint8
  CAN3_HVBCellUndrVoltErr: uint8
  CAN3_HVBChrgErr: uint8
  CAN3_HVBContactorSta: uint8
  CAN3_HVBHVILErr: uint8
  CAN3_HVBOvrChrgCurrErr: uint8
  CAN3_HVBOvrDchrgCurErr: uint8
  CAN3_HVBOvrSOCErr: uint8
  CAN3_HVBOvrTempErr: uint8
  CAN3_HVBOvrTempWarn: uint8
  CAN3_HVBOvrVoltErr: uint8
  CAN3_HVBPrechrgSta: uint8
  CAN3_HVBPreheatPrecoolSta: uint8
  CAN3_HVBSOCJumpError: uint8
  CAN3_HVBShrtChrgCurrErr: uint8
  CAN3_HVBShrtDischrgCurrErr: uint8
  CAN3_HVBTempDiffErr: uint8
  CAN3_HVBUndrSOCErr: uint8
  CAN3_HVBUndrTempErr: uint8
  CAN3_HVBUndrTempWarn: uint8
  CAN3_HVBUndrVoltErr: uint8
  CAN3_HVBattReady4Pre: uint8
  CAN3_HVILSta: uint8
  CAN3_IsoDetSta: uint8
  CAN3_SystemUncomErr: uint8
  CAN3_V2LSta: uint8

DT_CAN3_SG_BMS7 = Simulink.Bus(HeaderFile="Rte_Type.h")
  CAN3_ChrgCurType: uint8
  CAN3_ChrgLampSta: uint8
  CAN3_FireDetErr: uint8
  CAN3_HVBattErr: uint8

DT_CAN3_SG_CCU1 = Simulink.Bus(HeaderFile="Rte_Type.h")
  CAN3_CS_CCU1: uint8
  CAN3_DCDCAuxVolt: uint8
  CAN3_DCDCInVoltInf: uint16
  CAN3_DCDCPreCompleted: uint8
  CAN3_OBCDCCurrInf: uint16
  CAN3_OBCDCVoltInf: uint16
  CAN3_OBCPreCompleted: uint8
  CAN3_OBCWakeup4Plugin: uint8
  CAN3_RC_CCU1: uint8

DT_CAN3_SG_CCU2 = Simulink.Bus(HeaderFile="Rte_Type.h")
  CAN3_CS_CCU2: uint8
  CAN3_DCDCEnaSta: uint8
  CAN3_DCDCFaultSta: uint8
  CAN3_DCDCReady4Pre: uint8
  CAN3_DCDCTemp: uint8
  CAN3_OBCACCurrInf: uint16
  CAN3_OBCACVoltInf: uint16
  CAN3_OBCDCP: uint16
  CAN3_OBCEnaSta: uint8
  CAN3_OBCFaultSta: uint8
  CAN3_OBCPluginSta: uint8
  CAN3_OBCReady4Pre: uint8
  CAN3_OBCTemp: uint16
  CAN3_OBCV2LSta: uint8
  CAN3_OBC_AC_Cur_Lim: uint8
  CAN3_RC_CCU2: uint8
  CAN3_ReqOBCV2LEna: uint8

DT_CAN3_SG_CCU4 = Simulink.Bus(HeaderFile="Rte_Type.h")
  CAN3_DCDCAuxCur: uint16
  CAN3_DCDCHVCur: uint16
  CAN3_OBCV2LINVOTP: uint8
  CAN3_OBCV2LInsuFault: uint8
  CAN3_OBCV2LVinOVP: uint8
  CAN3_OBCV2LVinUVP: uint8
  CAN3_OBCV2LVoutOCP: uint8
  CAN3_OBCV2LVoutOVP: uint8
  CAN3_OBCV2LVoutUVP: uint8

DT_CAN3_SG_MCU_F1 = Simulink.Bus(HeaderFile="Rte_Type.h")
  CAN3_Fr_ActvDmpDisabSta: uint8
  CAN3_Fr_EDUDrtSta: uint8
  CAN3_Fr_EDUOpratingSta: uint8
  CAN3_Fr_EDURealTMTq: uint16
  CAN3_Fr_EDURotateDirction: uint8
  CAN3_Fr_EDUTqReqFbk: uint16
  CAN3_Fr_MCU1Chksum: uint8
  CAN3_Fr_MCU1RolCnt: uint8
  CAN3_Fr_MCUBAT: uint8
  CAN3_Fr_MCUDCBusCurr: uint16
  CAN3_Fr_MCUDCBusVolt: uint16
  CAN3_Fr_MCUDischrgSta: uint8
  CAN3_Fr_MCUEnaSta: uint8
  CAN3_Fr_MCUErr: uint8
  CAN3_Fr_MCUIGN_sta: uint8
  CAN3_Fr_MCUReady: uint8
  CAN3_Fr_MCUReady4Pre: uint8
  CAN3_Fr_MCUSysSta: uint8
  CAN3_Fr_MCUTemp: uint16
  CAN3_Fr_MotorAvailTq: uint16
  CAN3_Fr_RegenAvailTq: uint16
  CAN3_Fr_Reserved_bits: uint8
  CAN3_Fr_TMSpd: uint16
  CAN3_Fr_TMTemp: uint16
  CAN3_Fr_TMid: uint16
  CAN3_Fr_TMiq: uint16
  CAN3_MCUWarn_F: uint8

DT_CAN3_SG_MCU_F2 = Simulink.Bus(HeaderFile="Rte_Type.h")
  CAN3_Fr_CoolanttempReq: uint16
  CAN3_Fr_EOP_SpdSet: uint16
  CAN3_Fr_Failcode1: uint8
  CAN3_Fr_Failcode2: uint8
  CAN3_Fr_Failcodehistory1: uint8
  CAN3_Fr_Failcodehistory2: uint8
  CAN3_Fr_LLCTemp: uint16
  CAN3_Fr_LLCflowReq: uint8
  CAN3_Fr_MCU2Chksum: uint8
  CAN3_Fr_MCU2RolCnt: uint8
  CAN3_Fr_MCUTempWarn: uint8
  CAN3_Fr_TMTempWarn: uint8
  CAN3_MCU_F_ResetCnt_Sta: uint8

DT_CAN3_SG_MCU_R1 = Simulink.Bus(HeaderFile="Rte_Type.h")
  CAN3_MCUWarn_R: uint8
  CAN3_Rr_ActvDmpDisabSta: uint8
  CAN3_Rr_EDUDrtSta: uint8
  CAN3_Rr_EDUOpratingSta: uint8
  CAN3_Rr_EDURealTMTq: uint16
  CAN3_Rr_EDURotateDirction: uint8
  CAN3_Rr_EDUTqReqFbk: uint16
  CAN3_Rr_MCU1Chksum: uint8
  CAN3_Rr_MCU1RolCnt: uint8
  CAN3_Rr_MCUBAT: uint8
  CAN3_Rr_MCUDCBusCurr: uint16
  CAN3_Rr_MCUDCBusVolt: uint16
  CAN3_Rr_MCUDischrgSta: uint8
  CAN3_Rr_MCUEnaSta: uint8
  CAN3_Rr_MCUErr: uint8
  CAN3_Rr_MCUIGN_sta: uint8
  CAN3_Rr_MCUReady: uint8
  CAN3_Rr_MCUReady4Pre: uint8
  CAN3_Rr_MCUSysSta: uint8
  CAN3_Rr_MCUTemp: uint16
  CAN3_Rr_MotorAvailTq: uint16
  CAN3_Rr_RegenAvailTq: uint16
  CAN3_Rr_Reserved_bits: uint8
  CAN3_Rr_TMSpd: uint16
  CAN3_Rr_TMTemp: uint16
  CAN3_Rr_TMid: uint16
  CAN3_Rr_TMiq: uint16

DT_CAN3_SG_MCU_R2 = Simulink.Bus(HeaderFile="Rte_Type.h")
  CAN3_MCU_R_ResetCnt_Sta: uint8
  CAN3_Rr_CoolanttempReq: uint16
  CAN3_Rr_EOP_SpdSet: uint16
  CAN3_Rr_Failcode1: uint8
  CAN3_Rr_Failcode2: uint8
  CAN3_Rr_Failcodehistory1: uint8
  CAN3_Rr_Failcodehistory2: uint8
  CAN3_Rr_LLCTemp: uint16
  CAN3_Rr_LLCflowReq: uint8
  CAN3_Rr_MCU2Chksum: uint8
  CAN3_Rr_MCU2RolCnt: uint8
  CAN3_Rr_MCUTempWarn: uint8
  CAN3_Rr_TMTempWarn: uint8

DT_CAN3_SG_Shifter1 = Simulink.Bus(HeaderFile="Rte_Type.h")
  CAN3_Shifter_CRC8: uint8
  CAN3_Shifter_Fail_sta: uint8
  CAN3_Shifter_Handle_Cmd: uint8
  CAN3_Shifter_RC: uint8

DT_CAN4_SG_DKC1 = Simulink.Bus(HeaderFile="Rte_Type.h")
  CAN4_DKC_P_BLE_RSSI: uint8
  CAN4_DKC_P_UID_BatVolt: uint16
  CAN4_DKC_Re_VehData: uint8
  CAN4_DKC_Remote_PW: uint8
  CAN4_P_CommandToBCM: uint8
  CAN4_P_CommandToPTG: uint8
  CAN4_P_DKey_Area_LockUnlock: uint8
  CAN4_P_DKey_Area_PS: uint8
  CAN4_P_DKey_Area_PTG: uint8
  CAN4_P_DKey_Welcome: uint8
  CAN4_P_Dkey_Show_IVI: uint8
  CAN4_P_KeyMiss: uint8
  CAN4_P_KeyMode: uint8
  CAN4_P_UID_LowPower: uint8

uint64 = Simulink.NumericType(DataTypeMode="Fixed-point: binary point scaling", SignednessBool=false, WordLength=31, FixedExponent=0, HeaderFile="Rte_Type.h")

DT_CAN4_SG_DKC2 = Simulink.Bus(HeaderFile="Rte_Type.h")
  CAN4_EncryptionDATA_0_63: uint64
  CAN4_EncryptionDATA_64_127: uint64
  CAN4_Random_Number_X: uint64

DT_CAN4_SG_GW_ZDR_PTG1 = Simulink.Bus(HeaderFile="Rte_Type.h")
  CAN4_PTG_Active_Sta: uint8
  CAN4_PTG_AutoStaus: uint8
  CAN4_PTG_Cinch_Current: uint8
  CAN4_PTG_Exist: uint8
  CAN4_PTG_Full_Lock: uint8
  CAN4_PTG_HW_Ver: uint8
  CAN4_PTG_Half_Lock: uint8
  CAN4_PTG_Inner_SW_1: uint8
  CAN4_PTG_Is_Set_Height: uint8
  CAN4_PTG_Open_Ratio: uint8
  CAN4_PTG_RDIL_Sta: uint8
  CAN4_PTG_SW_Ver: uint8
  CAN4_PTG_Strut_Current: uint8
  CAN4_PTG_Sys_Sta: uint8
  CAN4_PTG_Warning_Sta: uint8

DT_CAN4_SG_GW_ZoneDR1 = Simulink.Bus(HeaderFile="Rte_Type.h")
  CAN4_AllLockSta: uint8
  CAN4_AutoLightSW: uint8
  CAN4_BrakeLampFail: uint8
  CAN4_CSW_DimSw: uint8
  CAN4_CSW_FWasSw_Sta: uint8
  CAN4_CSW_FWipSw_Sta: uint8
  CAN4_CSW_HW_version: uint16
  CAN4_CSW_PassSW_Sta: uint8
  CAN4_CSW_RWasSW_Sta: uint8
  CAN4_CSW_RWipIntSw_Sta: uint8
  CAN4_CSW_SW_version: uint16
  CAN4_CSW_TurnSw_Sta: uint8
  CAN4_CSW_resp_error: uint8
  CAN4_DrLockSta: uint8
  CAN4_HornSW: uint8
  CAN4_MIRROR_FOLD_SW: uint8
  CAN4_PsLockSta: uint8
  CAN4_RLLockSta: uint8
  CAN4_RLS_Exist: uint8
  CAN4_RLS_LIN_Resp_Err: uint8
  CAN4_RLS_Lamp_Sta: uint8
  CAN4_RLS_LightSnrErr: uint8
  CAN4_RLS_RainSnrErr: uint8
  CAN4_RLS_RainSnrWiperCmd: uint8
  CAN4_RLTurnLampC: uint8
  CAN4_RRLockSta: uint8
  CAN4_RRTurnLampC: uint8
  CAN4_RWiperAS: uint8
  CAN4_RWiperProtection: uint8
  CAN4_Wip_Speed: uint8
  CAN4_WiperSWPos: uint8
  CAN4_WiperZeroPosSW: uint8

DT_CAN4_SG_GW_ZoneDR2 = Simulink.Bus(HeaderFile="Rte_Type.h")
  CAN4_SWC_ACC_Sta: uint8
  CAN4_SWC_A_HW_version: uint16
  CAN4_SWC_A_Resp_Err: uint8
  CAN4_SWC_A_SW_version: uint16
  CAN4_SWC_CANCEL_Sta: uint8
  CAN4_SWC_Distance_Sta: uint8
  CAN4_SWC_Down_Sta: uint8
  CAN4_SWC_Drivemode_Sta: uint8
  CAN4_SWC_LKA_Sta: uint8
  CAN4_SWC_Left_Sta: uint8
  CAN4_SWC_RegenDown: uint8
  CAN4_SWC_RegenUp: uint8
  CAN4_SWC_Res_Up_Sta: uint8
  CAN4_SWC_Right_Sta: uint8
  CAN4_SWC_Set_down_Sta: uint8
  CAN4_SWC_Trip_Sta: uint8
  CAN4_SWC_Undefined_Sta: uint8
  CAN4_SWC_Up_Sta: uint8
  CAN4_SWC_VR_Sta: uint8
  CAN4_SWC_mode_Sta: uint8
  CAN4_SWC_resp_error: uint8

DT_CAN4_SG_GW_ZoneDR3 = Simulink.Bus(HeaderFile="Rte_Type.h")
  CAN4_FAPWL_01_LIN_Response_Error: uint8
  CAN4_L_APM_IntellectClose: uint8
  CAN4_L_Drv_Motor_Relay_Error: uint8
  CAN4_L_Drv_Motor_Ripple_Error: uint8
  CAN4_L_Drv_OverHeat_Protect: uint8
  CAN4_L_Drv_Val_Wdw_Opened: uint8
  CAN4_L_Drv_Wdw_Init: uint8
  CAN4_L_Drv_Wdw_LocalSwitch: uint8
  CAN4_L_Drv_Wdw_OD_Sts: uint8
  CAN4_L_Drv_Wdw_Obs_InhibitSts: uint8
  CAN4_L_Drv_Wdw_Pas_Switch: uint8
  CAN4_L_Drv_Wdw_PositionSts: uint8
  CAN4_L_Drv_Wdw_RLD_Switch: uint8
  CAN4_L_Drv_Wdw_RRD_Switch: uint8
  CAN4_L_Drv_Wdw_Running_Sts: uint8
  CAN4_L_Pas_Motor_Relay_Error: uint8
  CAN4_L_Pas_Motor_Ripple_Error: uint8
  CAN4_L_Pas_OverHeat_Protect: uint8
  CAN4_L_Pas_Val_Wdw_Opened: uint8
  CAN4_L_Pas_Wdw_Init: uint8
  CAN4_L_Pas_Wdw_LocalSwitch: uint8
  CAN4_L_Pas_Wdw_OD_Sts: uint8
  CAN4_L_Pas_Wdw_Obs_InhibitSts: uint8
  CAN4_L_Pas_Wdw_PositionSts: uint8
  CAN4_L_Pas_Wdw_Running_Sts: uint8
  CAN4_L_Power_Status: uint8

DT_CAN4_SG_GW_ZoneDR4 = Simulink.Bus(HeaderFile="Rte_Type.h")
  CAN4_L_RLD_Motor_Relay_Error: uint8
  CAN4_L_RLD_Motor_Ripple_Error: uint8
  CAN4_L_RLD_OverHeat_Protect: uint8
  CAN4_L_RLD_Val_Wdw_Opened: uint8
  CAN4_L_RLD_Wdw_Init: uint8
  CAN4_L_RLD_Wdw_LocalSwitch: uint8
  CAN4_L_RLD_Wdw_OD_Sts: uint8
  CAN4_L_RLD_Wdw_Obs_InhibitSts: uint8
  CAN4_L_RLD_Wdw_PositionSts: uint8
  CAN4_L_RLD_Wdw_Running_Sts: uint8
  CAN4_L_RRD_Motor_Relay_Error: uint8
  CAN4_L_RRD_Motor_Ripple_Error: uint8
  CAN4_L_RRD_OverHeat_Protect: uint8
  CAN4_L_RRD_Val_Wdw_Opened: uint8
  CAN4_L_RRD_Wdw_Init: uint8
  CAN4_L_RRD_Wdw_LocalSwitch: uint8
  CAN4_L_RRD_Wdw_OD_Sts: uint8
  CAN4_L_RRD_Wdw_Obs_InhibitSts: uint8
  CAN4_L_RRD_Wdw_PositionSts: uint8
  CAN4_L_RRD_Wdw_Running_Sts: uint8
  CAN4_PTG_Inner_SW_2: uint8
  CAN4_RAPWL_01_LIN_Response_Error: uint8

DT_CAN4_SG_GW_ZoneDR6 = Simulink.Bus(HeaderFile="Rte_Type.h")
  CAN4_FrntPTCBusLineHiV: uint16
  CAN4_FrntPTCComFlt: uint8
  CAN4_FrntPTCFltSt: uint8
  CAN4_FrntPTCHVOverUFlt: uint8
  CAN4_FrntPTCHVUnderUFlt: uint8
  CAN4_FrntPTCHWVers: uint8
  CAN4_FrntPTCLVOverUFlt: uint8
  CAN4_FrntPTCLVUnderUFlt: uint8
  CAN4_FrntPTCLeActHeatPwr: uint8
  CAN4_FrntPTCLeBusLineC: uint8
  CAN4_FrntPTCLeCoreOverTFlt: uint8
  CAN4_FrntPTCLeCoreT: uint8
  CAN4_FrntPTCLeCoreTSnsrFlt: uint8
  CAN4_FrntPTCLeIGBTOverTFlt: uint8
  CAN4_FrntPTCLeIGBTShoCircFlt: uint8
  CAN4_FrntPTCLeIGBTT: uint8
  CAN4_FrntPTCLeIGBTTSnsrFlt: uint8
  CAN4_FrntPTCLeOpentCircFlt: uint8
  CAN4_FrntPTCLeOverAFlt: uint8
  CAN4_FrntPTCPCBOverTFlt: uint8
  CAN4_FrntPTCPCBT: uint8
  CAN4_FrntPTCPCBTSnsrFlt: uint8
  CAN4_FrntPTCRearLeActHeatPwr: uint8
  CAN4_FrntPTCRearLeBusLineC: uint8
  CAN4_FrntPTCRearLeCoreOverTFlt: uint8
  CAN4_FrntPTCRearLeCoreT: uint8
  CAN4_FrntPTCRearLeCoreTSnsrFlt: uint8
  CAN4_FrntPTCRearLeIGBTShoCFlt: uint8
  CAN4_FrntPTCRearLeOpentCircFlt: uint8
  CAN4_FrntPTCRearLeOverAFlt: uint8
  CAN4_FrntPTCRearRiActHeatPwr: uint8
  CAN4_FrntPTCRearRiBusLineC: uint8
  CAN4_FrntPTCRearRiCoreOverTFlt: uint8
  CAN4_FrntPTCRearRiCoreT: uint8
  CAN4_FrntPTCRearRiCoreTSnsrFlt: uint8
  CAN4_FrntPTCRearRiIGBTShoCFlt: uint8
  CAN4_FrntPTCRearRiOpentCircFlt: uint8
  CAN4_FrntPTCRearRiOverAFlt: uint8
  CAN4_FrntPTCRiActHeatPwr: uint8
  CAN4_FrntPTCRiBusLineC: uint8
  CAN4_FrntPTCRiCoreOverTFlt: uint8
  CAN4_FrntPTCRiCoreT: uint8
  CAN4_FrntPTCRiCoreTSnsrFlt: uint8
  CAN4_FrntPTCRiIGBTOverTFlt: uint8
  CAN4_FrntPTCRiIGBTShoCircFlt: uint8
  CAN4_FrntPTCRiIGBTT: uint8
  CAN4_FrntPTCRiIGBTTSnsrFlt: uint8
  CAN4_FrntPTCRiOpentCircFlt: uint8
  CAN4_FrntPTCRiOverAFlt: uint8
  CAN4_FrntPTCSWVers: uint8
  CAN4_FrntPTCSts: uint8
  CAN4_FrntPTCSupplierCod: uint8

DT_CAN4_SG_GW_ZoneFR1 = Simulink.Bus(HeaderFile="Rte_Type.h")
  CAN4_AGS_Actual_Position: uint8
  CAN4_AGS_Actuator_Blocked: uint8
  CAN4_AGS_Actuator_Fault: uint8
  CAN4_AGS_Calibration_Active: uint8
  CAN4_AGS_Calibration_Enabled: uint8
  CAN4_AGS_Calibration_Indicated: uint8
  CAN4_AGS_Electrical_Error: uint8
  CAN4_AGS_LINResponse_Error: uint8
  CAN4_AGS_Low_Voltage_Error: uint8
  CAN4_AGS_Position_Request: uint8
  CAN4_AGS_Sensor_Error: uint8
  CAN4_AGS_Temperature_Error: uint8
  CAN4_BDC_1_MoveEnable: uint8
  CAN4_BDC_1_ReqMovePos: uint8
  CAN4_CCV4_MoveEnable: uint8
  CAN4_CCV4_ReqMovePos: uint8
  CAN4_ChargeInletLockSta: uint8
  CAN4_EWP1_Default_Operation_EWP_Rq: uint8
  CAN4_EWP1_RPM_Target_EWP_Rq: uint8
  CAN4_EWP2_Default_Operation_EWP_Rq: uint8
  CAN4_EWP2_RPM_Target_EWP_Rq: uint8
  CAN4_EWP3_Default_Operation_EWP_Rq: uint8
  CAN4_EWP3_RPM_Target_EWP_Rq: uint8
  CAN4_EXV2_Cmd_Init_Rq: uint8
  CAN4_EXV2_Cmd_Move_Enbl: uint8
  CAN4_EXV2_Cmd_Set_Rq: uint16
  CAN4_EXV_Cmd_Init_Rq: uint8
  CAN4_EXV_Cmd_Move_Enbl: uint8
  CAN4_EXV_Cmd_Set_Rq: uint16
  CAN4_FLTurnLampC: uint8
  CAN4_FRTurnLampC: uint8
  CAN4_FWiperAS: uint8
  CAN4_FWiperProtection: uint8

DT_CAN4_SG_GW_ZoneFR2 = Simulink.Bus(HeaderFile="Rte_Type.h")
  CAN4_BMSPackVol_h6HSC6: uint16
  CAN4_CCM_SpdCmd: uint16
  CAN4_COMP_ComLost: uint8
  CAN4_COMP_ConCur: uint16
  CAN4_COMP_ConVolt: uint16
  CAN4_COMP_CtrlCircFlt: uint8
  CAN4_COMP_CurOverProtect: uint8
  CAN4_COMP_CurVaild: uint8
  CAN4_COMP_IPM_HWFLt: uint8
  CAN4_COMP_IPM_TempOverFlt: uint8
  CAN4_COMP_Init: uint8
  CAN4_COMP_SpdVaild: uint8
  CAN4_COMP_Sta: uint8
  CAN4_COMP_StatorSpd: uint16
  CAN4_COMP_VoltLessErr: uint8
  CAN4_COMP_VoltOverErr: uint8
  CAN4_COMP_VoltVaild: uint8
  CAN4_CompProEN: uint8
  CAN4_EAC_DrvVoltFalt: uint8
  CAN4_EAC_MotCrt: uint8
  CAN4_EAC_MotorLackFalt: uint8
  CAN4_EAC_OvLoadFalt: uint8
  CAN4_EAC_Temp: uint8
  CAN4_EAC_TempSnsrFalt: uint8
  CAN4_PTCActuCrntHSC6: uint16
  CAN4_PTCActuPWMDutyHSC6: uint8
  CAN4_PTCActuVolHSC6: uint16
  CAN4_PTCChksmHSC6: uint8
  CAN4_PTCFltLvlHSC6: uint8
  CAN4_PTCHVLckStsHSC6: uint8
  CAN4_PTCIGBTOverHeatHSC6: uint8
  CAN4_PTCIGBTStsHSC6: uint8
  CAN4_PTCIGBTTemHSC6: uint16
  CAN4_PTCNTCStsHSC6: uint8
  CAN4_PTCOtptTemHSC6: uint16
  CAN4_PTCOverCrntHSC6: uint8
  CAN4_PTCOverHeatHSC6: uint8
  CAN4_PTCOverVolHSC6: uint8
  CAN4_PTCPCBTemHSC6: uint16
  CAN4_PTCRlngCtrHSC6: uint8
  CAN4_PTCSecChksmHSC6: uint8
  CAN4_PTCSecRlngCtrHSC6: uint8
  CAN4_PTCStsHSC6: uint8
  CAN4_PTCUnderVolHSC6: uint8

DT_CAN4_SG_Zone_Dr_SCP = Simulink.Bus(HeaderFile="Rte_Type.h")
  CAN4_DrSCPSysErrLmp: uint8
  CAN4_RegenMode: uint8
  CAN4_Set_Spd: uint8
  CAN4_Zone_Spd_Ctrl_Mode: uint8
  CAN4_Zone_Spd_Ctrl_Sta: uint8

DT_CAN4_SG_Zone_Dr_THCM = Simulink.Bus(HeaderFile="Rte_Type.h")
  CAN4_APTC_Err: uint8
  CAN4_Blower_Err: uint8
  CAN4_Blower_FB: uint8
  CAN4_SolarL: uint8
  CAN4_SolarL_Err: uint8
  CAN4_SolarR: uint8
  CAN4_SolarR_Err: uint8
  CAN4_T_Face_L: uint8
  CAN4_T_Face_L_Err: uint8
  CAN4_T_Face_R: uint8
  CAN4_T_Face_R_Err: uint8
  CAN4_T_Face_Rr: uint8
  CAN4_T_Face_Rr_Err: uint8
  CAN4_T_Foot_L: uint8
  CAN4_T_Foot_L_Err: uint8
  CAN4_T_Foot_R: uint8
  CAN4_T_Foot_R_Err: uint8
  CAN4_T_Foot_Rr: uint8
  CAN4_T_Foot_Rr_Err: uint8
  CAN4_Tevap: uint8
  CAN4_Tevap_Err: uint8
  CAN4_Tincar: uint8
  CAN4_Tincar_Err: uint8
  CAN4_ZDR_THCM_IntakeFail_Sta: uint8
  CAN4_ZDR_THCM_LINACT1_Sta: uint8
  CAN4_ZDR_THCM_LINACT2_Sta: uint8
  CAN4_ZDR_THCM_LINACT3_Sta: uint8
  CAN4_ZDR_THCM_LINACT4_Sta: uint8
  CAN4_ZDR_THCM_LINACT5_Sta: uint8
  CAN4_ZDR_THCM_ModeFail_Sta: uint8

DT_CAN4_SG_Zone_Dr_VCU = Simulink.Bus(HeaderFile="Rte_Type.h")
  CAN4_DrAPWLINErr: uint8
  CAN4_DrAPWStaErr: uint8
  CAN4_DrAuBoxPwrN1Curr: uint8
  CAN4_DrAuBoxPwrN2Curr: uint8
  CAN4_DrColumnSWFault: uint8
  CAN4_DrCtrlBDVolt: uint16
  CAN4_DrCtrlTemp: uint16
  CAN4_DrEOBDFault: uint8
  CAN4_DrIVIFault: uint8
  CAN4_DrInfoErrSta: uint8
  CAN4_DrInfoFault: uint8
  CAN4_DrONA1ErrSta: uint8
  CAN4_DrPMMLVOutPErrLmp: uint8
  CAN4_DrPMMLimpHomeActReq: uint8
  CAN4_DrPMMSysErrLmp: uint8
  CAN4_DrPowerTemp1: uint16
  CAN4_DrPowerTemp2: uint16
  CAN4_DrPwrInformationSta: uint8
  CAN4_DrPwrONA1Curr: uint8
  CAN4_DrPwrONA2Curr: uint8
  CAN4_DrPwrSta: uint8
  CAN4_DrPwrStdbyACurr: uint8
  CAN4_DrPwrWinErrSta: uint8
  CAN4_DrPwrWindowECUFault: uint8
  CAN4_DrStdAErrSta: uint8
  CAN4_DrTHCMFault: uint8
  CAN4_ZDR_SYS_APMRetryCnt_Sta: uint8
  CAN4_ZDR_SYS_BSWSleepReq_Sta: uint8
  CAN4_ZDR_SYS_CSWRetryCnt_Sta: uint8
  CAN4_ZDR_VCU_HWReset_Sta: uint8
  CAN4_ZDR_VCU_PwrSupply_Sta: uint8
  CAN4_ZoneDrMalfunLevel: uint8

DT_CAN4_SG_Zone_Fr_THCM = Simulink.Bus(HeaderFile="Rte_Type.h")
  CAN4_AGS_Err: uint8
  CAN4_Bat_In_Temp: uint8
  CAN4_Bat_In_Temp_Err: uint8
  CAN4_Bat_Out_Temp: uint8
  CAN4_Bat_Out_Temp_Err: uint8
  CAN4_COMP_Err: uint8
  CAN4_EACProtectEnable: uint8
  CAN4_EWP1_Err: uint8
  CAN4_EWP2_Err: uint8
  CAN4_EWP3_Err: uint8
  CAN4_EXV1_Err: uint8
  CAN4_EXV2_Err: uint8
  CAN4_FWV_Err: uint8
  CAN4_Fan_Err: uint8
  CAN4_Motor_In_Temp: uint8
  CAN4_Motor_In_Temp_Err: uint8
  CAN4_Motor_Out_Temp: uint8
  CAN4_Motor_Out_Temp_Err: uint8
  CAN4_PT_High_P: uint16
  CAN4_PT_High_P_Err: uint8
  CAN4_PT_High_T: uint8
  CAN4_PT_High_Tact: uint8
  CAN4_PT_High_Tact_Err: uint8
  CAN4_PT_Low_P1: uint16
  CAN4_PT_Low_P1_Err: uint8
  CAN4_PT_Low_P2: uint16
  CAN4_PT_Low_P2_Err: uint8
  CAN4_PT_Low_T1: uint8
  CAN4_PT_Low_T1_Err: uint8
  CAN4_PT_Low_T2: uint8
  CAN4_PT_Low_T2_Err: uint8
  CAN4_SOTXV_Err: uint8
  CAN4_SOV1_Err: uint8
  CAN4_SOV2_Err: uint8
  CAN4_SOV3_Err: uint8
  CAN4_TWV_Err: uint8
  CAN4_Tamb: uint8
  CAN4_Tamb_Err: uint8
  CAN4_WPTC_Err: uint8

DT_CAN5_SG_TBOX1 = Simulink.Bus(HeaderFile="Rte_Type.h")
  CAN5_Antitheft_Zero: uint8
  CAN5_CbnPreACEnaReq: uint8
  CAN5_CbnPreReq: uint8
  CAN5_CbnPreTarT: uint8
  CAN5_PowerOff_T_Set: uint8
  CAN5_ReOutsideMirror: uint8
  CAN5_Re_DoorLock: uint16
  CAN5_Re_PwrReqTbox: uint8
  CAN5_Re_Radio: uint8
  CAN5_Remote_ACTemp: uint8
  CAN5_Remote_AutoReq: uint8
  CAN5_Remote_MidAutoReq: uint8
  CAN5_TBOX_NET_SIG_STR: uint8
  CAN5_TBOX_Re_DTCData: uint8
  CAN5_TBOX_Re_VehData: uint8
  CAN5_TBOX_RemoteOn: uint8
  CAN5_TBOX_Remote_PW: uint8
  CAN5_TBOX_TEST_STATUS: uint8
  CAN5_Uncounting_Req: uint8

DT_CAN1_SG_FD_BCM1 = Simulink.Bus(HeaderFile="Rte_Type.h")
  CAN1_AllDoorSW: uint8
  CAN1_AntiTheftSeatFold: uint8
  CAN1_AntitheftSta: uint8
  CAN1_BCM_Buzzer_Req: uint8
  CAN1_BCM_DoorLock_Sta: uint8
  CAN1_BrakeLamp: uint8
  CAN1_CTDCtrl: uint8
  CAN1_CTDLockSW: uint8
  CAN1_CTDUnlockSW: uint8
  CAN1_CrashDetd: uint8
  CAN1_Dimmer: uint8
  CAN1_DimmerEN: uint8
  CAN1_DoorLockIND: uint8
  CAN1_DrDoorSW: uint8
  CAN1_Fr_ChargingDoorCtrl: uint8
  CAN1_Fr_FogLamp: uint8
  CAN1_Fr_Wiper_H: uint8
  CAN1_Fr_Wiper_L: uint8
  CAN1_H_Beam: uint8
  CAN1_HazardSW: uint8
  CAN1_HoodSW: uint8
  CAN1_HornCtrl: uint8
  CAN1_LBSD: uint8
  CAN1_LDRL: uint8
  CAN1_LTurnLP: uint8
  CAN1_L_APM_WdwEnable: uint8
  CAN1_L_Beam: uint8
  CAN1_LockSetting: uint8
  CAN1_MirrorCtrl: uint8
  CAN1_MirrorDefog: uint8
  CAN1_PosLamp: uint8
  CAN1_PsDoorSW: uint8
  CAN1_RBSD: uint8
  CAN1_RDRL: uint8
  CAN1_RLDoorSW: uint8
  CAN1_RRDoorSW: uint8
  CAN1_RTurnLP: uint8
  CAN1_ReverseLamp: uint8
  CAN1_RoomLampH: uint8
  CAN1_RoomLampL: uint8
  CAN1_Rr_ChargingDoorCtrl: uint8
  CAN1_Rr_Defog: uint8
  CAN1_Rr_FogLamp: uint8
  CAN1_Rr_Wiper: uint8
  CAN1_TailgateHDSW: uint8
  CAN1_TailgateRemote: uint8
  CAN1_Tailgate_SW: uint8
  CAN1_TrunkRel: uint8
  CAN1_WasherCtrl: uint8
  CAN1_WiperFixMode: uint8

DT_CAN1_SG_FD_VCU1 = Simulink.Bus(HeaderFile="Rte_Type.h")
  CAN1_CC_Crl_Sta: uint8
  CAN1_HVPwrSta: uint8
  CAN1_LVPwrSta: uint8
  CAN1_MSA_Crl_Sta: uint8
  CAN1_P_Button_Sta: uint8
  CAN1_PrkReq: uint8
  CAN1_PrkReqValid: uint8
  CAN1_PwrSta: uint8
  CAN1_ShiftGearPosn: uint8
  CAN1_XWDMode: uint8

DT_CAN1_SG_FD_VCU4 = Simulink.Bus(HeaderFile="Rte_Type.h")
  CAN1_Eng_AGSCloseSta: uint8
  CAN1_Eng_ActvDmpDisabSta: uint8
  CAN1_Eng_CoastDwSta: uint8
  CAN1_Eng_PwrLockSta: uint8
  CAN1_VehMalfunLevel: uint8

DT_CAN2_SG_FD_BCM1 = Simulink.Bus(HeaderFile="Rte_Type.h")
  CAN2_APMDoorControlSta: uint8
  CAN2_AllDoorSW: uint8
  CAN2_AntiTheftSeatFold: uint8
  CAN2_AntitheftSta: uint8
  CAN2_BCM_Buzzer_Req: uint8
  CAN2_BCM_DoorLock_Sta: uint8
  CAN2_BrakeLamp: uint8
  CAN2_CTDCtrl: uint8
  CAN2_CTDLockSW: uint8
  CAN2_CTDUnlockSW: uint8
  CAN2_CrashDetd: uint8
  CAN2_Dimmer: uint8
  CAN2_DimmerEN: uint8
  CAN2_DoorLockIND: uint8
  CAN2_DrDoorSW: uint8
  CAN2_FDC_BCM_LockAlarm_Cmd: uint8
  CAN2_FDC_THCM_APTCWarning_Sta: uint8
  CAN2_FollowMe: uint8
  CAN2_Fr_ChargingDoorCtrl: uint8
  CAN2_Fr_FogLamp: uint8
  CAN2_Fr_Wiper_H: uint8
  CAN2_Fr_Wiper_L: uint8
  CAN2_H_Beam: uint8
  CAN2_HazardSW: uint8
  CAN2_HoodSW: uint8
  CAN2_HornCtrl: uint8
  CAN2_LBSD: uint8
  CAN2_LDRL: uint8
  CAN2_LTurnLP: uint8
  CAN2_L_APM_WdwEnable: uint8
  CAN2_L_Beam: uint8
  CAN2_LockSetting: uint8
  CAN2_MirrorCtrl: uint8
  CAN2_MirrorDefog: uint8
  CAN2_PosLamp: uint8
  CAN2_PsDoorSW: uint8
  CAN2_RBSD: uint8
  CAN2_RDRL: uint8
  CAN2_RLDoorSW: uint8
  CAN2_RRDoorSW: uint8
  CAN2_RTurnLP: uint8
  CAN2_ReverseLamp: uint8
  CAN2_RoomLampH: uint8
  CAN2_RoomLampL: uint8
  CAN2_Rr_ChargingDoorCtrl: uint8
  CAN2_Rr_Defog: uint8
  CAN2_Rr_FogLamp: uint8
  CAN2_Rr_Wiper: uint8
  CAN2_TailgateHDSW: uint8
  CAN2_TailgateRemote: uint8
  CAN2_Tailgate_SW: uint8
  CAN2_TrunkRel: uint8
  CAN2_WasherCtrl: uint8
  CAN2_WiperFixMode: uint8

DT_CAN2_SG_FD_BCM2 = Simulink.Bus(HeaderFile="Rte_Type.h")
  CAN2_AmbLightBreath1: uint8
  CAN2_AmbLightBreath2: uint8
  CAN2_AmbLightBreath3: uint8
  CAN2_AmbLightBrightness1: uint8
  CAN2_AmbLightBrightness2: uint8
  CAN2_AmbLightBrightness3: uint8
  CAN2_AmbLightColor1: uint8
  CAN2_AmbLightColor2: uint8
  CAN2_AmbLightColor3: uint8
  CAN2_LampPwr: uint8
  CAN2_User1AmbLightColor: uint8
  CAN2_User1DrAmbLightBrightness: uint8
  CAN2_User1IPAmbLightBrightness: uint8
  CAN2_User2AmbLightColor: uint8
  CAN2_User2DrAmbLightBrightness: uint8
  CAN2_User2IPAmbLightBrightness: uint8
  CAN2_User3AmbLightColor: uint8
  CAN2_User3DrAmbLightBrightness: uint8
  CAN2_User3IPAmbLightBrightness: uint8
  CAN2_User4AmbLightColor: uint8
  CAN2_User4DrAmbLightBrightness: uint8
  CAN2_User4IPAmbLightBrightness: uint8
  CAN2_User5AmbLightColor: uint8
  CAN2_User5DrAmbLightBrightness: uint8
  CAN2_User5IPAmbLightBrightness: uint8
  CAN2_User6AmbLightColor: uint8
  CAN2_User6DrAmbLightBrightness: uint8
  CAN2_User6IPAmbLightBrightness: uint8

DT_CAN2_SG_FD_TPMS1 = Simulink.Bus(HeaderFile="Rte_Type.h")
  CAN2_AutoLTips: uint8
  CAN2_CWheelTips: uint8
  CAN2_LFBatWarn: uint8
  CAN2_LFPressIndi: uint8
  CAN2_LFSensorFail: uint8
  CAN2_LFSensorMode: uint8
  CAN2_LFWheelDebug: uint8
  CAN2_LFWheelPSW: uint8
  CAN2_LFWheelPress: uint8
  CAN2_LFWheelTemp: uint8
  CAN2_LFWheelTmpIndi: uint8
  CAN2_LRBatWarn: uint8
  CAN2_LRPressIndi: uint8
  CAN2_LRSensorFail: uint8
  CAN2_LRSensorMode: uint8
  CAN2_LRWheelDebug: uint8
  CAN2_LRWheelPSW: uint8
  CAN2_LRWheelPress: uint8
  CAN2_LRWheelTemp: uint8
  CAN2_LRWheelTmpIndi: uint8
  CAN2_RFBatWarn: uint8
  CAN2_RFPressIndi: uint8
  CAN2_RFSensorFail: uint8
  CAN2_RFSensorMode: uint8
  CAN2_RFWheelDebug: uint8
  CAN2_RFWheelPSW: uint8
  CAN2_RFWheelPress: uint8
  CAN2_RFWheelTemp: uint8
  CAN2_RFWheelTmpIndi: uint8
  CAN2_RRBatWarn: uint8
  CAN2_RRPressIndi: uint8
  CAN2_RRSensorFail: uint8
  CAN2_RRSensorMode: uint8
  CAN2_RRWheelDebug: uint8
  CAN2_RRWheelPSW: uint8
  CAN2_RRWheelPress: uint8
  CAN2_RRWheelTemp: uint8
  CAN2_RRWheelTmpIndi: uint8
  CAN2_TPMSWarnIndi: uint8
  CAN2_TPMS_Cali_Butt_Allow: uint8
  CAN2_TPMS_Res_Butt_Allow: uint8

DT_CAN2_SG_FD_TPMS2 = Simulink.Bus(HeaderFile="Rte_Type.h")
  CAN2_ID1_ALTU: uint32
  CAN2_ID1_Loc_ALTU: uint8
  CAN2_ID1_message_ALTU: uint8
  CAN2_ID2_ALTU: uint32
  CAN2_ID2_Loc_ALTU: uint8
  CAN2_ID2_message_ALTU: uint8
  CAN2_ID3_ALTU: uint32
  CAN2_ID3_Loc_ALTU: uint8
  CAN2_ID3_message_ALTU: uint8
  CAN2_ID4_ALTU: uint32
  CAN2_ID4_Loc_ALTU: uint8
  CAN2_ID4_message_ALTU: uint8
  CAN2_IDin_ALTU: uint32
  CAN2_RF_FAT_ALTU: uint8
  CAN2_S1WheelDebug_ALTU: uint8
  CAN2_S2WheelDebug_ALTU: uint8
  CAN2_S3WheelDebug_ALTU: uint8
  CAN2_S4WheelDebug_ALTU: uint8

DT_CAN2_SG_FD_V2L1 = Simulink.Bus(HeaderFile="Rte_Type.h")
  CAN2_Req_OBCV2LEna: uint8
  CAN2_Req_V2LSwOn: uint8
  CAN2_Req_V2L_IVI_Popup: uint8

DT_CAN2_SG_FD_VCU0 = Simulink.Bus(HeaderFile="Rte_Type.h")
  CAN2_EVCCAplusPwrUpReq: uint8
  CAN2_FDADC12VDetAvg: uint8
  CAN2_Fr_TqSource: uint8
  CAN2_HVRlyOpFail: uint8
  CAN2_HVTHCMSysAvail: uint8
  CAN2_LVBattChrgtimeAct: uint16
  CAN2_LVBattVoltSta: uint8
  CAN2_LVChrgHoldTAct: uint16
  CAN2_LVSilentChrgLv: uint8
  CAN2_LVSilentChrgReq: uint8
  CAN2_LVSilentChrgSta: uint8
  CAN2_MCUActDisFail: uint8
  CAN2_PMMAllowECUSleep: uint8
  CAN2_PowerDownFault: uint8
  CAN2_PowerDownState: uint8
  CAN2_PowerUpFault: uint8
  CAN2_PowerUpState: uint8
  CAN2_PwrDownReq: uint8
  CAN2_PwrStaConstraint: uint8
  CAN2_PwrStaONTOIVIPopReq: uint8
  CAN2_PwrStaONTOIVIPopT: uint16
  CAN2_PwrStaSelect: uint8
  CAN2_PwrStaTOSta: uint8
  CAN2_PwrUpReq: uint8
  CAN2_Rr_TqSource: uint8
  CAN2_SchedChgTOSta: uint8
  CAN2_SilentChkAllowSleep: uint8
  CAN2_SysAllowReadySta: uint8
  CAN2_SysPwrSta: uint8
  CAN2_TCountSta: uint8
  CAN2_TimerAllowSleep: uint8
  CAN2_VCUBrkSWSta: uint8
  CAN2_VCUFLDoorSta: uint8
  CAN2_VCUFRDoorSta: uint8
  CAN2_VCUHoodSWSta: uint8
  CAN2_VCURLDoorSta: uint8
  CAN2_VCURRDoorSta: uint8
  CAN2_VCUTailgateSWSta: uint8
  CAN2_VehHVPwrAvail4THCM: uint8

DT_CAN2_SG_FD_VCU1 = Simulink.Bus(HeaderFile="Rte_Type.h")
  CAN2_ActiveDischReq: uint8
  CAN2_CC_Crl_Sta: uint8
  CAN2_CS_VCU1_CAN2: uint8
  CAN2_CoastDwModeStaChk: uint8
  CAN2_CreepSW_Sta: uint8
  CAN2_DCDCEnaReq: uint8
  CAN2_DCDCVoltSetpoint: uint8
  CAN2_DemoModeStaChk: uint8
  CAN2_DisengageP_Fail: uint8
  CAN2_Dr_SeatSta: uint8
  CAN2_DynoModeStaChk: uint8
  CAN2_EngageP_Fail: uint8
  CAN2_FDC_VCU_PwrSaveReq_Cmd: uint8
  CAN2_FalseNPrevent_Sta: uint8
  CAN2_Fr_ActvDmpDisabReq: uint8
  CAN2_Fr_MCUEnaReq: uint8
  CAN2_HVBatCnctReq: uint8
  CAN2_HVSysReadyToCharge: uint8
  CAN2_LVChrgFuncStaChk: uint8
  CAN2_MSA_Crl_Sta: uint8
  CAN2_PrkReq: uint8
  CAN2_PwrSta: uint8
  CAN2_RC_VCU1_CAN2: uint8
  CAN2_Rr_ActvDmpDisabReq: uint8
  CAN2_Rr_MCUEnaReq: uint8
  CAN2_ShiftGearPosn: uint8
  CAN2_VCU_OPDHold: uint8
  CAN2_XWDMode: uint8

DT_CAN2_SG_FD_VCU4 = Simulink.Bus(HeaderFile="Rte_Type.h")
  CAN2_EVDriveMode: uint8
  CAN2_Eng_AGSCloseSta: uint8
  CAN2_Eng_ActvDmpDisabSta: uint8
  CAN2_Eng_CoastDwSta: uint8
  CAN2_Eng_PwrLockSta: uint8
  CAN2_VCU_ACCErr: uint8
  CAN2_VCU_ISAErr: uint8
  CAN2_VehMalfunLevel: uint8
  CAN2_ZoneDR_SCP_CommErr: uint8

DT_CAN2_SG_FD_VMC1 = Simulink.Bus(HeaderFile="Rte_Type.h")
  CAN2_CCMSA_SpdWar: uint8

DT_CAN3_SG_FD_BCM1 = Simulink.Bus(HeaderFile="Rte_Type.h")
  CAN3_AllDoorSW: uint8
  CAN3_AntiTheftSeatFold: uint8
  CAN3_AntitheftSta: uint8
  CAN3_BCM_Buzzer_Req: uint8
  CAN3_BCM_DoorLock_Sta: uint8
  CAN3_BrakeLamp: uint8
  CAN3_CTDCtrl: uint8
  CAN3_CTDLockSW: uint8
  CAN3_CTDUnlockSW: uint8
  CAN3_CrashDetd: uint8
  CAN3_Dimmer: uint8
  CAN3_DimmerEN: uint8
  CAN3_DoorLockIND: uint8
  CAN3_DrDoorSW: uint8
  CAN3_Fr_ChargingDoorCtrl: uint8
  CAN3_Fr_FogLamp: uint8
  CAN3_Fr_Wiper_H: uint8
  CAN3_Fr_Wiper_L: uint8
  CAN3_H_Beam: uint8
  CAN3_HazardSW: uint8
  CAN3_HoodSW: uint8
  CAN3_HornCtrl: uint8
  CAN3_LBSD: uint8
  CAN3_LDRL: uint8
  CAN3_LTurnLP: uint8
  CAN3_L_APM_WdwEnable: uint8
  CAN3_L_Beam: uint8
  CAN3_LockSetting: uint8
  CAN3_MirrorCtrl: uint8
  CAN3_MirrorDefog: uint8
  CAN3_PmicBootReason: uint8
  CAN3_PosLamp: uint8
  CAN3_PsDoorSW: uint8
  CAN3_RBSD: uint8
  CAN3_RDRL: uint8
  CAN3_RLDoorSW: uint8
  CAN3_RRDoorSW: uint8
  CAN3_RTurnLP: uint8
  CAN3_ReverseLamp: uint8
  CAN3_RoomLampH: uint8
  CAN3_RoomLampL: uint8
  CAN3_Rr_ChargingDoorCtrl: uint8
  CAN3_Rr_Defog: uint8
  CAN3_Rr_FogLamp: uint8
  CAN3_Rr_Wiper: uint8
  CAN3_TailgateHDSW: uint8
  CAN3_TailgateRemote: uint8
  CAN3_Tailgate_SW: uint8
  CAN3_TrunkRel: uint8
  CAN3_WasherCtrl: uint8
  CAN3_WiperFixMode: uint8
  CAN3_WisrBootReason: uint32

DT_CAN3_SG_FD_THCM2 = Simulink.Bus(HeaderFile="Rte_Type.h")
  CAN3_ACSubMode: uint8
  CAN3_APTC_ActFrRiPwr: uint8
  CAN3_BatLoopActWtFlw: uint8
  CAN3_CCU_CbnPreACWkSts: uint8
  CAN3_CCU_CbnPreEstimdTi: uint8
  CAN3_CCU_CbnPreSts: uint8
  CAN3_CCU_HiVoltageReq: uint8
  CAN3_CoolgFanActDuty: uint8
  CAN3_DeiceModReq: uint8
  CAN3_FD_Blower_Cmd: uint8
  CAN3_FD_Comp_Cmd: uint16
  CAN3_FD_EWP1_Cmd: uint8
  CAN3_FD_EWP2_Cmd: uint8
  CAN3_FD_EWP3_Cmd: uint8
  CAN3_FD_EXV1_Cmd: uint16
  CAN3_FD_EXV2_Cmd: uint16
  CAN3_FD_FWV_Cmd: uint8
  CAN3_FD_FrLeAPTCHeatPwr_Cmd: uint8
  CAN3_FD_FrRiAPTCHeatPwr_Cmd: uint8
  CAN3_FD_FrWPTCHeatPwr_Cmd: uint16
  CAN3_FD_RrAPTCHeatPwr_Cmd: uint8
  CAN3_FD_SOTXV_Cmd: uint8
  CAN3_FD_SOV1_Cmd: uint8
  CAN3_FD_SOV2_Cmd: uint8
  CAN3_FD_SOV3_Cmd: uint8
  CAN3_FD_TWV_Cmd: uint8

DT_CAN3_SG_FD_V2L1 = Simulink.Bus(HeaderFile="Rte_Type.h")
  CAN3_Req_OBCV2LEna: uint8
  CAN3_Req_V2LSwOn: uint8
  CAN3_Req_V2L_IVI_Popup: uint8

DT_CAN4_SG_FD_DKC1 = Simulink.Bus(HeaderFile="Rte_Type.h")
  CAN4_Approach_Unlock_SW: uint8
  CAN4_BrkPedalPos: uint8
  CAN4_BrkPedalPos_Sta: uint8
  CAN4_BrkSw_Sta: uint8
  CAN4_BrkSw_V: uint8
  CAN4_DSEAT_anti_set: uint8
  CAN4_DSEAT_entryfun_set: uint8
  CAN4_DSEAT_vent_req: uint8
  CAN4_FDC_BCM_ATCtrl_Cmd: uint8
  CAN4_FDC_BCM_LockAlarm_Cmd: uint8
  CAN4_FDC_BCM_OutMode_Cmd: uint8
  CAN4_FDC_THCM_ACTInitial_Cmd: uint8
  CAN4_HeadLampSW: uint8
  CAN4_Hood_Latch_SW: uint8
  CAN4_IVI_ISA_OffsetSpd: uint8
  CAN4_IVI_Located_STA: uint8
  CAN4_IVI_PTG_Mode_SW: uint8
  CAN4_IVI_PTG_Open_Height: uint8
  CAN4_IVI_PTG_Sta_SW: uint8
  CAN4_IVI_PTG_USSta_SW: uint8
  CAN4_IVI_Time_Check: uint8
  CAN4_IVI_Time_Day: uint8
  CAN4_IVI_Time_Hour: uint8
  CAN4_IVI_Time_Minute: uint8
  CAN4_IVI_Time_Month: uint8
  CAN4_IVI_Time_Second: uint8
  CAN4_IVI_Time_Year: uint8
  CAN4_L_Drv_CtrlCmd: uint8
  CAN4_L_Pas_CtrlCmd: uint8
  CAN4_L_RLD_CtrlCmd: uint8
  CAN4_L_RRD_CtrlCmd: uint8
  CAN4_MCPressure: uint16
  CAN4_MCPressure_V: uint8
  CAN4_OFF_AC_MODE: uint8
  CAN4_PSEAT_vent_req: uint8
  CAN4_PTG_Inner_SW2: uint8
  CAN4_SenstivityPosition: uint8
  CAN4_TurnSwTimeSet: uint8
  CAN4_Walkaway_Lock_SW: uint8

DT_CAN4_SG_FD_THCM2 = Simulink.Bus(HeaderFile="Rte_Type.h")
  CAN4_ACSubMode: uint8
  CAN4_APTC_ActFrRiPwr: uint8
  CAN4_BatLoopActWtFlw: uint8
  CAN4_CCU_CbnPreACWkSts: uint8
  CAN4_CCU_CbnPreEstimdTi: uint8
  CAN4_CCU_CbnPreSts: uint8
  CAN4_CCU_HiVoltageReq: uint8
  CAN4_CoolgFanActDuty: uint8
  CAN4_DeiceModReq: uint8
  CAN4_FD_Blower_Cmd: uint8
  CAN4_FD_Comp_Cmd: uint16
  CAN4_FD_EWP1_Cmd: uint8
  CAN4_FD_EWP2_Cmd: uint8
  CAN4_FD_EWP3_Cmd: uint8
  CAN4_FD_EXV1_Cmd: uint16
  CAN4_FD_EXV2_Cmd: uint16
  CAN4_FD_FWV_Cmd: uint8
  CAN4_FD_FrLeAPTCHeatPwr_Cmd: uint8
  CAN4_FD_FrRiAPTCHeatPwr_Cmd: uint8
  CAN4_FD_FrWPTCHeatPwr_Cmd: uint16
  CAN4_FD_RrAPTCHeatPwr_Cmd: uint8
  CAN4_FD_SOTXV_Cmd: uint8
  CAN4_FD_SOV1_Cmd: uint8
  CAN4_FD_SOV2_Cmd: uint8
  CAN4_FD_SOV3_Cmd: uint8
  CAN4_FD_TWV_Cmd: uint8

DT_CAN5_SG_FD_BCM1 = Simulink.Bus(HeaderFile="Rte_Type.h")
  CAN5_AllDoorSW: uint8
  CAN5_AntiTheftSeatFold: uint8
  CAN5_AntitheftSta: uint8
  CAN5_BCM_Buzzer_Req: uint8
  CAN5_BCM_DoorLock_Sta: uint8
  CAN5_BrakeLamp: uint8
  CAN5_CTDCtrl: uint8
  CAN5_CTDLockSW: uint8
  CAN5_CTDUnlockSW: uint8
  CAN5_CrashDetd: uint8
  CAN5_Dimmer: uint8
  CAN5_DimmerEN: uint8
  CAN5_DoorLockIND: uint8
  CAN5_DrDoorSW: uint8
  CAN5_Fr_ChargingDoorCtrl: uint8
  CAN5_Fr_FogLamp: uint8
  CAN5_Fr_Wiper_H: uint8
  CAN5_Fr_Wiper_L: uint8
  CAN5_H_Beam: uint8
  CAN5_HazardSW: uint8
  CAN5_HoodSW: uint8
  CAN5_HornCtrl: uint8
  CAN5_LBSD: uint8
  CAN5_LDRL: uint8
  CAN5_LTurnLP: uint8
  CAN5_L_APM_WdwEnable: uint8
  CAN5_L_Beam: uint8
  CAN5_LockSetting: uint8
  CAN5_MirrorCtrl: uint8
  CAN5_MirrorDefog: uint8
  CAN5_PosLamp: uint8
  CAN5_PsDoorSW: uint8
  CAN5_RBSD: uint8
  CAN5_RDRL: uint8
  CAN5_RLDoorSW: uint8
  CAN5_RRDoorSW: uint8
  CAN5_RTurnLP: uint8
  CAN5_ReverseLamp: uint8
  CAN5_RoomLampH: uint8
  CAN5_RoomLampL: uint8
  CAN5_Rr_ChargingDoorCtrl: uint8
  CAN5_Rr_Defog: uint8
  CAN5_Rr_FogLamp: uint8
  CAN5_Rr_Wiper: uint8
  CAN5_TailgateHDSW: uint8
  CAN5_TailgateRemote: uint8
  CAN5_Tailgate_SW: uint8
  CAN5_TrunkRel: uint8
  CAN5_WasherCtrl: uint8
  CAN5_WiperFixMode: uint8

DT_CAN5_SG_FD_CONN1 = Simulink.Bus(HeaderFile="Rte_Type.h")
  CAN5_CCU_AutoLampSts: uint8
  CAN5_FD_DKC_VehData_Err: uint8
  CAN5_FD_DKC_VehData_Sta: uint8
  CAN5_FD_TBOX_DTCData_Err: uint8
  CAN5_FD_TBOX_DTCData_Sta: uint8
  CAN5_FD_TBOX_VehData_Err: uint8
  CAN5_FD_TBOX_VehData_Sta: uint8
  CAN5_SWC_mode_Sta: uint8

DT_CAN5_SG_FD_THCM2 = Simulink.Bus(HeaderFile="Rte_Type.h")
  CAN5_ACSubMode: uint8
  CAN5_APTC_ActFrRiPwr: uint8
  CAN5_BatLoopActWtFlw: uint8
  CAN5_CCU_CbnPreACWkSts: uint8
  CAN5_CCU_CbnPreEstimdTi: uint8
  CAN5_CCU_CbnPreSts: uint8
  CAN5_CCU_HiVoltageReq: uint8
  CAN5_CoolgFanActDuty: uint8
  CAN5_DeiceModReq: uint8
  CAN5_FD_Blower_Cmd: uint8
  CAN5_FD_Comp_Cmd: uint16
  CAN5_FD_EWP1_Cmd: uint8
  CAN5_FD_EWP2_Cmd: uint8
  CAN5_FD_EWP3_Cmd: uint8
  CAN5_FD_EXV1_Cmd: uint16
  CAN5_FD_EXV2_Cmd: uint16
  CAN5_FD_FWV_Cmd: uint8
  CAN5_FD_FrLeAPTCHeatPwr_Cmd: uint8
  CAN5_FD_FrRiAPTCHeatPwr_Cmd: uint8
  CAN5_FD_FrWPTCHeatPwr_Cmd: uint16
  CAN5_FD_RrAPTCHeatPwr_Cmd: uint8
  CAN5_FD_SOTXV_Cmd: uint8
  CAN5_FD_SOV1_Cmd: uint8
  CAN5_FD_SOV2_Cmd: uint8
  CAN5_FD_SOV3_Cmd: uint8
  CAN5_FD_TWV_Cmd: uint8

DT_CAN5_SG_FD_VCU0 = Simulink.Bus(HeaderFile="Rte_Type.h")
  CAN5_EVCCAplusPwrUpReq: uint8
  CAN5_FDADC12VDetAvg: uint8
  CAN5_Fr_TqSource: uint8
  CAN5_HVRlyOpFail: uint8
  CAN5_HVTHCMSysAvail: uint8
  CAN5_LVBattChrgtimeAct: uint16
  CAN5_LVBattVoltSta: uint8
  CAN5_LVChrgHoldTAct: uint16
  CAN5_LVSilentChrgLv: uint8
  CAN5_LVSilentChrgReq: uint8
  CAN5_LVSilentChrgSta: uint8
  CAN5_MCUActDisFail: uint8
  CAN5_PMMAllowECUSleep: uint8
  CAN5_PowerDownFault: uint8
  CAN5_PowerDownState: uint8
  CAN5_PowerUpFault: uint8
  CAN5_PowerUpState: uint8
  CAN5_PwrDownReq: uint8
  CAN5_PwrStaConstraint: uint8
  CAN5_PwrStaONTOIVIPopReq: uint8
  CAN5_PwrStaONTOIVIPopT: uint16
  CAN5_PwrStaSelect: uint8
  CAN5_PwrStaTOSta: uint8
  CAN5_PwrUpReq: uint8
  CAN5_Rr_TqSource: uint8
  CAN5_SchedChgTOSta: uint8
  CAN5_SilentChkAllowSleep: uint8
  CAN5_SysAllowReadySta: uint8
  CAN5_SysPwrSta: uint8
  CAN5_TCountSta: uint8
  CAN5_TimerAllowSleep: uint8
  CAN5_VCUBrkSWSta: uint8
  CAN5_VCUFLDoorSta: uint8
  CAN5_VCUFRDoorSta: uint8
  CAN5_VCURLDoorSta: uint8
  CAN5_VCURRDoorSta: uint8
  CAN5_VehHVPwrAvail4THCM: uint8

DT_CAN5_SG_FD_VCU1 = Simulink.Bus(HeaderFile="Rte_Type.h")
  CAN5_MSA_Crl_Sta: uint8
  CAN5_PwrSta: uint8
  CAN5_ShiftGearPosn: uint8

DT_CAN5_SG_FD_VCU4 = Simulink.Bus(HeaderFile="Rte_Type.h")
  CAN5_Eng_AGSCloseSta: uint8
  CAN5_Eng_ActvDmpDisabSta: uint8
  CAN5_Eng_CoastDwSta: uint8
  CAN5_Eng_PwrLockSta: uint8
  CAN5_VehMalfunLevel: uint8

DT_CAN1_SG_FD_APS3 = Simulink.Bus(HeaderFile="Rte_Type.h")
  CAN1_APS3_LifeCount: uint8
  CAN1_APS3_checksum: uint8
  CAN1_APSOpenPTG: uint8
  CAN1_APS_DecReq: uint8
  CAN1_APS_DecReq_A: uint8
  CAN1_APS_Req: uint8
  CAN1_CAAS_Sta: uint8
  CAN1_SPTGDet: uint8
  CAN1_SPTG_Sta: uint8

DT_CAN1_SG_FD_VCU2 = Simulink.Bus(HeaderFile="Rte_Type.h")
  CAN1_ACC_CtrlAvail: uint8
  CAN1_AccPedal_Override: uint8
  CAN1_ActAPSPosn: uint8
  CAN1_CS_VCU2_CAN1: uint8
  CAN1_DriverTq: uint16
  CAN1_Fr_DriverTq: uint16
  CAN1_RC_VCU2_CAN1: uint8
  CAN1_Rr_DriverTq: uint16
  CAN1_VehActPwr: uint32

DT_CAN1_SG_FD_VCU3 = Simulink.Bus(HeaderFile="Rte_Type.h")
  CAN1_CS_VCU3_CAN1: uint8
  CAN1_EquivAccPedalSWSta: uint8
  CAN1_Fr_EDUAvailBrkRgnTq: uint16
  CAN1_Fr_EDUAvailBrkRgnTqValid: uint8
  CAN1_Fr_EDURealARgnTq: uint16
  CAN1_Fr_EDURealDrvOrBRgnTq: uint16
  CAN1_Fr_EDUSpd: uint16
  CAN1_Fr_EDUSpdValid: uint8
  CAN1_Fr_RgnDecrSta: uint8
  CAN1_Fr_RgnPermSta: uint8
  CAN1_PTCS_PermSta: uint8
  CAN1_RC_VCU3_CAN1: uint8
  CAN1_RgnAbnorSta: uint8
  CAN1_Rr_EDUAvailBrkRgnTq: uint16
  CAN1_Rr_EDUAvailBrkRgnTqValid: uint8
  CAN1_Rr_EDURealARgnTq: uint16
  CAN1_Rr_EDURealDrvOrBRgnTq: uint16
  CAN1_Rr_EDUSpd: uint16
  CAN1_Rr_EDUSpdValid: uint8
  CAN1_Rr_RgnDecrSta: uint8
  CAN1_Rr_RgnPermSta: uint8

DT_CAN2_SG_FD_APS3 = Simulink.Bus(HeaderFile="Rte_Type.h")
  CAN2_APS3_LifeCount: uint8
  CAN2_APS3_checksum: uint8
  CAN2_APSOpenPTG: uint8
  CAN2_APS_DecReq: uint8
  CAN2_APS_DecReq_A: uint8
  CAN2_APS_Req: uint8
  CAN2_CAAS_Sta: uint8
  CAN2_SPTGDet: uint8
  CAN2_SPTG_Sta: uint8

DT_CAN2_SG_FD_VCU2 = Simulink.Bus(HeaderFile="Rte_Type.h")
  CAN2_ACC_CtrlAvail: uint8
  CAN2_AccPedal_Override: uint8
  CAN2_ActAPSPosn: uint8
  CAN2_CS_VCU2_CAN1: uint8
  CAN2_DriverTq: uint16
  CAN2_Fr_DriverTq: uint16
  CAN2_RC_VCU2_CAN1: uint8
  CAN2_Rr_DriverTq: uint16
  CAN2_VehActPwr: uint32

DT_CAN3_SG_FD_VCU0 = Simulink.Bus(HeaderFile="Rte_Type.h")
  CAN3_EVCCAplusPwrUpReq: uint8
  CAN3_FDADC12VDet: uint8
  CAN3_FDADC12VDetAvg: uint8
  CAN3_FDC_VCU_ActMaxSlideRate_Sta: uint16
  CAN3_FDC_VCU_AllowMovThd_OTA_Sta: uint8
  CAN3_FDC_VCU_DTCCarousel_Sta: uint8
  CAN3_FDC_VCU_ForceP_Cmd: uint8
  CAN3_FDC_VCU_PwrReq_OTA_Sta: uint8
  CAN3_FDC_VCU_RWDRDCActive_Sta: uint8
  CAN3_FDC_VCU_RegenTqLimitEn_Sta: uint8
  CAN3_FDC_VCU_SlideRegenLimTq_Sta: uint16
  CAN3_FDC_VCU_VehActSpd_Sta: uint16
  CAN3_FDC_VCU_VehMalfunLevel_Sta: uint8
  CAN3_FDC_VMC_ActStESCYaw_Sta: uint16
  CAN3_FDC_VMC_AntiSpdLimEn_Sta: uint8
  CAN3_FDC_VMC_LongAcc_Sta: uint16
  CAN3_Fr_TqSource: uint8
  CAN3_HVRlyOpFail: uint8
  CAN3_HVTHCMSysAvail: uint8
  CAN3_LVBattChrgtimeAct: uint16
  CAN3_LVBattVoltSta: uint8
  CAN3_LVChrgHoldTAct: uint16
  CAN3_LVSilentChrgLv: uint8
  CAN3_LVSilentChrgReq: uint8
  CAN3_LVSilentChrgSta: uint8
  CAN3_MCUActDisFail: uint8
  CAN3_PMMAllowECUSleep: uint8
  CAN3_PowerDownFault: uint8
  CAN3_PowerDownState: uint8
  CAN3_PowerUpFault: uint8
  CAN3_PowerUpState: uint8
  CAN3_PwrDownReq: uint8
  CAN3_PwrStaConstraint: uint8
  CAN3_PwrStaONTOIVIPopReq: uint8
  CAN3_PwrStaONTOIVIPopT: uint16
  CAN3_PwrStaSelect: uint8
  CAN3_PwrStaTOSta: uint8
  CAN3_PwrUpReq: uint8
  CAN3_Rr_TqSource: uint8
  CAN3_SchedChgTOSta: uint8
  CAN3_SilentChkAllowSleep: uint8
  CAN3_SysAllowReadySta: uint8
  CAN3_SysPwrSta: uint8
  CAN3_TCountSta: uint8
  CAN3_TimerAllowSleep: uint8
  CAN3_VCUBrkSWSta: uint8
  CAN3_VCUFLDoorSta: uint8
  CAN3_VCUFRDoorSta: uint8
  CAN3_VCURLDoorSta: uint8
  CAN3_VCURRDoorSta: uint8
  CAN3_VehHVPwrAvail4THCM: uint8

DT_CAN3_SG_FD_VCU2 = Simulink.Bus(HeaderFile="Rte_Type.h")
  CAN3_CS_VCU2_CAN1: uint8
  CAN3_Fr_IdcMax: uint16
  CAN3_Fr_IdcMin: uint16
  CAN3_Fr_TMTqReq: uint16
  CAN3_Fr_TorqMax: uint16
  CAN3_Fr_TorqMin: uint16
  CAN3_Fr_UdcMax: uint16
  CAN3_Fr_UdcMin: uint16
  CAN3_RC_VCU2_CAN1: uint8
  CAN3_Rr_IdcMax: uint16
  CAN3_Rr_IdcMin: uint16
  CAN3_Rr_TMTqReq: uint16
  CAN3_Rr_TorqMax: uint16
  CAN3_Rr_TorqMin: uint16
  CAN3_Rr_UdcMax: uint16
  CAN3_Rr_UdcMin: uint16

DT_CAN5_SG_FD_VCU3 = Simulink.Bus(HeaderFile="Rte_Type.h")
  CAN5_CS_VCU3_CAN1: uint8
  CAN5_EquivAccPedalSWSta: uint8
  CAN5_Fr_EDUActTqValid: uint8
  CAN5_Fr_EDUAvailBrkRgnTq: uint16
  CAN5_Fr_EDUAvailBrkRgnTqValid: uint8
  CAN5_Fr_EDURealARgnTq: uint16
  CAN5_Fr_EDURealDrvOrBRgnTq: uint16
  CAN5_Fr_EDURolRgnTqValid: uint8
  CAN5_Fr_EDUSpd: uint16
  CAN5_Fr_EDUSpdValid: uint8
  CAN5_Fr_RgnDecrSta: uint8
  CAN5_Fr_RgnPermSta: uint8
  CAN5_PTCS_PermSta: uint8
  CAN5_RC_VCU3_CAN1: uint8
  CAN5_RgnAbnorSta: uint8
  CAN5_Rr_EDUActTqValid: uint8
  CAN5_Rr_EDUAvailBrkRgnTq: uint16
  CAN5_Rr_EDUAvailBrkRgnTqValid: uint8
  CAN5_Rr_EDURealARgnTq: uint16
  CAN5_Rr_EDURealDrvOrBRgnTq: uint16
  CAN5_Rr_EDURolRgnTqValid: uint8
  CAN5_Rr_EDUSpd: uint16
  CAN5_Rr_EDUSpdValid: uint8
  CAN5_Rr_RgnDecrSta: uint8
  CAN5_Rr_RgnPermSta: uint8

DT_CAN1_SG_FD_THCM1 = Simulink.Bus(HeaderFile="Rte_Type.h")
  CAN1_BatteryMode: uint8
  CAN1_CCU_ACLampSts: uint8
  CAN1_CCU_ACMaxLampSts: uint8
  CAN1_CCU_AutoLampSts: uint8
  CAN1_CCU_AutoMidLampSts: uint8
  CAN1_CCU_Dispaly_Request: uint8
  CAN1_CCU_EcoSts: uint8
  CAN1_CCU_FrtOnOffLampSts: uint8
  CAN1_CCU_HEATMaxLampSts: uint8
  CAN1_CCU_RrOnOffLampSts: uint8
  CAN1_CCU_SyncLampSts: uint8
  CAN1_CabinMode: uint8
  CAN1_EDriveMode: uint8
  CAN1_FD_AGS_Cmd: uint8
  CAN1_FD_RecyAuto_Cmd: uint8
  CAN1_Fr_Coolantflow: uint8
  CAN1_Fr_Coolanttemp: uint16
  CAN1_HPThermalRecoveryReq: uint8
  CAN1_Rr_Coolantflow: uint8
  CAN1_Rr_Coolanttemp: uint16
  CAN1_sigAirIntenZon1St: uint8
  CAN1_sigAirIntenZon3St: uint8
  CAN1_sigAmbAirT: uint8
  CAN1_sigCbnAirT: uint8
  CAN1_sigCbnPTCPwrAct: uint8
  CAN1_sigCbnSolarLeft: uint8
  CAN1_sigCbnSolarRight: uint8
  CAN1_sigClmtCmprPwrAct: uint8
  CAN1_sigClntTHvBattOut: uint8
  CAN1_sigDfrstSt: uint8
  CAN1_sigHvacSt: uint8
  CAN1_sigRecircSt: uint8
  CAN1_sigSetTempZon1St: uint8
  CAN1_sigSetTempZon2St: uint8
  CAN1_sigSetTempZon3St: uint8
  CAN1_sigWindDirZon1St: uint8
  CAN1_sigWindDirZon3St: uint8

DT_CAN2_SG_FD_THCM1 = Simulink.Bus(HeaderFile="Rte_Type.h")
  CAN2_BatteryMode: uint8
  CAN2_CCU_ACLampSts: uint8
  CAN2_CCU_ACMaxLampSts: uint8
  CAN2_CCU_AutoLampSts: uint8
  CAN2_CCU_AutoMidLampSts: uint8
  CAN2_CCU_Dispaly_Request: uint8
  CAN2_CCU_EcoSts: uint8
  CAN2_CCU_FrtOnOffLampSts: uint8
  CAN2_CCU_HEATMaxLampSts: uint8
  CAN2_CCU_RrOnOffLampSts: uint8
  CAN2_CCU_SyncLampSts: uint8
  CAN2_CabinMode: uint8
  CAN2_EDriveMode: uint8
  CAN2_FD_AGS_Cmd: uint8
  CAN2_FD_RecyAuto_Cmd: uint8
  CAN2_Fr_Coolantflow: uint8
  CAN2_Fr_Coolanttemp: uint16
  CAN2_HPThermalRecoveryReq: uint8
  CAN2_Rr_Coolantflow: uint8
  CAN2_Rr_Coolanttemp: uint16
  CAN2_sigAirIntenZon1St: uint8
  CAN2_sigAirIntenZon3St: uint8
  CAN2_sigAmbAirT: uint8
  CAN2_sigCbnAirT: uint8
  CAN2_sigCbnPTCPwrAct: uint8
  CAN2_sigCbnSolarLeft: uint8
  CAN2_sigCbnSolarRight: uint8
  CAN2_sigClmtCmprPwrAct: uint8
  CAN2_sigClntTHvBattOut: uint8
  CAN2_sigDfrstSt: uint8
  CAN2_sigHvacSt: uint8
  CAN2_sigRecircSt: uint8
  CAN2_sigSetTempZon1St: uint8
  CAN2_sigSetTempZon2St: uint8
  CAN2_sigSetTempZon3St: uint8
  CAN2_sigWindDirZon1St: uint8
  CAN2_sigWindDirZon3St: uint8

DT_CAN3_SG_FD_THCM1 = Simulink.Bus(HeaderFile="Rte_Type.h")
  CAN3_BatteryMode: uint8
  CAN3_CCU_ACLampSts: uint8
  CAN3_CCU_ACMaxLampSts: uint8
  CAN3_CCU_AutoLampSts: uint8
  CAN3_CCU_AutoMidLampSts: uint8
  CAN3_CCU_Dispaly_Request: uint8
  CAN3_CCU_EcoSts: uint8
  CAN3_CCU_FrtOnOffLampSts: uint8
  CAN3_CCU_HEATMaxLampSts: uint8
  CAN3_CCU_RrOnOffLampSts: uint8
  CAN3_CCU_SyncLampSts: uint8
  CAN3_CabinMode: uint8
  CAN3_EDriveMode: uint8
  CAN3_FD_AGS_Cmd: uint8
  CAN3_FD_RecyAuto_Cmd: uint8
  CAN3_Fr_Coolantflow: uint8
  CAN3_Fr_Coolanttemp: uint16
  CAN3_HPThermalRecoveryReq: uint8
  CAN3_Rr_Coolantflow: uint8
  CAN3_Rr_Coolanttemp: uint16
  CAN3_sigAirIntenZon1St: uint8
  CAN3_sigAirIntenZon3St: uint8
  CAN3_sigAmbAirT: uint8
  CAN3_sigCbnAirT: uint8
  CAN3_sigCbnPTCPwrAct: uint8
  CAN3_sigCbnSolarLeft: uint8
  CAN3_sigCbnSolarRight: uint8
  CAN3_sigClmtCmprPwrAct: uint8
  CAN3_sigClntTHvBattOut: uint8
  CAN3_sigDfrstSt: uint8
  CAN3_sigHvacSt: uint8
  CAN3_sigRecircSt: uint8
  CAN3_sigSetTempZon1St: uint8
  CAN3_sigSetTempZon2St: uint8
  CAN3_sigSetTempZon3St: uint8
  CAN3_sigWindDirZon1St: uint8
  CAN3_sigWindDirZon3St: uint8

DT_CAN4_SG_FD_THCM1 = Simulink.Bus(HeaderFile="Rte_Type.h")
  CAN4_BatteryMode: uint8
  CAN4_CCU_ACLampSts: uint8
  CAN4_CCU_ACMaxLampSts: uint8
  CAN4_CCU_AutoLampSts: uint8
  CAN4_CCU_AutoMidLampSts: uint8
  CAN4_CCU_Dispaly_Request: uint8
  CAN4_CCU_EcoSts: uint8
  CAN4_CCU_FrtOnOffLampSts: uint8
  CAN4_CCU_HEATMaxLampSts: uint8
  CAN4_CCU_RrOnOffLampSts: uint8
  CAN4_CCU_SyncLampSts: uint8
  CAN4_CabinMode: uint8
  CAN4_EDriveMode: uint8
  CAN4_FD_AGS_Cmd: uint8
  CAN4_FD_RecyAuto_Cmd: uint8
  CAN4_Fr_Coolantflow: uint8
  CAN4_Fr_Coolanttemp: uint16
  CAN4_HPThermalRecoveryReq: uint8
  CAN4_Rr_Coolantflow: uint8
  CAN4_Rr_Coolanttemp: uint16
  CAN4_sigAirIntenZon1St: uint8
  CAN4_sigAirIntenZon3St: uint8
  CAN4_sigAmbAirT: uint8
  CAN4_sigCbnAirT: uint8
  CAN4_sigCbnPTCPwrAct: uint8
  CAN4_sigCbnSolarLeft: uint8
  CAN4_sigCbnSolarRight: uint8
  CAN4_sigClmtCmprPwrAct: uint8
  CAN4_sigClntTHvBattOut: uint8
  CAN4_sigDfrstSt: uint8
  CAN4_sigHvacSt: uint8
  CAN4_sigRecircSt: uint8
  CAN4_sigSetTempZon1St: uint8
  CAN4_sigSetTempZon2St: uint8
  CAN4_sigSetTempZon3St: uint8
  CAN4_sigWindDirZon1St: uint8
  CAN4_sigWindDirZon3St: uint8

DT_CAN1_SG_FD_APS1 = Simulink.Bus(HeaderFile="Rte_Type.h")
  CAN1_APS_Angle_Target: uint16
  CAN1_APS_Rq_EPAS_Ctrl: uint8
  CAN1_APS_Sta_System: uint8
  CAN1_APS_V_Rq_EPAS_Ctrl: uint8

DT_CAN1_SG_FD_APS2 = Simulink.Bus(HeaderFile="Rte_Type.h")
  CAN1_APS_D_FLL: uint16
  CAN1_APS_D_FLR: uint16
  CAN1_APS_D_RLL: uint16
  CAN1_APS_D_RLR: uint16
  CAN1_APS_ExitCondition: uint8
  CAN1_APS_HW_Ver: uint8
  CAN1_APS_Progress_PCT: uint8
  CAN1_APS_RQ_Display: uint8
  CAN1_APS_SW_Ver: uint8
  CAN1_PAS_A_FCL: uint8
  CAN1_PAS_A_FCR: uint8
  CAN1_PAS_A_FML: uint8
  CAN1_PAS_A_FMR: uint8
  CAN1_PAS_A_RCL: uint8
  CAN1_PAS_A_RCR: uint8
  CAN1_PAS_A_RML: uint8
  CAN1_PAS_A_RMR: uint8
  CAN1_PAS_Chime: uint8
  CAN1_PAS_D_FCL: uint8
  CAN1_PAS_D_FCR: uint8
  CAN1_PAS_D_FML: uint8
  CAN1_PAS_D_FMR: uint8
  CAN1_PAS_D_RCL: uint8
  CAN1_PAS_D_RCR: uint8
  CAN1_PAS_D_RML: uint8
  CAN1_PAS_D_RMR: uint8
  CAN1_PAS_Mod_Operation: uint8
  CAN1_PAS_SNSR_Layout: uint8
  CAN1_PAS_Sta_F_Sys: uint8
  CAN1_USS_Sta_FCL: uint8
  CAN1_USS_Sta_FCR: uint8
  CAN1_USS_Sta_FLL: uint8
  CAN1_USS_Sta_FLR: uint8
  CAN1_USS_Sta_FML: uint8
  CAN1_USS_Sta_FMR: uint8
  CAN1_USS_Sta_RCL: uint8
  CAN1_USS_Sta_RCR: uint8
  CAN1_USS_Sta_RLL: uint8
  CAN1_USS_Sta_RLR: uint8
  CAN1_USS_Sta_RML: uint8
  CAN1_USS_Sta_RMR: uint8

DT_CAN2_SG_FD_APS1 = Simulink.Bus(HeaderFile="Rte_Type.h")
  CAN2_APS_Angle_Target: uint16
  CAN2_APS_Rq_EPAS_Ctrl: uint8
  CAN2_APS_Sta_System: uint8
  CAN2_APS_V_Rq_EPAS_Ctrl: uint8

DT_CAN2_SG_FD_APS2 = Simulink.Bus(HeaderFile="Rte_Type.h")
  CAN2_APS_D_FLL: uint16
  CAN2_APS_D_FLR: uint16
  CAN2_APS_D_RLL: uint16
  CAN2_APS_D_RLR: uint16
  CAN2_APS_ExitCondition: uint8
  CAN2_APS_HW_Ver: uint8
  CAN2_APS_Progress_PCT: uint8
  CAN2_APS_RQ_Display: uint8
  CAN2_APS_SW_Ver: uint8
  CAN2_FDC_VCU_RegenLimInd_Sta: uint8
  CAN2_FDC_VCU_SmartEcoSpdLim_Sta: uint8
  CAN2_FDC_VCU_SmartEco_Sta: uint8
  CAN2_PAS_A_FCL: uint8
  CAN2_PAS_A_FCR: uint8
  CAN2_PAS_A_FML: uint8
  CAN2_PAS_A_FMR: uint8
  CAN2_PAS_A_RCL: uint8
  CAN2_PAS_A_RCR: uint8
  CAN2_PAS_A_RML: uint8
  CAN2_PAS_A_RMR: uint8
  CAN2_PAS_Chime: uint8
  CAN2_PAS_D_FCL: uint8
  CAN2_PAS_D_FCR: uint8
  CAN2_PAS_D_FML: uint8
  CAN2_PAS_D_FMR: uint8
  CAN2_PAS_D_RCL: uint8
  CAN2_PAS_D_RCR: uint8
  CAN2_PAS_D_RML: uint8
  CAN2_PAS_D_RMR: uint8
  CAN2_PAS_Mod_Operation: uint8
  CAN2_PAS_SNSR_Layout: uint8
  CAN2_PAS_Sta_F_Sys: uint8
  CAN2_USS_Sta_FCL: uint8
  CAN2_USS_Sta_FCR: uint8
  CAN2_USS_Sta_FLL: uint8
  CAN2_USS_Sta_FLR: uint8
  CAN2_USS_Sta_FML: uint8
  CAN2_USS_Sta_FMR: uint8
  CAN2_USS_Sta_RCL: uint8
  CAN2_USS_Sta_RCR: uint8
  CAN2_USS_Sta_RLL: uint8
  CAN2_USS_Sta_RLR: uint8
  CAN2_USS_Sta_RML: uint8
  CAN2_USS_Sta_RMR: uint8

DT_CAN2_SG_FD_VCU5 = Simulink.Bus(HeaderFile="Rte_Type.h")
  CAN2_EDriveSysErr_AccPedalErr: uint8
  CAN2_EDriveSysErr_MCUErr: uint8
  CAN2_EDriveSysErr_ShifterErr: uint8
  CAN2_EDriveSysErr_VCUErr: uint8
  CAN2_HVSysErr_IsolationErr: uint8
  CAN2_HVSysErr_PackErr: uint8
  CAN2_HVSysErr_RelayErr: uint8
  CAN2_LVSysErr_PwrOutpErr: uint8
  CAN2_LimphomeAct: uint8
  CAN2_LowSOCWarn: uint8
  CAN2_PwrStaErr: uint8
  CAN2_Re_VehThdChkSta: uint8

DT_CAN5_SG_FD_VCU5 = Simulink.Bus(HeaderFile="Rte_Type.h")
  CAN5_EDriveSysErr_AccPedalErr: uint8
  CAN5_EDriveSysErr_MCUErr: uint8
  CAN5_EDriveSysErr_ShifterErr: uint8
  CAN5_EDriveSysErr_VCUErr: uint8
  CAN5_HVSysErr_IsolationErr: uint8
  CAN5_HVSysErr_PackErr: uint8
  CAN5_HVSysErr_RelayErr: uint8
  CAN5_LVSysErr_PwrOutpErr: uint8
  CAN5_LimphomeAct: uint8
  CAN5_LowSOCWarn: uint8
  CAN5_PwrStaErr: uint8
  CAN5_Re_VehThdChkSta: uint8

DT_CAN2_SG_FD_VCU6 = Simulink.Bus(HeaderFile="Rte_Type.h")
  CAN2_FUSION_HW_Ver1: uint8
  CAN2_FUSION_HW_Ver2: uint8
  CAN2_FUSION_HW_Ver3: uint8
  CAN2_FUSION_SW_CarModel1: uint8
  CAN2_FUSION_SW_CarModel2: uint8
  CAN2_FUSION_SW_CarModel3: uint8
  CAN2_FUSION_SW_Controller1: uint8
  CAN2_FUSION_SW_Controller2: uint8
  CAN2_FUSION_SW_Country1: uint8
  CAN2_FUSION_SW_Country2: uint8
  CAN2_FUSION_SW_Major1: uint8
  CAN2_FUSION_SW_Major2: uint8
  CAN2_FUSION_SW_Minor1: uint8
  CAN2_FUSION_SW_Minor2: uint8
  CAN2_FUSION_SW_Patch1: uint8
  CAN2_FUSION_SW_Patch2: uint8
  CAN2_FUSION_SW_SHA1: uint8
  CAN2_FUSION_SW_SHA2: uint8
  CAN2_FUSION_SW_SHA3: uint8
  CAN2_FUSION_SW_SHA4: uint8
  CAN2_FUSION_SW_SHA5: uint8
  CAN2_FUSION_SW_SHA6: uint8
  CAN2_FUSION_SW_SHA7: uint8
  CAN2_FUSION_SW_SHA8: uint8
  CAN2_FUSION_SW_Var: uint8
  CAN2_FUSION_SW_change1: uint8
  CAN2_FUSION_SW_change2: uint8
  CAN2_FUSION_SW_dash1: uint8
  CAN2_FUSION_SW_dash2: uint8

DT_CAN3_SG_FD_VCU1 = Simulink.Bus(HeaderFile="Rte_Type.h")
  CAN3_ActiveDischReq: uint8
  CAN3_CS_VCU1: uint8
  CAN3_CoastDwModeStaChk: uint8
  CAN3_DCDCEnaReq: uint8
  CAN3_DCDCVoltSetpoint: uint8
  CAN3_DemoModeStaChk: uint8
  CAN3_Dr_SeatSta: uint8
  CAN3_DynoModeStaChk: uint8
  CAN3_Fr_ActvDmpDisabReq: uint8
  CAN3_Fr_MCUEnaReq: uint8
  CAN3_HVBatCnctReq: uint8
  CAN3_HVSysReadyToCharge: uint8
  CAN3_LVChrgFuncStaChk: uint8
  CAN3_MSA_Crl_Sta: uint8
  CAN3_PrkReq: uint8
  CAN3_PwrSta: uint8
  CAN3_RC_VCU1: uint8
  CAN3_Rr_ActvDmpDisabReq: uint8
  CAN3_Rr_MCUEnaReq: uint8
  CAN3_ShiftGearPosn: uint8

DT_CAN4_SG_FD_VCU1 = Simulink.Bus(HeaderFile="Rte_Type.h")
  CAN4_AllDoorSW: uint8
  CAN4_AmbLightBreath1: uint8
  CAN4_AmbLightBreath2: uint8
  CAN4_AmbLightBreath3: uint8
  CAN4_AmbLightBrightness1: uint8
  CAN4_AmbLightBrightness2: uint8
  CAN4_AmbLightBrightness3: uint8
  CAN4_AmbLightColor1: uint8
  CAN4_AmbLightColor2: uint8
  CAN4_AmbLightColor3: uint8
  CAN4_AntiTheftSeatFold: uint8
  CAN4_AntitheftSta: uint8
  CAN4_BCM_Buzzer_Req: uint8
  CAN4_BCM_DoorLock_Sta: uint8
  CAN4_BrakeLamp: uint8
  CAN4_CC_Crl_Sta: uint8
  CAN4_CS_VCU1_CAN4: uint8
  CAN4_CTDCtrl: uint8
  CAN4_CTDLockSW: uint8
  CAN4_CTDUnlockSW: uint8
  CAN4_CrashDetd: uint8
  CAN4_CtrlDrPwrStbA2: uint8
  CAN4_CtrlFrBMSCCUCIR: uint8
  CAN4_CtrlFrEDUINVERTER: uint8
  CAN4_CtrlFrIRC1: uint8
  CAN4_CtrlFrPwrStbA1P: uint8
  CAN4_DKCAuthSta: uint8
  CAN4_DKCTimeSN: uint32
  CAN4_Dimmer: uint8
  CAN4_DimmerEN: uint8
  CAN4_DoorLockIND: uint8
  CAN4_DrDoorSW: uint8
  CAN4_Dr_SeatSta: uint8
  CAN4_EquivAccPedalSWSta: uint8
  CAN4_FD_DKC_VehData_Err: uint8
  CAN4_FD_DKC_VehData_Sta: uint8
  CAN4_FD_TBOX_DTCData_Err: uint8
  CAN4_FD_TBOX_DTCData_Sta: uint8
  CAN4_FD_TBOX_VehData_Err: uint8
  CAN4_FD_TBOX_VehData_Sta: uint8
  CAN4_Fr_ChargingDoorCtrl: uint8
  CAN4_Fr_FogLamp: uint8
  CAN4_Fr_Wiper_H: uint8
  CAN4_Fr_Wiper_L: uint8
  CAN4_HWResetSta: uint8
  CAN4_H_Beam: uint8
  CAN4_HazardSW: uint8
  CAN4_HoodSW: uint8
  CAN4_HornCtrl: uint8
  CAN4_LBSD: uint8
  CAN4_LDRL: uint8
  CAN4_LTurnLP: uint8
  CAN4_L_APM_WdwEnable: uint8
  CAN4_L_Beam: uint8
  CAN4_LampPwr: uint8
  CAN4_LockSetting: uint8
  CAN4_MSA_Crl_Sta: uint8
  CAN4_MirrorCtrl: uint8
  CAN4_MirrorDefog: uint8
  CAN4_PosLamp: uint8
  CAN4_PsDoorSW: uint8
  CAN4_PwrSta: uint8
  CAN4_RBSD: uint8
  CAN4_RC_VCU1_CAN4: uint8
  CAN4_RDRL: uint8
  CAN4_RLDoorSW: uint8
  CAN4_RRDoorSW: uint8
  CAN4_RTurnLP: uint8
  CAN4_ReBrakeLPReq: uint8
  CAN4_ReverseLamp: uint8
  CAN4_RoomLampH: uint8
  CAN4_RoomLampL: uint8
  CAN4_Rr_ChargingDoorCtrl: uint8
  CAN4_Rr_Defog: uint8
  CAN4_Rr_FogLamp: uint8
  CAN4_Rr_Wiper: uint8
  CAN4_ShiftGearPosn: uint8
  CAN4_TailgateHDSW: uint8
  CAN4_TailgateRemote: uint8
  CAN4_Tailgate_SW: uint8
  CAN4_TimeSNDKCFbk: uint32
  CAN4_TrunkRel: uint8
  CAN4_VehSpeed: uint16
  CAN4_WasherCtrl: uint8
  CAN4_WiperFixMode: uint8

P_boolean = Simulink.Parameter(0, DataType="uint8")