% Simulink data dictionary APPTypes.sldd

AppModeRequestType = enum(HeaderFile="Rte_Type.h", DefaultValue="APP_MODE_ACTIVE", StorageType="uint8")
  APP_MODE_ACTIVE = 0
  APP_MODE_INACTIVE = 1

DT_CAN1_SG_FD1_CE100_2 = Simulink.Bus(HeaderFile="Rte_Type.h")
  CAN1_FDC_BCM_DVRSignalL_Cmd: uint8
  CAN1_FDC_BCM_DVRSignalR_Cmd: uint8
  CAN1_FDC_BCM_LTurnLp_Cmd: uint8
  CAN1_FDC_BCM_RTurnLp_Cmd: uint8

DT_CAN2_SG_FD2_CE100_0 = Simulink.Bus(HeaderFile="Rte_Type.h")
  CAN2_FDC_BCM_BSD_Buzzer_Cmd: uint8
  CAN2_FDC_BCM_Brake_Cmd: uint8
  CAN2_FDC_BCM_CallBell_Cmd: uint8
  CAN2_FDC_BCM_DVRSignalL_Cmd: uint8
  CAN2_FDC_BCM_DVRSignalR_Cmd: uint8
  CAN2_FDC_BCM_EmExitSW_Sta: uint8
  CAN2_FDC_BCM_EmSV_Cmd: uint8
  CAN2_FDC_BCM_FDCloseSV_Cmd: uint8
  CAN2_FDC_BCM_FDOpenSV_Cmd: uint8
  CAN2_FDC_BCM_FDoor_Sta: uint8
  CAN2_FDC_BCM_FRoomLpSet_Sta: uint8
  CAN2_FDC_BCM_HBeam_Cmd: uint8
  CAN2_FDC_BCM_HazardSW_Sta: uint8
  CAN2_FDC_BCM_HelpIND_Cmd: uint8
  CAN2_FDC_BCM_InnerBuzzerMode_Sta: uint8
  CAN2_FDC_BCM_InnerBuzzer_Cmd: uint8
  CAN2_FDC_BCM_InnerCallBell_Cmd: uint8
  CAN2_FDC_BCM_LBSDR_Cmd: uint8
  CAN2_FDC_BCM_LBSDY_Cmd: uint8
  CAN2_FDC_BCM_LBeam_Cmd: uint8
  CAN2_FDC_BCM_LDRL_Cmd: uint8
  CAN2_FDC_BCM_LTurnLp_Cmd: uint8
  CAN2_FDC_BCM_LTurnSW_Sta: uint8
  CAN2_FDC_BCM_MDCloseSV_Cmd: uint8
  CAN2_FDC_BCM_MDOpenSV_Cmd: uint8
  CAN2_FDC_BCM_MDoor_Sta: uint8
  CAN2_FDC_BCM_MRoomLpSet_Sta: uint8
  CAN2_FDC_BCM_OutDoorOpenSW_Sta: uint8
  CAN2_FDC_BCM_PLamp_Cmd: uint8
  CAN2_FDC_BCM_RBSDR_Cmd: uint8
  CAN2_FDC_BCM_RBSDY_Cmd: uint8
  CAN2_FDC_BCM_RDRL_Cmd: uint8
  CAN2_FDC_BCM_RDoor_Sta: uint8
  CAN2_FDC_BCM_RFLamp_Cmd: uint8
  CAN2_FDC_BCM_RGear_Sta: uint8
  CAN2_FDC_BCM_RRoomLpSet_Sta: uint8
  CAN2_FDC_BCM_RTurnLp_Cmd: uint8
  CAN2_FDC_BCM_RTurnSW_Sta: uint8
  CAN2_FDC_BCM_RoomLpAmbSet_Sta: uint8
  CAN2_FDC_BCM_RoomLpAmb_Cmd: uint8
  CAN2_FDC_BCM_RoomLpSet_Sta: uint8
  CAN2_FDC_BCM_SLTLp_Cmd: uint8
  CAN2_FDC_BCM_SMKL_Cmd: uint8
  CAN2_FDC_BCM_SMKR_Cmd: uint8
  CAN2_FDC_BCM_SRTLp_Cmd: uint8
  CAN2_FDC_BCM_STOPBALL_Cmd: uint8
  CAN2_FDC_BCM_Stop_IND_Cmd: uint8
  CAN2_FDC_BCM_TurnBuzzerEN_Sta: uint8
  CAN2_FDC_BCM_TurnLpPattern_Sta: uint8
  CAN2_FDC_BCM_Washer_Cmd: uint8
  CAN2_FDC_BCM_WiperH_Cmd: uint8
  CAN2_FDC_BCM_WiperL_Cmd: uint8

DT_CAN4_SG_FD4_CE100_0 = Simulink.Bus(HeaderFile="Rte_Type.h")
  CAN4_FDC_BCM_BSD_Buzzer_Cmd: uint8
  CAN4_FDC_BCM_Brake_Cmd: uint8
  CAN4_FDC_BCM_CallBell_Cmd: uint8
  CAN4_FDC_BCM_DVRSignalL_Cmd: uint8
  CAN4_FDC_BCM_DVRSignalR_Cmd: uint8
  CAN4_FDC_BCM_EmExitSW_Sta: uint8
  CAN4_FDC_BCM_EmSV_Cmd: uint8
  CAN4_FDC_BCM_FDCloseSV_Cmd: uint8
  CAN4_FDC_BCM_FDOpenSV_Cmd: uint8
  CAN4_FDC_BCM_FDoor_Sta: uint8
  CAN4_FDC_BCM_HBeam_Cmd: uint8
  CAN4_FDC_BCM_InnerBuzzerMode_Sta: uint8
  CAN4_FDC_BCM_InnerBuzzer_Cmd: uint8
  CAN4_FDC_BCM_InnerCallBell_Cmd: uint8
  CAN4_FDC_BCM_LBSDR_Cmd: uint8
  CAN4_FDC_BCM_LBSDY_Cmd: uint8
  CAN4_FDC_BCM_LBeam_Cmd: uint8
  CAN4_FDC_BCM_LDRL_Cmd: uint8
  CAN4_FDC_BCM_LTurnLp_Cmd: uint8
  CAN4_FDC_BCM_MDCloseSV_Cmd: uint8
  CAN4_FDC_BCM_MDOpenSV_Cmd: uint8
  CAN4_FDC_BCM_MDoor_Sta: uint8
  CAN4_FDC_BCM_OutDoorOpenSW_Sta: uint8
  CAN4_FDC_BCM_PLamp_Cmd: uint8
  CAN4_FDC_BCM_RBSDR_Cmd: uint8
  CAN4_FDC_BCM_RBSDY_Cmd: uint8
  CAN4_FDC_BCM_RDRL_Cmd: uint8
  CAN4_FDC_BCM_RDoor_Sta: uint8
  CAN4_FDC_BCM_RFLamp_Cmd: uint8
  CAN4_FDC_BCM_RGear_Sta: uint8
  CAN4_FDC_BCM_RTurnLp_Cmd: uint8
  CAN4_FDC_BCM_RoomLpAmb_Cmd: uint8
  CAN4_FDC_BCM_SLTLp_Cmd: uint8
  CAN4_FDC_BCM_SMKL_Cmd: uint8
  CAN4_FDC_BCM_SMKR_Cmd: uint8
  CAN4_FDC_BCM_SRTLp_Cmd: uint8
  CAN4_FDC_BCM_STOPBALL_Cmd: uint8
  CAN4_FDC_BCM_Stop_IND_Cmd: uint8
  CAN4_FDC_BCM_TurnLpPattern_Sta: uint8
  CAN4_FDC_BCM_Washer_Cmd: uint8
  CAN4_FDC_BCM_WiperH_Cmd: uint8
  CAN4_FDC_BCM_WiperL_Cmd: uint8
  CAN4_VCUKeyStatus: uint8

DT_CAN4_SG_FD4_CE100_1 = Simulink.Bus(HeaderFile="Rte_Type.h")
  CAN4_FDC_BCM_FRoomLp_Cmd: uint8
  CAN4_FDC_BCM_MRoomLp_Cmd: uint8
  CAN4_FDC_BCM_RRoomLp_Cmd: uint8
  CAN4_FDC_THCM_CoolFanReq_Cmd: uint8

DT_CAN7_SG_FD7_CE100_0 = Simulink.Bus(HeaderFile="Rte_Type.h")
  CAN7_FDC_BCM_DVRSignalL_Cmd: uint8
  CAN7_FDC_BCM_DVRSignalR_Cmd: uint8
  CAN7_FDC_BCM_FDoor_Sta: uint8
  CAN7_FDC_BCM_HBeam_Cmd: uint8
  CAN7_FDC_BCM_LBeam_Cmd: uint8
  CAN7_FDC_BCM_MDoor_Sta: uint8
  CAN7_FDC_BCM_PLamp_Cmd: uint8

DT_CAN1_SG_FD1_C10_0 = Simulink.Bus(HeaderFile="Rte_Type.h")
  CAN1_VehActDriveDirect: uint8

DT_CAN1_SG_FD1_C10_1 = Simulink.Bus(HeaderFile="Rte_Type.h")
  CAN1_ActEMOutSftSpd: uint16
  CAN1_ActEMpTrq: uint8
  CAN1_ActEMpTrqHrls: uint8
  CAN1_ActMaxAvaEMRecpTrq: uint8
  CAN1_DrvDemEMRtapTrq: uint8
  CAN1_EMTrqModeDrvBrk: uint8
  CAN1_RetSelNonEng: uint8
  CAN1_SACtrlDev: uint8

DT_CAN2_SG_FD2_C10_0 = Simulink.Bus(HeaderFile="Rte_Type.h")
  CAN2_ActDriveMode: uint8
  CAN2_CeTraxSysReady: uint8
  CAN2_CreeperSta: uint8
  CAN2_EBrakeTorqLow: uint8
  CAN2_EMotorOverSpd: uint8
  CAN2_EMotorPerformance: uint16
  CAN2_EMotorSpd: uint16
  CAN2_EVECU1MSGCS: uint8
  CAN2_EVECU1MSGCnt: uint8
  CAN2_RecuperHighSta: uint8
  CAN2_TUpASta: uint8
  CAN2_VehActDriveDirect: uint8
  CAN2_WheelSlipdet: uint8

DT_CAN3_SG_FD3_C10_0 = Simulink.Bus(HeaderFile="Rte_Type.h")
  CAN3_DCDCRlyEn: uint8
  CAN3_EACRlyEn: uint8
  CAN3_EHPSRlyEn: uint8
  CAN3_MCUHVPwrOnOffReq: uint8
  CAN3_VCULife1: uint8

DT_CAN3_SG_FD3_C10_1 = Simulink.Bus(HeaderFile="Rte_Type.h")
  CAN3_VCUMCUCtrlMd: uint8
  CAN3_VCUMCUDemCS: uint8
  CAN3_VCUMCUDemHiPosVal: uint8
  CAN3_VCUMCUDemLoNegVal: uint8
  CAN3_VCUMCUDemRC: uint8
  CAN3_VCUMCUDemSpd: uint16
  CAN3_VCUMCUDemTrq: uint16
  CAN3_VCUMCUEn: uint8
  CAN3_VCUMCUFailRst: uint8
  CAN3_VCUMCUFootBrk: uint8
  CAN3_VCUMCUGearSta: uint8
  CAN3_VCUMCUHandBrk: uint8

DT_CAN4_SG_FD4_C10_0 = Simulink.Bus(HeaderFile="Rte_Type.h")
  CAN4_ACHVPwrOnOffReq: uint8
  CAN4_MCUHVPwrOnOffReq: uint8
  CAN4_VCULife1: uint8
  CAN4_VCU_DCDCEACEHPSRlyEn_cmd: uint8
  CAN4_VCU_DeFogTMSRlyEn_cmd: uint8

DT_CAN7_SG_FD7_C10_0 = Simulink.Bus(HeaderFile="Rte_Type.h")
  CAN7_EMotorSpd: uint16

DT_CAN1_SG_FD1_C100_0 = Simulink.Bus(HeaderFile="Rte_Type.h")
  CAN1_VCUEBSRd4BR: uint8

DT_CAN1_SG_FD1_C100_1 = Simulink.Bus(HeaderFile="Rte_Type.h")
  CAN1_VCUEBSHBSw: uint8
  CAN1_VCUEBSHHSw: uint8

DT_CAN1_SG_FD1_C100_2 = Simulink.Bus(HeaderFile="Rte_Type.h")
  CAN1_GearFlashInd: uint8
  CAN1_LVBattLow: uint8
  CAN1_PweLmtInd: uint8
  CAN1_VCUBCMBuzzReq: uint8
  CAN1_VCUDTCCurrCode: uint32
  CAN1_VCUDTCCurrSta: uint8
  CAN1_VCUDTCHisCode: uint32
  CAN1_VCUDTCHisSta: uint8
  CAN1_VCUKeyStatus: uint8
  CAN1_VCUWarnInd: uint8
  CAN1_VCUnoPBInd: uint8

DT_CAN1_SG_FD1_C100_3 = Simulink.Bus(HeaderFile="Rte_Type.h")
  CAN1_BrakeSW: uint8
  CAN1_VCUVehSpd: uint16

DT_CAN2_SG_GW2_C100_0 = Simulink.Bus(HeaderFile="Rte_Type.h")
  CAN2_CACTempWarn: uint8
  CAN2_DACStatus: uint8
  CAN2_GearFlashInd: uint8
  CAN2_LVBattLow: uint8
  CAN2_PweLmtInd: uint8
  CAN2_VCUWarnInd: uint8
  CAN2_VCUnoPBInd: uint8

DT_CAN3_SG_FD3_C100_0 = Simulink.Bus(HeaderFile="Rte_Type.h")
  CAN3_V2BACPosRlyFlt: uint8
  CAN3_V2BACPosRlySta: uint8
  CAN3_V2BAirPosRlyFlt: uint8
  CAN3_V2BAirPosRlySta: uint8
  CAN3_V2BAux1OnOff: uint8
  CAN3_V2BAux1RlyFlt: uint8
  CAN3_V2BAux1RlySta: uint8
  CAN3_V2BAux2OnOff: uint8
  CAN3_V2BAux2RlyFlt: uint8
  CAN3_V2BAux2RlySta: uint8
  CAN3_V2BAux3OnOff: uint8
  CAN3_V2BAux3RlyFlt: uint8
  CAN3_V2BAux3RlySta: uint8
  CAN3_V2BAux4ReyFlt: uint8
  CAN3_V2BAux4RlySta: uint8
  CAN3_V2BDCDCPosRlyFlt: uint8
  CAN3_V2BDCDCPosRlySta: uint8
  CAN3_V2BHVOnOff: uint8
  CAN3_V2BLifeSig: uint8
  CAN3_V2BMainPosRlyFlt: uint8
  CAN3_V2BMainPosRlySta: uint8
  CAN3_V2BOilPosRlyFlt: uint8
  CAN3_V2BOilPosRlySta: uint8
  CAN3_V2BVehSpd: uint8

DT_CAN4_SG_FD4_C100_0 = Simulink.Bus(HeaderFile="Rte_Type.h")
  CAN4_DCDCEnDemand: uint8
  CAN4_EACSpdDemand: uint16
  CAN4_FDC_CHA_EACEnDemand_Cmd: uint8
  CAN4_FDC_EHPS_EnDemand_Cmd: uint8
  CAN4_FDC_EHPS_SpdDemand_Cmd: uint16
  CAN4_VCULife2: uint8

DT_CAN5_SG_FD5_C100_0 = Simulink.Bus(HeaderFile="Rte_Type.h")
  CAN5_AlcLockSta: uint8
  CAN5_B2VAPlusSta: uint8
  CAN5_VCUHVILSta: uint8

DT_CAN7_SG_FD7_C100_0 = Simulink.Bus(HeaderFile="Rte_Type.h")
  CAN7_VCUKeyStatus: uint8

DT_CAN2_SG_FD2_C1000_0 = Simulink.Bus(HeaderFile="Rte_Type.h")
  CAN2_VCUVehAcclLimit: uint8
  CAN2_VCUVehSpdlimit: uint8

DT_CAN1_SG_FD1_C20_0 = Simulink.Bus(HeaderFile="Rte_Type.h")
  CAN1_DCCurr: uint16
  CAN1_DCVol: uint16
  CAN1_MaxTorqAvail: uint16
  CAN1_MinTorqAvail: uint16

DT_CAN1_SG_FD1_C200_0 = Simulink.Bus(HeaderFile="Rte_Type.h")
  CAN1_SysPowerMode: uint8

DT_CAN2_SG_FD2_C200_0 = Simulink.Bus(HeaderFile="Rte_Type.h")
  CAN2_CACPresWarn: uint8
  CAN2_FDC_VCU_VCUDRM_Sta: uint8
  CAN2_SysPowerMode: uint8

DT_CAN3_SG_FD3_C200_0 = Simulink.Bus(HeaderFile="Rte_Type.h")
  CAN3_ChrgFault: uint8
  CAN3_ChrgState: uint8
  CAN3_PowerDownFault: uint8
  CAN3_PowerDownState: uint8
  CAN3_PowerUpFault: uint8
  CAN3_PowerUpState: uint8
  CAN3_SysPowerMode: uint8
  CAN3_VCUIGNSta: uint8
  CAN3_VCUIRCSta: uint8
  CAN3_VCUPSSSta: uint8

DT_CAN3_SG_FD3_C200_1 = Simulink.Bus(HeaderFile="Rte_Type.h")
  CAN3_FDC_THCM_EWPPEReq_Cmd: uint8

DT_CAN4_SG_FD4_C200_0 = Simulink.Bus(HeaderFile="Rte_Type.h")
  CAN4_SysPowerMode: uint8
  CAN4_VCUIGNSta: uint8
  CAN4_VCUIRCSta: uint8

DT_CAN5_SG_FD5_C200_0 = Simulink.Bus(HeaderFile="Rte_Type.h")
  CAN5_SysPowerMode: uint8

DT_CAN6_SG_FD6_C200_0 = Simulink.Bus(HeaderFile="Rte_Type.h")
  CAN6_SysPowerMode: uint8

DT_CAN7_SG_FD7_C200_0 = Simulink.Bus(HeaderFile="Rte_Type.h")
  CAN7_SysPowerMode: uint8

DT_CAN1_SG_FD1_C250_0 = Simulink.Bus(HeaderFile="Rte_Type.h")
  CAN1_EMParasLoss: uint8
  CAN1_NFricPercTorq: uint8

DT_CAN1_SG_FD1_C50_0 = Simulink.Bus(HeaderFile="Rte_Type.h")
  CAN1_ActDriveDirect: uint8

DT_CAN1_SG_FD1_C50_1 = Simulink.Bus(HeaderFile="Rte_Type.h")
  CAN1_AccPedal1LowSW: uint8
  CAN1_AccPedalPos1: uint8
  CAN1_EEC2MSGCS: uint8
  CAN1_EEC2MSGCnt: uint8

DT_CAN2_SG_FD2_C50_0 = Simulink.Bus(HeaderFile="Rte_Type.h")
  CAN2_EVEHCMSGCS: uint8
  CAN2_EVEHCMSGCnt: uint8
  CAN2_EVSysRls: uint8
  CAN2_ElecSysRdy: uint8
  CAN2_ExtAccLimReq: uint8
  CAN2_ExtDischgReq: uint8
  CAN2_ExtDriveMReq: uint8
  CAN2_ExtWorkshopMReq: uint8
  CAN2_RecuperLimOrReq: uint8

DT_CAN7_SG_FD7_C50_0 = Simulink.Bus(HeaderFile="Rte_Type.h")
  CAN7_AccPedalPos1: uint8

DT_CAN2_SG_FD2_C500_0 = Simulink.Bus(HeaderFile="Rte_Type.h")
  CAN2_IGNKeySta: uint8
  CAN2_VCU_VehicleSpd: uint16
  CAN2_VSPFunc: uint8

DT_CAN1_SG_FD1_C5000_0 = Simulink.Bus(HeaderFile="Rte_Type.h")
  CAN1_RC1MaxRetSpdP2: uint16
  CAN1_RC1PctTrqIdleP1: uint8
  CAN1_RC1PctTrqMaxSpdP2: uint8
  CAN1_RC1PctTrqP3: uint8
  CAN1_RC1PctTrqP4: uint8
  CAN1_RC1PctTrqPekTrqP5: uint8
  CAN1_RC1RefRetTrq: uint16
  CAN1_RC1RetCtrlMth: uint8
  CAN1_RC1RetLocat: uint8
  CAN1_RC1RetSpdIdleP1: uint16
  CAN1_RC1RetSpdP3: uint16
  CAN1_RC1RetSpdP4: uint16
  CAN1_RC1RetSpdPekTrqP5: uint16
  CAN1_RC1RetType: uint8

DT_CAN1_SG_FD1_C5000_1 = Simulink.Bus(HeaderFile="Rte_Type.h")
  CAN1_EMDefTrqLmt: uint16
  CAN1_EMEMRefTorq: uint16
  CAN1_EMEMSpdP2: uint16
  CAN1_EMEMSpdP3: uint16
  CAN1_EMEMSpdP4: uint16
  CAN1_EMEMSpdP5: uint16
  CAN1_EMExtRSCtrlUpLmt: uint16
  CAN1_EMGainEndSpdGvn: uint16
  CAN1_EMMaxMEngOvrSP7: uint16
  CAN1_EMMaxMOvrTLmt: uint8
  CAN1_EMMomOfInertia: uint16
  CAN1_EMPercTorqIdleP1: uint8
  CAN1_EMPercTorqP2: uint8
  CAN1_EMPercTorqP3: uint8
  CAN1_EMPercTorqP4: uint8
  CAN1_EMPercTorqP5: uint8
  CAN1_EMReqSpdCtrlLoLmt: uint8
  CAN1_EMReqSpdCtrlUpLmt: uint8
  CAN1_EMReqTrqCtrlLoLmt: uint8
  CAN1_EMReqTrqCtrlUpLmt: uint8
  CAN1_EMSpdHIdleP6: uint16
  CAN1_EMSpdIdleP1: uint16
  CAN1_EMSupTSC1CtrlPG1: uint8
  CAN1_EMSupTSC1CtrlPG2: uint8
  CAN1_EMSupTSC1CtrlPG3: uint8
  CAN1_EMSupTSC1CtrlPG4: uint8
  CAN1_EMSupVarRTSC1MSG: uint8

DT_CAN1_SG_FD1_C80_0 = Simulink.Bus(HeaderFile="Rte_Type.h")
  CAN1_DLEngaged: uint8
  CAN1_ShiftPgs: uint8

DT_CAN1_SG_FD1_CE100_0 = Simulink.Bus(HeaderFile="Rte_Type.h")
  CAN1_CFGEM1DT0: uint8
  CAN1_CFGEM1DT1: uint8
  CAN1_CFGEM1DT2: uint8
  CAN1_CFGEM1DT3: uint8
  CAN1_CFGEM1DT4: uint8
  CAN1_CFGEM1DT5: uint8
  CAN1_CFGEM1DT6: uint8
  CAN1_CFGEM1DT7: uint8

DT_CAN1_SG_FD1_CE100_1 = Simulink.Bus(HeaderFile="Rte_Type.h")
  CAN1_CFGEM1BAMPGN: uint32
  CAN1_CFGEM1BAMRsv: uint8
  CAN1_CFGEM1BAMTNum: uint8
  CAN1_CFGEM1BAMTSize: uint16
  CAN1_CFGEM1Ctrl: uint8

DT_CAN1_SG_AC_BTMS_C1000_0 = Simulink.Bus(HeaderFile="Rte_Type.h")
  CAN1_ACAmbTemp: uint16
  CAN1_ACCabinTemp: uint16
  CAN1_THCM_Reserve1_Sta: uint8
  CAN1_THCM_Reserve2_Sta: uint8
  CAN1_THCM_Reserve3_Sta: uint8
  CAN1_THCM_Reserve4_Sta: uint8

DT_CAN1_SG_AC_BTMS_C1000_1 = Simulink.Bus(HeaderFile="Rte_Type.h")
  CAN1_ACFanSpdSta: uint8
  CAN1_ACMODESta: uint8
  CAN1_ACPwrSta: uint8
  CAN1_THCM_Outcycle_Sta: uint8
  CAN1_THCM_Reserve10_Sta: uint8
  CAN1_THCM_Reserve11_Sta: uint8
  CAN1_THCM_Reserve12_Sta: uint8
  CAN1_THCM_Reserve13_Sta: uint8
  CAN1_THCM_Reserve5_Sta: uint8
  CAN1_THCM_Reserve6_Sta: uint8
  CAN1_THCM_Reserve7_Sta: uint8
  CAN1_THCM_Reserve8_Sta: uint8
  CAN1_THCM_Reserve9_Sta: uint8

DT_CAN1_SG_AC_BTMS_C1000_4 = Simulink.Bus(HeaderFile="Rte_Type.h")
  CAN1_TM2BFaultCode: uint8
  CAN1_TM2BFaultLv: uint8
  CAN1_TM2BInletTemp: uint8
  CAN1_TM2BOutletTemp: uint8
  CAN1_TM2BRQPower: uint16
  CAN1_TM2BTMSHVRlySta: uint8
  CAN1_TM2BWorkStatus: uint8

DT_CAN1_SG_AC_BTMS_C5000_0 = Simulink.Bus(HeaderFile="Rte_Type.h")
  CAN1_ACTempSetSta: uint8

DT_CAN1_SG_ASC1_A = Simulink.Bus(HeaderFile="Rte_Type.h")
  CAN1_ASC1KneelingInfo: uint8

DT_CAN1_SG_EBC1 = Simulink.Bus(HeaderFile="Rte_Type.h")
  CAN1_ABSFullyOper: uint8
  CAN1_ABSOffroadSw: uint8
  CAN1_ASRBrakeCtrlAtc: uint8
  CAN1_ASREngCtrlAtc: uint8
  CAN1_ASRHillHolderSw: uint8
  CAN1_ASROffroadSw: uint8
  CAN1_ATCASRInfoSig: uint8
  CAN1_AcltrInterlockSw: uint8
  CAN1_AntiLBrakABSAct: uint8
  CAN1_BrakePedalPos: uint8
  CAN1_EBSAmWarnLampSta: uint8
  CAN1_EBSBrakeSw: uint8
  CAN1_EBSRedWarnLampSta: uint8
  CAN1_EngAuxShutdownSw: uint8
  CAN1_EngDerateSw: uint8
  CAN1_EngRetSel: uint8
  CAN1_HaltBrakeSw: uint8
  CAN1_RmAccelEnSw: uint8
  CAN1_SACtrlBrakeCtrl: uint8
  CAN1_TractCtrlOvrSw: uint8
  CAN1_TrailerABSSta: uint8
  CAN1_TrailerABSWarnSig: uint8

DT_CAN1_SG_EBC2 = Simulink.Bus(HeaderFile="Rte_Type.h")
  CAN1_FASpeed: uint16
  CAN1_RelaSpdFALWheel: uint8
  CAN1_RelaSpdFARWheel: uint8
  CAN1_RelaSpdRA1LWheel: uint8
  CAN1_RelaSpdRA1RWheel: uint8
  CAN1_RelaSpdRA2LWheel: uint8
  CAN1_RelaSpdRA2RWheel: uint8

DT_CAN1_SG_EBC5 = Simulink.Bus(HeaderFile="Rte_Type.h")
  CAN1_BrkTempeWarn: uint8
  CAN1_EmhBrkAct: uint8
  CAN1_FndBrkUse: uint8
  CAN1_HaltBrkMode: uint8
  CAN1_HillHolderMode: uint8
  CAN1_ParkBrkActuFAct: uint8
  CAN1_RailroadMode: uint8
  CAN1_XBRAcltnLimit: uint8
  CAN1_XBRActtrlMode: uint8
  CAN1_XBRSysSta: uint8

DT_CAN1_SG_ECAS_DM1 = Simulink.Bus(HeaderFile="Rte_Type.h")
  CAN1_ECASAWarmLampSta: uint8

DT_CAN1_SG_EMC1_EM1 = Simulink.Bus(HeaderFile="Rte_Type.h")
  CAN1_EM1CS: uint8
  CAN1_EM1Cnt: uint8
  CAN1_EM1OvrCtrlMBrk: uint8
  CAN1_EM1OvrCtrlMDriv: uint8
  CAN1_EM1OvrCtrlMPriBrk: uint8
  CAN1_EM1OvrCtrlMPriDriv: uint8
  CAN1_EM1ReqTorqHRlsBrk: uint8
  CAN1_EM1ReqTorqHRlsDri: uint8
  CAN1_EM1ReqTorqLimBrk: uint8
  CAN1_EM1ReqTorqLimDriv: uint8

DT_CAN1_SG_HRW = Simulink.Bus(HeaderFile="Rte_Type.h")
  CAN1_WhlSpeed_FL: uint16
  CAN1_WhlSpeed_FR: uint16
  CAN1_WhlSpeed_RL: uint16
  CAN1_WhlSpeed_RR: uint16

DT_CAN1_SG_TC1 = Simulink.Bus(HeaderFile="Rte_Type.h")
  CAN1_DrivDirF: uint8
  CAN1_DrivDirN: uint8
  CAN1_DrivDirR: uint8
  CAN1_LifeCnt: uint8
  CAN1_TransReqGear: uint8

DT_CAN2_SG_IVI_C100_0 = Simulink.Bus(HeaderFile="Rte_Type.h")
  CAN2_IVI_ACCoolTempSetdownReq_Cmd: uint8
  CAN2_IVI_ACCoolTempSetupReq_Cmd: uint8
  CAN2_IVI_ACFanSpdReq_Cmd: uint8
  CAN2_IVI_ACHeatTempSetDownReq_Cmd: uint8
  CAN2_IVI_ACHeatTempSetUPReq_Cmd: uint8
  CAN2_IVI_ACMODEReq_Cmd: uint8
  CAN2_IVI_ACOutCycleReq_Cmd: uint8
  CAN2_IVI_ACPwrReq_Cmd: uint8
  CAN2_IVI_ACRemoteReq_Cmd: uint8
  CAN2_IVI_ACTempSet_Cmd: uint8

DT_CAN3_SG_B2TM_Info = Simulink.Bus(HeaderFile="Rte_Type.h")
  CAN3_B2TChgSta: uint8
  CAN3_B2THVCmd: uint8
  CAN3_B2THVRlySta: uint8
  CAN3_B2TMCRC: uint8
  CAN3_B2TMLifeSig: uint8
  CAN3_B2TPackVol: uint16
  CAN3_B2TSetModeA: uint8
  CAN3_B2TSetTemp: uint8

DT_CAN3_SG_B2V_BattInfo1 = Simulink.Bus(HeaderFile="Rte_Type.h")
  CAN3_B2VBI1BattType: uint8
  CAN3_B2VBI1RateCap: uint16
  CAN3_B2VBI1RateHVolt: uint16
  CAN3_B2VBI1RatePower: uint16

DT_CAN3_SG_B2V_CurrentLimit = Simulink.Bus(HeaderFile="Rte_Type.h")
  CAN3_B2VAPlsDischgCurr: uint16
  CAN3_B2VAvaPlsChgCurr: uint16

DT_CAN3_SG_B2V_Fult1_32960 = Simulink.Bus(HeaderFile="Rte_Type.h")
  CAN3_B2VHVILFault: uint8

DT_CAN3_SG_B2V_ST1 = Simulink.Bus(HeaderFile="Rte_Type.h")
  CAN3_B2VACChgConnSta: uint8
  CAN3_B2VACChgNegRlySta: uint8
  CAN3_B2VACChgPosRlySta: uint8
  CAN3_B2VAux1RlySta: uint8
  CAN3_B2VAux2RlySta: uint8
  CAN3_B2VAux3RlySta: uint8
  CAN3_B2VBMUBalSta: uint8
  CAN3_B2VBMUHVSta: uint8
  CAN3_B2VChgMode: uint8
  CAN3_B2VChgSta: uint8
  CAN3_B2VCoolingSta: uint8
  CAN3_B2VDCChgConnSta: uint8
  CAN3_B2VDCChgN1RlySta: uint8
  CAN3_B2VDCChgN2RlySta: uint8
  CAN3_B2VDCChgP1RlySta: uint8
  CAN3_B2VDCChgP2RlySta: uint8
  CAN3_B2VHeatNegRelaySta: uint8
  CAN3_B2VHeatPosRlySta: uint8
  CAN3_B2VHeatingSta: uint8
  CAN3_B2VMainNegRlySta: uint8
  CAN3_B2VMainPosRlySta: uint8
  CAN3_B2VPChgPosRlySta: uint8
  CAN3_B2VPChrgConnSta: uint8
  CAN3_B2VPChrgNegRlySta: uint8
  CAN3_B2VPrechgRelaySta: uint8
  CAN3_B2VST1RChrgCy: uint32

DT_CAN3_SG_B2V_ST2 = Simulink.Bus(HeaderFile="Rte_Type.h")
  CAN3_B2VFaultCode: uint8
  CAN3_B2VFaultLv: uint8
  CAN3_B2VPackCurr: uint16
  CAN3_B2VPackInsideVol: uint16
  CAN3_B2VRqHVPwrOff: uint8
  CAN3_B2VSOC: uint8
  CAN3_B2VSOH: uint8
  CAN3_B2VST2LifeSig: uint8

DT_CAN3_SG_B2V_ST4 = Simulink.Bus(HeaderFile="Rte_Type.h")
  CAN3_B2VCellAvgTemp: uint8
  CAN3_B2VMaxTempCSCSN: uint8
  CAN3_B2VMaxTempPos: uint8
  CAN3_B2VMinTempCSCSN: uint8
  CAN3_B2VMinTempPos: uint8
  CAN3_B2VPackMaxTemp: uint8
  CAN3_B2VPackMinTemp: uint8

DT_CAN3_SG_B2V_ST5 = Simulink.Bus(HeaderFile="Rte_Type.h")
  CAN3_B2VCellMinVol: uint16

DT_CAN3_SG_EWP1 = Simulink.Bus(HeaderFile="Rte_Type.h")
  CAN3_EWPPEFault: uint8

DT_CAN3_SG_TM_MCUSta1 = Simulink.Bus(HeaderFile="Rte_Type.h")
  CAN3_AtvDisChgEnFbk: uint8
  CAN3_MCUCtrlMdSta: uint8
  CAN3_MCUIGBTEnFbk: uint8
  CAN3_MCUMsgSta1LCnt: uint8
  CAN3_MotorSpd: uint16
  CAN3_MotorTrq: uint16

DT_CAN3_SG_TM_MCUSta2 = Simulink.Bus(HeaderFile="Rte_Type.h")
  CAN3_MCUFailGrade: uint8
  CAN3_MCUMsgSta2LCnt: uint8
  CAN3_MCUTemp: uint8
  CAN3_MCUTrqLimHi: uint16
  CAN3_MCUTrqLimLo: uint16
  CAN3_MotorTemp: uint8

DT_CAN3_SG_TM_MCUSta3 = Simulink.Bus(HeaderFile="Rte_Type.h")
  CAN3_MCUDCCur: uint16
  CAN3_MCUDCVol: uint16
  CAN3_MCUFailCode: uint8

DT_CAN4_SG_ZFR_C100_0 = Simulink.Bus(HeaderFile="Rte_Type.h")
  CAN4_ParkBrakeSW: uint8

DT_CAN4_SG_ZFR_CE100_0 = Simulink.Bus(HeaderFile="Rte_Type.h")
  CAN4_AirPressureFC2: uint8
  CAN4_ZFR_BCM_AutoLightSW_Sta: uint8
  CAN4_ZFR_BCM_BSD_Dimmer_Sta: uint8
  CAN4_ZFR_BCM_BacklightDuty_Sta: uint8
  CAN4_ZFR_BCM_Brake_Sta: uint8
  CAN4_ZFR_BCM_DVRMidDoor_Sta: uint8
  CAN4_ZFR_BCM_DVRSignalL_Sta: uint8
  CAN4_ZFR_BCM_DVRSignalR_Sta: uint8
  CAN4_ZFR_BCM_DVRSignalReverse_Sta: uint8
  CAN4_ZFR_BCM_HBeamSW_Sta: uint8
  CAN4_ZFR_BCM_HBeam_Sta: uint8
  CAN4_ZFR_BCM_HeadLpSW_Sta: uint8
  CAN4_ZFR_BCM_HornSW_Sta: uint8
  CAN4_ZFR_BCM_LBSDR_Sta: uint8
  CAN4_ZFR_BCM_LBSDY_Sta: uint8
  CAN4_ZFR_BCM_LBeam_Sta: uint8
  CAN4_ZFR_BCM_LDRL_Sta: uint8
  CAN4_ZFR_BCM_LFTurnLpC_Sta: uint8
  CAN4_ZFR_BCM_LFTurnLp_Sta: uint8
  CAN4_ZFR_BCM_LightSensorV_Sta: uint8
  CAN4_ZFR_BCM_PLamp_Sta: uint8
  CAN4_ZFR_BCM_PosLpSW_Sta: uint8
  CAN4_ZFR_BCM_RBSDR_Sta: uint8
  CAN4_ZFR_BCM_RBSDY_Sta: uint8
  CAN4_ZFR_BCM_RDRL_Sta: uint8
  CAN4_ZFR_BCM_RFTurnLpC_Sta: uint8
  CAN4_ZFR_BCM_RFTurnLp_Sta: uint8
  CAN4_ZFR_BCM_RFogLp_SW_Sta: uint8
  CAN4_ZFR_BCM_Seatbelt_Sta: uint8
  CAN4_ZFR_BCM_TurnBuzzer_Sta: uint8
  CAN4_ZFR_BCM_WasherSW_Sta: uint8
  CAN4_ZFR_BCM_Washer_Sta: uint8
  CAN4_ZFR_BCM_WiperAS_Sta: uint8
  CAN4_ZFR_BCM_WiperHSW_Sta: uint8
  CAN4_ZFR_BCM_WiperH_Sta: uint8
  CAN4_ZFR_BCM_WiperLSW_Sta: uint8
  CAN4_ZFR_BCM_WiperL_Sta: uint8

DT_CAN4_SG_ZRR_CE100_0 = Simulink.Bus(HeaderFile="Rte_Type.h")
  CAN4_ZRR_BCM_AllDoor_Sta: uint8

DT_CAN4_SG_ZRR_CE100_1 = Simulink.Bus(HeaderFile="Rte_Type.h")
  CAN4_AirPressurePC3: uint8
  CAN4_AirPressureRC1: uint8
  CAN4_FDC_CHASSIS_VCUEACPress_Sta: uint8
  CAN4_ZRR_BCM_BrakeLp_Sta: uint8
  CAN4_ZRR_BCM_CallingSW_Sta: uint8
  CAN4_ZRR_BCM_EmLight_Sta: uint8
  CAN4_ZRR_BCM_EmSV_Sta: uint8
  CAN4_ZRR_BCM_FDCloseSV_Sta: uint8
  CAN4_ZRR_BCM_FDOpenSV_Sta: uint8
  CAN4_ZRR_BCM_FDoorAP_Sta: uint8
  CAN4_ZRR_BCM_LRTurnLpC_Sta: uint8
  CAN4_ZRR_BCM_LRTurnLp_Sta: uint8
  CAN4_ZRR_BCM_MDCloseSV_Sta: uint8
  CAN4_ZRR_BCM_MDOpenSV_Sta: uint8
  CAN4_ZRR_BCM_MDoorAP_Sta: uint8
  CAN4_ZRR_BCM_PLamp_Sta: uint8
  CAN4_ZRR_BCM_RFLamp_Sta: uint8
  CAN4_ZRR_BCM_RRTurnLpC_Sta: uint8
  CAN4_ZRR_BCM_RRTurnLp_Sta: uint8
  CAN4_ZRR_BCM_ReverseBuz_Sta: uint8
  CAN4_ZRR_BCM_ReverseLp_Sta: uint8
  CAN4_ZRR_BCM_RoomLpAmb_Sta: uint8
  CAN4_ZRR_BCM_SLTLp_Sta: uint8
  CAN4_ZRR_BCM_SMKL_Sta: uint8
  CAN4_ZRR_BCM_SMKR_Sta: uint8
  CAN4_ZRR_BCM_SRTLp_Sta: uint8
  CAN4_ZRR_BCM_STOPSW2_Sta: uint8
  CAN4_ZRR_BCM_STOPSW_Sta: uint8
  CAN4_ZRR_BCM_StopLight_Sta: uint8
  CAN4_ZRR_BCM_TurnBuzzer_Sta: uint8

DT_CAN4_SG_zGW_CANRr1_C50_0 = Simulink.Bus(HeaderFile="Rte_Type.h")
  CAN4_DCDC_En_Sta: uint8
  CAN4_DCDC_ErrLv_Sta: uint8
  CAN4_DCDC_LifeSig_Sta: uint8
  CAN4_DCDC_OutVol_Sta: uint16
  CAN4_DCDC_Temp_Sta: uint8
  CAN4_EAC_En_Sta: uint8
  CAN4_EAC_ErrLv_Sta: uint8
  CAN4_EAC_InvTemp_Sta: uint8
  CAN4_EAC_LifeSig_Sta: uint8
  CAN4_EHPS_En_Sta: uint8
  CAN4_EHPS_ErrLv_Sta: uint8
  CAN4_EHPS_InvTemp_Sta: uint8
  CAN4_EHPS_LifeSig_Sta: uint8
  CAN4_EHPS_MotorSpd_Sta: uint16
  CAN4_PDU_ACRly_Sta: uint8
  CAN4_PDU_DCDCEACEHPSHVLoop_Sta: uint8
  CAN4_PDU_DCDCEACEHPSPreRly_Sta: uint8
  CAN4_PDU_DCDCEACEHPSRly_Sta: uint8
  CAN4_PDU_DeFogTMSRly_Sta: uint8
  CAN4_PDU_HVIL_Sta: uint8
  CAN4_PDU_LifeSig_Sta: uint8
  CAN4_PDU_MCUHVLoop_Sta: uint8
  CAN4_PDU_MCUPosRly_Sta: uint8
  CAN4_PDU_MCUPreRly_Sta: uint8
  CAN4_PDU_SelfChk_Sta: uint8

DT_CAN1_SG_AC_BTMS_C1000_2 = Simulink.Bus(HeaderFile="Rte_Type.h")
  CAN1_THCM_Faultlv_Sta: uint8

DT_CAN1_SG_TPMS1 = Simulink.Bus(HeaderFile="Rte_Type.h")
  CAN1_LBIBatWarn: uint8
  CAN1_LBIPressIndi: uint8
  CAN1_LBISensorFail: uint8
  CAN1_LBIWheelTmpIndi: uint8
  CAN1_LBOBatWarn: uint8
  CAN1_LBOPressIndi: uint8
  CAN1_LBOSensorFail: uint8
  CAN1_LBOWheelTmpIndi: uint8
  CAN1_LFBatWarn: uint8
  CAN1_LFPressIndi: uint8
  CAN1_LFSensorFail: uint8
  CAN1_LFWheelTmpIndi: uint8
  CAN1_RBIBatWarn: uint8
  CAN1_RBIPressIndi: uint8
  CAN1_RBISensorFail: uint8
  CAN1_RBIWheelTmpIndi: uint8
  CAN1_RBOBatWarn: uint8
  CAN1_RBOPressIndi: uint8
  CAN1_RBOSensorFail: uint8
  CAN1_RBOWheelTmpIndi: uint8
  CAN1_RFBatWarn: uint8
  CAN1_RFPressIndi: uint8
  CAN1_RFSensorFail: uint8
  CAN1_RFWheelTmpIndi: uint8
  CAN1_TPMSWarnIndi: uint8

DT_CAN1_SG_TPMS2 = Simulink.Bus(HeaderFile="Rte_Type.h")
  CAN1_LBIWheelPress: uint8
  CAN1_LBOWheelPress: uint8
  CAN1_LFWheelPress: uint8
  CAN1_RBIWheelPress: uint8
  CAN1_RBOWheelPress: uint8
  CAN1_RFWheelPress: uint8

DT_CAN1_SG_TPMS3 = Simulink.Bus(HeaderFile="Rte_Type.h")
  CAN1_LBIWheelTemp: uint8
  CAN1_LBOWheelTemp: uint8
  CAN1_LFWheelTemp: uint8
  CAN1_RBIWheelTemp: uint8
  CAN1_RBOWheelTemp: uint8
  CAN1_RFWheelTemp: uint8

DT_CAN1_SG_VDC1 = Simulink.Bus(HeaderFile="Rte_Type.h")
  CAN1_VDCBrakeLightReq: uint8

DT_CAN4_SG_ZFR_C5000_0 = Simulink.Bus(HeaderFile="Rte_Type.h")
  CAN4_ZFR_CHASSIS_LiningWearFL_Sta: uint8
  CAN4_ZFR_CHASSIS_LiningWearFR_Sta: uint8

DT_CAN4_SG_ZRR_C5000_0 = Simulink.Bus(HeaderFile="Rte_Type.h")
  CAN4_ZRR_CHASSIS_LiningWearRL_Sta: uint8
  CAN4_ZRR_CHASSIS_LiningWearRR_Sta: uint8

DT_CAN1_SG_FD1_C1000_0 = Simulink.Bus(HeaderFile="Rte_Type.h")
  CAN1_AirPressureFC2: uint8
  CAN1_AirPressurePC3: uint8
  CAN1_AirPressureRC1: uint8

DT_CAN1_SG_CGW_FD1_C100_3 = Simulink.Bus(HeaderFile="Rte_Type.h")
  CAN1_ParkBrakeSW: uint8

DT_CAN2_SG_CGW_FD2_C1000_0 = Simulink.Bus(HeaderFile="Rte_Type.h")
  CAN2_ACMODESta: uint8
  CAN2_LBIBatWarn: uint8
  CAN2_LBIPressIndi: uint8
  CAN2_LBISensorFail: uint8
  CAN2_LBIWheelPress: uint8
  CAN2_LBIWheelTemp: uint8
  CAN2_LBIWheelTmpIndi: uint8
  CAN2_LBOBatWarn: uint8
  CAN2_LBOPressIndi: uint8
  CAN2_LBOSensorFail: uint8
  CAN2_LBOWheelPress: uint8
  CAN2_LBOWheelTemp: uint8
  CAN2_LBOWheelTmpIndi: uint8
  CAN2_LFBatWarn: uint8
  CAN2_LFPressIndi: uint8
  CAN2_LFSensorFail: uint8
  CAN2_LFWheelPress: uint8
  CAN2_LFWheelTemp: uint8
  CAN2_LFWheelTmpIndi: uint8
  CAN2_RBIBatWarn: uint8
  CAN2_RBIPressIndi: uint8
  CAN2_RBISensorFail: uint8
  CAN2_RBIWheelPress: uint8
  CAN2_RBIWheelTmpIndi: uint8
  CAN2_RBOBatWarn: uint8
  CAN2_RBOPressIndi: uint8
  CAN2_RBOSensorFail: uint8
  CAN2_RBOWheelPress: uint8
  CAN2_RBOWheelTemp: uint8
  CAN2_RBOWheelTmpIndi: uint8
  CAN2_RFBatWarn: uint8
  CAN2_RFPressIndi: uint8
  CAN2_RFSensorFail: uint8
  CAN2_RFWheelPress: uint8
  CAN2_RFWheelTemp: uint8
  CAN2_RFWheelTmpIndi: uint8
  CAN2_THCM_Faultlv_Sta: uint8
  CAN2_TPMSWarnIndi: uint8

DT_CAN2_SG_CGW_GW2_C100_0 = Simulink.Bus(HeaderFile="Rte_Type.h")
  CAN2_ABSFullyOper: uint8
  CAN2_ACTempSetSta: uint8
  CAN2_ASC1KneelingInfo: uint8
  CAN2_ASRBrakeCtrlAtc: uint8
  CAN2_ASREngCtrlAtc: uint8
  CAN2_AirPressureRC1: uint8
  CAN2_B2THVRlySta: uint8
  CAN2_B2VBI1BattType: uint8
  CAN2_B2VBI1RateCap: uint16
  CAN2_B2VBI1RateHVolt: uint16
  CAN2_B2VBI1RatePower: uint16
  CAN2_B2VChgMode: uint8
  CAN2_B2VChgSta: uint8
  CAN2_B2VDCChgConnSta: uint8
  CAN2_B2VFaultCode: uint8
  CAN2_B2VPChrgConnSta: uint8
  CAN2_B2VSOC: uint8
  CAN2_B2VSOH: uint8
  CAN2_DCDC_En_Sta: uint8
  CAN2_EBSAmWarnLampSta: uint8
  CAN2_EBSBrakeSw: uint8
  CAN2_EBSRedWarnLampSta: uint8
  CAN2_ECASAWarmLampSta: uint8
  CAN2_EHPS_ErrLv_Sta: uint8
  CAN2_MCUFailGrade: uint8
  CAN2_ParkBrakeSW: uint8
  CAN2_TransReqGear: uint8
  CAN2_VDCBrakeLightReq: uint8
  CAN2_WhlSpeed_FL: uint16
  CAN2_WhlSpeed_FR: uint16
  CAN2_WhlSpeed_RL: uint16
  CAN2_WhlSpeed_RR: uint16
  CAN2_ZFR_CHASSIS_LiningWearFL_Sta: uint8
  CAN2_ZFR_CHASSIS_LiningWearFR_Sta: uint8
  CAN2_ZRR_CHASSIS_LiningWearRL_Sta: uint8
  CAN2_ZRR_CHASSIS_LiningWearRR_Sta: uint8